# Grasshopper definition 20230727_Baseline_EnergyMode_10_Ideal_WholeBldPrgm_ZW_v1.5_L2only.gh (Grasshopper 1.0.7)

# ---- group: 90.1-2016 - MedOffice - ASHRAE 169-2013-2B
opaquemat = HBOpaqueMaterial(
    name="25mm Stucco",
    thickness="0.0254",
    conductivity="0.72",
    density="1856",
    spec_heat="840",
    roughness="Smooth",
    therm_absp="0.9",
    sol_absp="0.7",
    vis_absp="0.7")  # -> mat; plug-in component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
opaquemat_2 = HBOpaqueMaterial(
    name="5/8 in. Gypsum Board",
    thickness="0.0159",
    conductivity="0.16",
    density="800",
    spec_heat="1090",
    roughness="MediumSmooth",
    therm_absp="0.9",
    sol_absp="0.7",
    vis_absp="0.7")  # -> mat; plug-in component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
opaquematnomass = HBOpaqueMaterialNoMass(
    name="Typical Insulation R-9.73",
    r_value="1.712828",
    roughness="Smooth",
    therm_absp="0.9",
    sol_absp="0.7",
    vis_absp="0.7")  # -> mat; plug-in component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

# ---- group: 90.1-2016 - MedOffice - Plenum - ASHRAE 169-2013-2B
opaquemat_3 = HBOpaqueMaterial(
    name="Acoustic Tile - 1/2 in.",
    thickness="0.0127",
    conductivity="0.057633",
    density="288.332341",
    spec_heat="795.492",
    roughness="MediumSmooth",
    therm_absp="0.9",
    sol_absp="0.00",
    vis_absp="0.00")  # -> mat; plug-in component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

# ---- group: 90.1-2016 - MedOffice - ASHRAE 169-2013-2B
opaquemat_4 = HBOpaqueMaterial(
    name="Roof Membrane - Highly",
    thickness="0.0095",
    conductivity="0.16",
    density="1211.29",
    spec_heat="1460",
    roughness="VeryRough",
    therm_absp="0.75",
    sol_absp="0.45",
    vis_absp="0.70")  # -> mat; plug-in component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
opaquematnomass_2 = HBOpaqueMaterialNoMass(
    name="Typical Insulation R-24.52",
    r_value="4.318887",
    roughness="Smooth",
    therm_absp="0.9",
    sol_absp="0.7",
    vis_absp="0.7")  # -> mat; plug-in component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
opaquemat_5 = HBOpaqueMaterial(
    name="Metal Roof Surface",
    thickness="0.0008",
    conductivity="45.28",
    density="7824",
    spec_heat="500",
    roughness="Smooth",
    therm_absp="0.9",
    sol_absp="0.70",
    vis_absp="0.70")  # -> mat; plug-in component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

opaquematnomass_3 = HBOpaqueMaterialNoMass(name="Typical Carpet pad", r_value="0.216480", roughness="Smooth", therm_absp="0.9", sol_absp="0.7", vis_absp="0.8")  # -> mat; plug-in component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
opaquemat_6 = HBOpaqueMaterial(
    name="8in. Normalweight Concrete",
    thickness="0.2032",
    conductivity="2.31",
    density="2322",
    spec_heat="832",
    roughness="MediumRough",
    therm_absp="0.9",
    sol_absp="0.7",
    vis_absp="0.7")  # -> mat; plug-in component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

opaquematnomass_4 = HBOpaqueMaterialNoMass(
    name="Typical Insulation R-6.78",
    r_value="0.216480",
    roughness="Smooth",
    therm_absp="0.9",
    sol_absp="0.7",
    vis_absp="0.8")  # -> mat; plug-in component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
opaquematnomass_5 = HBOpaqueMaterialNoMass(name="Typical Carpet pad", r_value="0.216480", roughness="Smooth", therm_absp="0.9", sol_absp="0.7", vis_absp="0.8")  # -> mat; plug-in component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
opaquemat_7 = HBOpaqueMaterial(
    name="4in. Normalweight Concrete",
    thickness="0.1016",
    conductivity="2.31",
    density="2322",
    spec_heat="832",
    roughness="MediumRough",
    therm_absp="0.9",
    sol_absp="0.7",
    vis_absp="0.7")  # -> mat; plug-in component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

opaquemat_8 = HBOpaqueMaterial(
    name="G01 13mm gypsum board",
    thickness="0.0127",
    conductivity="0.16",
    density="800",
    spec_heat="1090",
    roughness="Smooth",
    therm_absp="0.9",
    sol_absp="0.7",
    vis_absp="0.5")  # -> mat; plug-in component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
opaquematnomass_6 = HBOpaqueMaterialNoMass(name="CP02 Carpet Pad", r_value="0.216480", roughness="VeryRough", therm_absp="0.9", sol_absp="0.7", vis_absp="0.8")  # -> mat; plug-in component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
opaquemat_9 = HBOpaqueMaterial(
    name="100mm Normalweight Concrete floor",
    thickness="0.101600",
    conductivity="2.31",
    density="2322",
    spec_heat="832",
    roughness="MediumSmooth",
    therm_absp="0.9",
    sol_absp="0.7",
    vis_absp="0.7")  # -> mat; plug-in component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

opaquemat_10 = HBOpaqueMaterial(
    name="F08 Metal Surface",
    thickness="0.0008",
    conductivity="45.28",
    density="7824",
    spec_heat="500",
    roughness="Smooth",
    therm_absp="0.9",
    sol_absp="0.7",
    vis_absp="0.7")  # -> mat; plug-in component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
opaquematnomass_7 = HBOpaqueMaterialNoMass(
    name="Typical Insulation R-1.85",
    r_value="0.326262",
    roughness="Smooth",
    therm_absp="0.9",
    sol_absp="0.7",
    vis_absp="0.7")  # -> mat; plug-in component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

windowmat = HBWindowMaterial(u_factor="3.066262", shgc="0.25")  # -> mat; plug-in component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

# ---- group: Internal Mass
opaquemat_11 = HBOpaqueMaterial(
    name="Std Wood 6inch",
    thickness="0.15",
    conductivity="0.12",
    density="540",
    spec_heat="1210",
    roughness="MediumSmooth",
    therm_absp="0.9",
    sol_absp="0.7",
    vis_absp="0.7")  # -> mat; plug-in component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
opaqueconstr = HBOpaqueConstruction(name="InteriorFurnishings", materials=opaquemat_11)  # -> constr; plug-in component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

# ---- group: Input Plenum
rooms = Brep(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)

# ---- group: Input Rooms
rooms_2 = Brep(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)

# ----
bldgvintages = HBBuildingVintages({"ASHRAE 90.1 2019  |  IECC 2021": "2019", "ASHRAE 90.1 2016  |  IECC 2018": "2016", "ASHRAE 90.1 2013  |  IECC 2015": "2013", "ASHRAE 90.1 2010  |  IECC 2012": "2010", "ASHRAE 90.1 2007  |  IECC 2009": "2007", "ASHRAE 90.1 2004  |  IECC 2006": "2004", "1980-2004 (CBECS)": "1980_2004", "Pre-1980 (CBECS)": "pre_1980"}, selected="ASHRAE 90.1 2016  |  IECC 2018")
constructiontypes = HBConstructionTypes({"SteelFramed", "WoodFramed", "Mass", "Metal Building"}, selected="SteelFramed")
constrsetclimate = HBConstructionSetByClimate(climate_zone="2B", vintage=bldgvintages, constr_type=constructiontypes)  # -> constr_set; plug-in component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
searchprog = HBSearchPrograms(vintage=bldgvintages, keywords="Whole")  # -> room_prog; plug-in component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

# ---- group: Inteiror Walls
perimeter_thermal_zone_depth = Panel("4.572")
debrep = DeconstructBrep(Brep=rooms_2)  # -> Faces, Edges, Vertices
item = ListItem(List=debrep.Faces, Index=0, Wrap=True)  # -> Item, Item1, Item2
floor_to_ceiling_height = Panel("2.74")
skeleton = HBStraightSkeleton(floor_geo=item.Item, offset=perimeter_thermal_zone_depth)  # -> polyskel, perim_poly, core_poly; plug-in component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
lng = ListLength(List=flatten(skeleton.perim_poly))
lng_2 = ListLength(List=flatten(item.Item))
division = Division(A=lng, B=lng_2)
Z = UnitZ(Factor=floor_to_ceiling_height)
extr = Extrude(Base=skeleton.perim_poly, Direction=Z)
partition = PartitionList(List=extr, Size=division)
extr_2 = Extrude(Base=skeleton.core_poly, Direction=Z)  # -> graft(Extrusion)
partition_2 = PartitionList(List=skeleton.perim_poly, Size=division)
ins = InsertItems(List=partition, Item=extr_2, Indices=4, Wrap=True)

# ---- group: Boundary Condition
debrep_2 = DeconstructBrep(Brep=ins)  # -> Faces, Edges, Vertices
debrep_3 = DeconstructBrep(Brep=rooms)  # -> Faces, Edges, Vertices
panel = Panel("""1
4
7
10
13""")
item_2 = ListItem(List=debrep_2.Faces, Index=0, Wrap=True)
item_3 = ListItem(List=debrep_3.Faces, Index=panel, Wrap=True)
panel_2 = Panel("""Rm1_Wall_
Rm2_Wall_
Rm3_Wall_
Rm4_Wall_
Rm5_Wall_""")
face = HBFace(geo=flatten(item_2), name="ExposedFloor", bc="Adiabatic")  # -> report, graft(faces); plug-in component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
face_2 = HBFace(geo=debrep_2.Faces, name=graft(panel_2))  # -> report, faces; plug-in component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
face_3 = HBFace(geo=item_3, name="ExposedCeiling_", bc="Adiabatic")  # -> report, faces; plug-in component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
face_4 = HBFace(geo=debrep_3.Faces)  # -> report, faces; plug-in component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
replace = ReplaceItems(List=face_4.faces, Item=face_3.faces, Indices=panel, Wrap=False)
replace_2 = ReplaceItems(List=face_2.faces, Item=face.faces, Indices="0", Wrap=False)

# ----
decnstrconstrsetint = HBDeconstructConstructionSetInterior(constr_set=constrsetclimate)  # -> interior_wall, ceiling, interior_floor, interior_window, interior_door, int_glass_door; plug-in component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
searchmats = HBSearchMaterials(keywords="carpet")  # -> opaque_mats, window_mats; plug-in component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
decnstrconstrset = HBDeconstructConstructionSet(constr_set=constrsetclimate)  # -> exterior_wall, exterior_roof, exposed_floor, ground_wall, ground_roof, ground_floor, window, skylight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; plug-in component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
searchprog_2 = HBSearchPrograms(vintage=bldgvintages, keywords="Plenum")  # -> room_prog; plug-in component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
panel_3 = Panel(searchprog)
panel_4 = Panel(searchprog_2)
item_4 = ListItem(List=searchprog, Index="3", Wrap=True)
item_5 = ListItem(List=searchprog_2, Index="0", Wrap=True)

# ---- group: Plenum Program
programtype = HBProgramType()  # -> program; plug-in component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

# ----
roomattr = HBRoomAttributes({"Display Name": "display_name", "Simulation Name (Identifier)": "identifier", "Multiplier": "multiplier", "Floor Area Excluded": "exclude_floor_area", "Story": "story", "Volume": "volume", "Gross Floor Area": "floor_area", "Exposed Area": "exposed_area", "Exterior Wall Area": "exterior_wall_area", "Exterior Aperture Area": "exterior_aperture_area", "Average Floor Elevation": "average_floor_height"}, selected="Display Name")

# ---- group: Room Program
deconstrprogram = HBDeconstructProgramType(program=item_4)  # -> people, lighting, electric_equip, gas_equip, hot_water, infiltration, ventilation, setpoint; plug-in component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
programtype_2 = HBProgramType(
    name="custom_prototype_ideal_prog_perimeterRms",
    people=deconstrprogram.people,
    lighting=deconstrprogram.lighting,
    electric_equip=deconstrprogram.electric_equip,
    infiltration=deconstrprogram.infiltration,
    ventilation=deconstrprogram.ventilation,
    setpoint=deconstrprogram.setpoint)  # -> program; plug-in component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
programtype_3 = HBProgramType(
    name="custom_prototype_ideal_prog_core",
    people=deconstrprogram.people,
    lighting=deconstrprogram.lighting,
    electric_equip=deconstrprogram.electric_equip,
    ventilation=deconstrprogram.ventilation,
    setpoint=deconstrprogram.setpoint)  # -> program; plug-in component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

# ----
panel_5 = Panel("""0
0
0
0
0
0
0
0
0
0
0
0
0
0
0
0
0
0
0
0
0
0
0
0""")
panel_6 = Panel("""0
0
0
0
0
1
1
1
1
1
1
1
1
1
1
1
1
1
1
1
1
0
0
0""")
panel_7 = Panel("""0
0
0
0
0
1
1
1
1
1
1
1
1
1
1
1
1
1
0
0
0
0
0
0""")
panel_8 = Panel("""0
0
0
0
0
0
0
0
0
0
0
0
0
0
0
0
0
0
0
0
0
0
0
0""")
panel_9 = Panel("""0
0
0
0
0
1
1
1
1
1
1
1
1
1
1
1
1
1
1
1
1
0
0
0""")
panel_10 = Panel("""0
0
0
0
0
1
1
1
1
1
1
1
1
1
1
1
1
1
0
0
0
0
0
0""")
weeklyschedule = HBWeeklySchedule(
    sun=panel_8,
    mon=panel_9,
    tue=panel_9,
    wed=panel_9,
    thu=panel_9,
    fri=panel_9,
    sat=panel_10,
    holiday=panel_8,
    summer_des=panel_9,
    winter_des=panel_10,
    name="HVACOperatiion Schd",
    type_limit="On-Off")  # -> report, schedule, idf_year, idf_week, idf_days; plug-in component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
weeklyschedule_2 = HBWeeklySchedule(
    sun=panel_5,
    mon=panel_6,
    tue=panel_6,
    wed=panel_6,
    thu=panel_6,
    fri=panel_6,
    sat=panel_7,
    holiday=panel_5,
    summer_des=panel_6,
    winter_des=panel_7,
    name="Hours_of _operation",
    type_limit="Fractional")  # -> report, schedule, idf_year, idf_week, idf_days; plug-in component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
searchschs = HBSearchSchedules(keywords="Medium Office")  # -> schedules, type_limits; plug-in component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
panel_11 = Panel(searchschs.schedules)
panel_12 = Panel("""0.05
0.05
0.05
0.05
0.1
0.08623256
0.25869768
0.25869768
0.25869768
0.25869768
0.25869768
0.25869768
0.25869768
0.25869768
0.25869768
0.25869768
0.4311628
0.25869768
0.25869768
0.17246512
0.17246512
0.08623256
0.04311628
0.04311628""")
panel_13 = Panel("""0.05
0.05
0.05
0.05
0.05
0.08623256
0.08623256
0.25869768
0.25869768
0.25869768
0.25869768
0.12934884
0.12934884
0.12934884
0.12934884
0.12934884
0.04311628
0.04311628
0.05
0.05
0.05
0.05
0.05
0.05""")
panel_14 = Panel("""0.230755381
0.230755381
0.230755381
0.230755381
0.230755381
0.381234796
0.381234796
0.857778291
0.476543495
0.476543495
0.476543495
0.333580447
0.333580447
0.333580447
0.333580447
0.333580447
0.285926097
0.285926097
0.230755381
0.230755381
0.230755381
0.230755381
0.230755381
0.230755381""")
panel_15 = Panel("""0
0
0
0
0
0.05
0.05
0.05
0.05
0.05
0.05
0.05
0.05
0.05
0.05
0.05
0.05
0
0
0
0
0
0
0""")
panel_16 = Panel("""0
0
0
0
0
1
1
1
1
1
1
1
1
1
1
1
1
1
1
1
1
0.05
0.05
0.05""")
panel_17 = Panel("""0.05
0.05
0.05
0.05
0.05
0.04311628
0.04311628
0.04311628
0.04311628
0.04311628
0.04311628
0.04311628
0.04311628
0.04311628
0.04311628
0.04311628
0.04311628
0.05
0.05
0.05
0.05
0.05
0.05
0.05""")
panel_18 = Panel("""1
1
1
1
1
1
1
1
1
1
1
1
1
1
1
1
1
1
1
1
1
1
1
1""")
panel_19 = Panel("""0
0
0
0
0
0
0
0
0
0
0
0
0
0
0
0
0
0
0
0
0
0
0
0""")
panel_20 = Panel("""0.230755381
0.230755381
0.230755381
0.230755381
0.230755381
0.285926097
0.285926097
0.285926097
0.285926097
0.285926097
0.285926097
0.285926097
0.285926097
0.285926097
0.285926097
0.285926097
0.285926097
0.230755381
0.230755381
0.230755381
0.230755381
0.230755381
0.230755381
0.230755381""")
panel_21 = Panel("""0.307673841
0.307673841
0.307673841
0.307673841
0.307673841
0.381234796
0.381234796
0.857778291
0.857778291
0.857778291
0.857778291
0.476543495
0.476543495
0.476543495
0.476543495
0.476543495
0.476543495
0.381234796
0.381234796
0.381234796
0.381234796
0.381234796
0.381234796
0.381234796""")
panel_22 = Panel("""1
1
1
1
1
1
1
1
1
1
1
1
1
1
1
1
1
1
1
1
1
1
1
1""")
panel_23 = Panel("""0
0
0
0
0
0
0
0
0
0
0
0
0
0
0
0
0
0
0
0
0
0
0
0""")
panel_24 = Panel("""0
0
0
0
0
0.1
0.2
0.95
0.95
0.95
0.95
0.3
0.95
0.95
0.95
0.95
0.3
0.1
0.1
0.1
0.1
0.05
0.05
0.05""")
panel_25 = Panel("""0
0
0
0
0
0.1
0.1
0.3
0.3
0.3
0.3
0.1
0.1
0.1
0.1
0.1
0.05
0.05
0
0
0
0
0
0""")
panel_26 = Panel("""0
0
0
0
0
0
0
0
0
0
0
0
0
0
0
0
0
0
0
0
0
0
0
0""")
weeklyschedule_3 = HBWeeklySchedule(
    sun=panel_20,
    mon=panel_21,
    tue=panel_21,
    wed=panel_21,
    thu=panel_21,
    fri=panel_21,
    sat=panel_14,
    holiday=panel_20,
    summer_des=panel_22,
    winter_des=panel_23,
    name="BLDG_EQUIP_SCH",
    type_limit="Fractional")  # -> report, schedule, idf_year, idf_week, idf_days; plug-in component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
weeklyschedule_4 = HBWeeklySchedule(
    sun=panel_15,
    mon=panel_24,
    tue=panel_24,
    wed=panel_24,
    thu=panel_24,
    fri=panel_24,
    sat=panel_25,
    holiday=panel_15,
    summer_des=panel_16,
    winter_des=panel_26,
    name="BLDG_OCC_SCH",
    type_limit="Fractional")  # -> report, schedule, idf_year, idf_week, idf_days; plug-in component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
weeklyschedule_5 = HBWeeklySchedule(
    sun=panel_17,
    mon=panel_12,
    tue=panel_12,
    wed=panel_12,
    thu=panel_12,
    fri=panel_12,
    sat=panel_13,
    holiday=panel_17,
    summer_des=panel_18,
    winter_des=panel_19,
    name="BLDG_LIGHT_SCH",
    type_limit="Fractional")  # -> report, schedule, idf_year, idf_week, idf_days; plug-in component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

# ---- group: Window and Door Construction
windows = Geometry([<brep referenced from the Rhino model> x4])
aperture = HBAperture(geo=windows, name="Windows", operable=Toggle(True), ep_constr=decnstrconstrset.window)  # -> report, apertures; plug-in component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

# ----
panel_27 = Panel("""0
0
0
0
0
0
0.16
0.14
0.21
0.18
0.25
0.21
0.13
0.08
0.04
0.05
0.06
0
0
0
0
0
0
0""")
panel_28 = Panel("""0
0
0
0
0
0
0
0
0
0
0
0
0
0
0
0
0
0
0
0
0
0
0
0""")
panel_29 = Panel("""0
0
0
0
0
0
0.16
0.14
0.21
0.18
0.25
0.21
0.13
0.08
0.04
0.05
0.06
0
0
0
0
0
0
0""")
panel_30 = Panel("""0
0
0
0
0
0
0
0
0
0
0
0
0
0
0
0
0
0
0
0
0
0
0
0""")
panel_31 = Panel("""1
1
1
1
1
0.25
0.25
0.25
0.25
0.25
0.25
0.25
0.25
0.25
0.25
0.25
0.25
0.25
0.25
0.25
0.25
1
1
1""")
panel_32 = Panel("""0
0
0
0
0
0.144
1
0.144
0.144
0.144
0.144
1
0.144
0.144
0.144
0.144
1
0.144
0
0
0
0
0
0""")
panel_33 = Panel("""0
0
0
0
0
0
0
0
0
0
0
0
0
0
0
0
0
0
0
0
0
0
0
0""")
panel_34 = Panel("""0
0
0
0
0
0
0.35
0.69
0.43
0.37
0.43
0.58
0.48
0.37
0.37
0.46
0.62
0.12
0.04
0.04
0
0
0
0""")
panel_35 = Panel("""0.69
0.69
0.69
0.69
0.69
0.69
0.69
0.69
0.69
0.69
0.69
0.69
0.69
0.69
0.69
0.69
0.69
0.69
0.69
0.69
0.69
0.69
0.69
0.69""")
panel_36 = Panel("""0
0
0
0
0
0
0.35
0.69
0.43
0.37
0.43
0.58
0.48
0.37
0.37
0.46
0.62
0.12
0.04
0.04
0
0
0
0""")
panel_37 = Panel("""0.69
0.69
0.69
0.69
0.69
0.69
0.69
0.69
0.69
0.69
0.69
0.69
0.69
0.69
0.69
0.69
0.69
0.69
0.69
0.69
0.69
0.69
0.69
0.69""")
panel_38 = Panel("""1
1
1
1
1
1
1
1
1
1
1
1
1
1
1
1
1
1
1
1
1
1
1
1""")
weeklyschedule_6 = HBWeeklySchedule(
    sun=panel_32,
    mon=panel_33,
    tue=panel_33,
    wed=panel_33,
    thu=panel_33,
    fri=panel_33,
    sat=panel_32,
    holiday=panel_32,
    summer_des=panel_33,
    winter_des=panel_32,
    name="INFIL_Door_Opening_SCH",
    type_limit="Fractional")  # -> report, schedule, idf_year, idf_week, idf_days; plug-in component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
weeklyschedule_7 = HBWeeklySchedule(
    sun=panel_28,
    mon=panel_34,
    tue=panel_34,
    wed=panel_34,
    thu=panel_34,
    fri=panel_34,
    sat=panel_27,
    holiday=panel_28,
    summer_des=panel_35,
    winter_des=panel_28,
    name="BLDG_ELEVATORS",
    type_limit="Fractional")  # -> report, schedule, idf_year, idf_week, idf_days; plug-in component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
weeklyschedule_8 = HBWeeklySchedule(
    sun=panel_30,
    mon=panel_36,
    tue=panel_36,
    wed=panel_36,
    thu=panel_36,
    fri=panel_36,
    sat=panel_29,
    holiday=panel_30,
    summer_des=panel_37,
    winter_des=panel_30,
    name="ELEV_LIGHT_FAN_SCH_ADD_DF",
    type_limit="Fractional")  # -> report, schedule, idf_year, idf_week, idf_days; plug-in component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
weeklyschedule_9 = HBWeeklySchedule(
    sun=panel_38,
    mon=panel_31,
    tue=panel_31,
    wed=panel_31,
    thu=panel_31,
    fri=panel_31,
    sat=panel_38,
    holiday=panel_38,
    summer_des=panel_31,
    winter_des=panel_38,
    name="INFIL_SCH_PNNL",
    type_limit="Fractional")  # -> report, schedule, idf_year, idf_week, idf_days; plug-in component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
panel_39 = Panel("16")
panel_40 = Panel("""0
0
0
0
0
0.04
0.04
0.04
0.04
0.04
0.06
0.06
0.09
0.06
0.04
0.04
0.04
0
0
0
0
0
0
0""")
panel_41 = Panel("""0
0
0
0
0
0.07
0.19
0.35
0.38
0.39
0.47
0.57
0.54
0.34
0.33
0.44
0.26
0.21
0.15
0.17
0.08
0.05
0.05
0.05""")
panel_42 = Panel("""0
0
0
0
0
0.07
0.11
0.15
0.21
0.19
0.23
0.2
0.19
0.15
0.13
0.14
0.14
0.07
0
0
0
0
0
0""")

panel_43 = Panel("""0
0
0
0
0
0
0
0
0
0
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""")
analysisperiod = LBAnalysisPeriod(start_month="4", start_day="21", start_hour=0, end_month="4", end_day="21")  # -> period, hoys, dates; plug-in component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
_0421 = Panel("""1
1
1
1
1
1
1
1
1
1
1
1
1
1
0
0
0
0
1
1
1
1
1
1""")
_0423 = Panel("""1
1
1
1
1
1
1
1
1
1
0
0
0
0
0
0
0
0
0
0
0
1
1
1""")
replace_3 = ReplaceItems(List=panel_43, Item=_0421, Indices=analysisperiod.hoys, Wrap=False)
analysisperiod_2 = LBAnalysisPeriod(start_month="4", start_day="23", start_hour=0, end_month="4", end_day="23")  # -> period, hoys, dates; plug-in component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
replace_4 = ReplaceItems(List=replace_3, Item=_0423, Indices=analysisperiod_2.hoys, Wrap=False)
fixedintervalschedule = HBFixedIntervalSchedule(values=replace_4, name="Night Flushing Schedule", type_limit="On-Off")  # -> report, schedule; plug-in component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

versions = HBCheckVersions()  # -> lbt_gh, python, radiance, openstudio, energyplus; plug-in component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
panel_44 = Panel("15")
panel_45 = Panel("28")
panel_46 = Panel("-100")
panel_47 = Panel("1")
panel_48 = Panel(versions.lbt_gh)
panel_49 = Panel(versions.openstudio)
weeklyschedule_10 = HBWeeklySchedule(
    sun=panel_40,
    mon=panel_41,
    tue=panel_41,
    wed=panel_41,
    thu=panel_41,
    fri=panel_41,
    sat=panel_42,
    holiday=panel_40,
    summer_des=panel_41,
    winter_des=panel_42,
    name="BLDG_SWH_SCH",
    type_limit="Fractional")  # -> report, schedule, idf_year, idf_week, idf_days; plug-in component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
ventcontrol = HBVentilationControl(schedule=fixedintervalschedule.schedule)  # -> vent_cntrl; plug-in component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
analysisperiod_3 = LBAnalysisPeriod(start_month="4", start_day="21", start_hour=0, end_month="4", end_day="23")  # -> period, hoys, dates; plug-in component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
item_6 = ListItem(List=panel_43, Index=analysisperiod_3.hoys, Wrap=True)
panel_50 = Panel(item_6)
roomenergyattr = HBRoomEnergyAttributes({"Program": "properties.energy.program_type.display_name", "Construction Set": "properties.energy.construction_set.display_name", "Is Conditioned": "properties.energy.is_conditioned", "People per Area [ppl/m2]": "properties.energy.people.people_per_area", "Area per Person [m2/ppl]": "properties.energy.people.area_per_person", "Lighting per Area [W/m2]": "properties.energy.lighting.watts_per_area"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}, selected="Program")
toggle = BooleanToggle(True)
simcontrol = HBSimulationControl(
    do_zone_sizing=toggle,
    do_system_sizing=toggle,
    do_plant_sizing=toggle,
    for_sizing_period=Toggle(False),
    for_run_period=toggle)  # -> sim_control; plug-in component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
shadowcalc = HBShadowCalculation(solar_dist="FullInteriorAndExterior", frequency="30", max_figures="15000")  # -> shadow_calc; plug-in component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
toggle_2 = BooleanToggle(True)
ddy_tuscon_2b_sv = FilePath("G:\My Drive\PennDesign\DoE ARPA-E - TAL - Shared Folder\800 - InOut\IN\20221201_sv\USA_AZ_Tucson-Davis-Monthan.AFB.722745_TMY3.ddy")
simoutput = HBSimulationOutput(
    zone_energy_use=toggle_2,
    hvac_energy_use=toggle_2,
    gains_and_losses=toggle_2,
    comfort_metrics=toggle_2,
    surface_temperature=toggle_2,
    surface_energy_flow=toggle_2)  # -> report, sim_output; plug-in component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
sizingpar = HBSizingParameter(ddy_file=ddy_tuscon_2b_sv, heating_fac="1", cooling_fac="1")  # -> sizing; plug-in component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
simpar = HBSimulationParameter(output=simoutput.sim_output, timestep=6, sim_control=simcontrol, shadow_calc=shadowcalc, sizing=sizingpar)  # -> sim_par; plug-in component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
epw_tuscon_sv = FilePath("G:\My Drive\PennDesign\DoE ARPA-E - TAL - Shared Folder\800 - InOut\IN\20221201_sv\USA_AZ_Tucson-Davis-Monthan.AFB.722745_TMY3.epw")
panel_51 = Panel("G:\My Drive\PennDesign\DoE-ARPA-E-TAL\006 - os measure\CreateTypicalDOEBuildingFromModel")
epw_tuscon = Data(epw_tuscon_sv)
toggle_3 = BooleanToggle(False)
loadmeasure = HBLoadMeasure(measure_path=panel_51, template="90.1-2016", add_constructions=Toggle(False), remove_objects=Toggle(False))  # -> report, measure; plug-in component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

# ---- group: 90.1-2016 - MedOffice - Plenum - ASHRAE 169-2013-2B
opaqueconstr_2 = HBOpaqueConstruction(name="Plenum Acoustic Tile", materials=opaquemat_3)  # -> constr; plug-in component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

# ---- group: 90.1-2016 - MedOffice - ASHRAE 169-2013-2B
merge = Merge(Data1=opaquemat, Data2=opaquemat_2, Data3=opaquematnomass, Data4=opaquemat_2)
merge_2 = Merge(Data1=opaquemat_4, Data2=opaquematnomass_2, Data3=opaquemat_5)
merge_3 = Merge(Data1=opaquematnomass_4, Data2=opaquemat_7, Data3=opaquematnomass_5)
merge_4 = Merge(Data1=opaquemat_8, Data2=opaquemat_8)
merge_5 = Merge(Data1=opaquemat_9, Data2=opaquematnomass_6)
merge_6 = Merge(Data1=opaquematnomass_6, Data2=opaquemat_9)
merge_7 = Merge(Data1=opaquemat_6, Data2=opaquematnomass_3)
opaqueconstr_3 = HBOpaqueConstruction(name="Typical Insulated Steel Frame", materials=merge)  # -> constr; plug-in component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
panel_52 = Panel("U 0.54 SHGC 0.25 Simple Glazing")
opaqueconstr_4 = HBOpaqueConstruction(name="Typical IEAD Roof - Highly reflective", materials=merge_2)  # -> constr; plug-in component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
merge_8 = Merge(Data1=opaquemat_10, Data2=opaquematnomass_7)
opaqueconstr_5 = HBOpaqueConstruction(name="Typical Insulated Exterior Mass", materials=merge_3)  # -> constr; plug-in component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
opaqueconstr_6 = HBOpaqueConstruction(name="Typical Interior Wall", materials=merge_4)  # -> constr; plug-in component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
opaqueconstr_7 = HBOpaqueConstruction(name="Typical Insulated Carpeted 8in", materials=merge_7)  # -> constr; plug-in component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
opaqueconstr_8 = HBOpaqueConstruction(name="Typical Interior Floor", materials=merge_6)  # -> constr; plug-in component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
opaqueconstr_9 = HBOpaqueConstruction(name="Typical Interior Ceiling", materials=merge_5)  # -> constr; plug-in component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
opaqueconstr_10 = HBOpaqueConstruction(name="Typical Insulated Metal Door", materials=merge_8)  # -> constr; plug-in component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
exteriorsubset = HBExteriorConstructionSubset(exterior_wall=opaqueconstr_3, exterior_roof=opaqueconstr_4, exposed_floor=opaqueconstr_5)  # -> exterior_set; plug-in component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
groundsubset = HBGroundConstructionSubset(ground_floor=opaqueconstr_7)  # -> ground_set; plug-in component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
interiorsubset = HBInteriorConstructionSubset(interior_wall=opaqueconstr_6, ceiling=opaqueconstr_2, interior_floor=opaqueconstr_8)  # -> interior_set; plug-in component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

# ----
windowconstr = HBWindowConstruction(name=panel_52, materials=windowmat)  # -> constr; plug-in component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

# ---- group: 90.1-2016 - MedOffice - ASHRAE 169-2013-2B (continued)
subfacesubset = HBSubfaceSubset(window=windowconstr, operable=windowconstr, exterior_door=opaqueconstr_10)  # -> subface_set; plug-in component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
constructionset = HBConstructionSet(exterior_subset=exteriorsubset, ground_subset=groundsubset, interior_subset=interiorsubset, subface_subset=subfacesubset)  # -> constr_set; plug-in component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

# ---- group: 90.1-2016 - MedOffice - Plenum - ASHRAE 169-2013-2B (continued)
interiorsubset_2 = HBInteriorConstructionSubset(ceiling=opaqueconstr_9, interior_floor=opaqueconstr_2)  # -> interior_set; plug-in component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
constructionset_2 = HBConstructionSet(name="90.1-2016 - MedOffice - Plenum - ASHRAE 169-2013-2B", interior_subset=interiorsubset_2)  # -> constr_set; plug-in component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

# ---- group: Rooms
panel_53 = Panel("""Room-East
Room-North
Room-West
Room-South
Room-Core""")
room = HBRoom(faces=replace_2, name=graft(panel_53), constr_set=constructionset, conditioned=Toggle(True))  # -> report, room; plug-in component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

# ---- group: Plenum
room_2 = HBRoom(faces=flatten(replace), name="L2Plenum", constr_set=constructionset_2, program=programtype, conditioned=Toggle(False))  # -> report, room; plug-in component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

# ----
roomattr_2 = HBRoomAttributes({"Display Name": "display_name", "Simulation Name (Identifier)": "identifier", "Multiplier": "multiplier", "Story": "story", "Volume": "volume", "Gross Floor Area": "floor_area", "Exposed Area": "exposed_area", "Exterior Wall Area": "exterior_wall_area", "Exterior Aperture Area": "exterior_aperture_area", "Average Floor Elevation": "average_floor_height"}, selected="Gross Floor Area")
roomsbyattr = HBRoomsByAttribute(rooms=graft(room.room), attribute=roomattr_2)  # -> values, rooms; plug-in component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
roomsbyattr_2 = HBRoomsByAttribute(rooms=graft(room_2.room), attribute=roomattr_2)  # -> values, rooms; plug-in component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

# ---- group: Internal Mass Definition
srf_area_per_flr_space_area = Panel("2")
flatten = FlattenTree(Tree=roomsbyattr_2.values, Path="{0}")
multiplication = Multiplication(A=flatten, B=srf_area_per_flr_space_area)
internalmass = HBInternalMass(rooms=room_2.room, geo_or_area=multiplication, construction=opaqueconstr, name="Internal Mass Definition 1")  # -> report, rooms; plug-in component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

# ---- group: Plenum Rooms
toggle_4 = BooleanToggle(False)
plenum = HBPlenum(rooms=internalmass.rooms, conditioned=Toggle(False), remove_infilt=toggle_4, include_floor=toggle_4)  # -> rooms; plug-in component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
graft = GraftTree(Tree=plenum, IncludeEmptyLists=True, IncludeNullItems=True)  # -> simplify(Tree)

# ----
labelrooms = HBLabelRooms(rooms_model=flatten(room.room), attribute=roomattr)  # -> label_text, base_pts, labels, wire_frame; plug-in component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

# ---- group: Ideal HVAC
idealair = HBIdealAir(rooms=flatten(room.room), economizer="NoEconomizer", sensible_hr="0", heat_limit="NoLimit", cool_limit="NoLimit")  # -> report, rooms; plug-in component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

# ---- group: Perimeter Rooms
cull_i = CullIndex(List=idealair.rooms, Indices="4", Wrap=True)
applyprogram = HBApplyProgramType(rooms=cull_i, program=programtype_2)  # -> report, simplify(rooms); plug-in component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

# ---- group: Cores
item_7 = ListItem(List=idealair.rooms, Index="4", Wrap=True)
applyprogram_2 = HBApplyProgramType(rooms=item_7, program=programtype_3)  # -> report, rooms; plug-in component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

# ----
ins_2 = InsertItems(List=applyprogram.rooms, Item=applyprogram_2.rooms, Indices="4", Wrap=True)

# ---- group: Rooms Per Level
solveadj = HBSolveAdjacency(rooms=ins_2, adiabatic=Toggle(False), run=Toggle(True))  # -> report, simplify(adj_rooms); plug-in component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

# ---- group: Internal Mass Definition
flatten_2 = FlattenTree(Tree=roomsbyattr.values, Path="{0}")
srf_area_per_flr_space_area_2 = Panel("2")
path_mapper = PathMapper(flatten_2, source="{A}(i)", target="{i\5}")
multiplication_2 = Multiplication(A=path_mapper, B=srf_area_per_flr_space_area_2)
internalmass_2 = HBInternalMass(rooms=solveadj.adj_rooms, geo_or_area=multiplication_2, construction=opaqueconstr, name="Internal Mass Definition 1")  # -> report, simplify(rooms); plug-in component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

# ----
merge_9 = Merge(Data1=graft, Data2=internalmass_2.rooms)

# ---- group: Plenum to Room per Level
solveadj_2 = HBSolveAdjacency(rooms=merge_9, adiabatic=Toggle(False), run=Toggle(True))  # -> report, simplify(adj_rooms); plug-in component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

# ----
addsubface = HBAddSubface(hb_obj=flatten(solveadj_2.adj_rooms), sub_faces=flatten(aperture.apertures))  # -> hb_obj; plug-in component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

# ---- group: Nat. Vent.
ventcontrol_2 = HBVentilationControl(min_in_temp="21", max_in_temp="28")  # -> vent_cntrl; plug-in component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
applysetpointvals = HBApplySetpointValues(room_or_program=flatten(addsubface), cooling_setpt="29", heating_setpt="20")  # -> report, mod_obj; plug-in component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
windowopen = HBWindowOpening(rooms=flatten(applysetpointvals.mod_obj), vent_cntrl=ventcontrol_2, wind_cross_vent=Toggle(False))  # -> report, rooms; plug-in component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

# ----
panel_54 = Panel(addsubface)
vizbytype = HBVisualizeByType(hb_objs=addsubface)  # -> walls, interior_walls, roofs, ceilings, exterior_floors, interior_floors, air_walls, apertures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; plug-in component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
vizbybc = HBVisualizeByBC(hb_objs=addsubface)  # -> outdoors, surface, ground, adiabatic, other, wire_frame; plug-in component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
model = HBModel(rooms=flatten(addsubface), name="20230727_MidOffice_baseline_Measure")  # -> report, model; plug-in component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
afn = HBAirflowNewtwork(model=model.model)  # -> report, model; plug-in component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
geo = Geometry(vizbybc.adiabatic)
geo_2 = Geometry(vizbytype.interior_walls)
geo_3 = Geometry(vizbytype.ceilings)
geo_4 = Geometry(vizbytype.interior_floors)
geo_5 = Geometry(vizbytype.apertures)
geo_6 = Geometry(vizbytype.wire_frame)
labelrooms_2 = HBLabelRooms(rooms_model=flatten(afn.model), attribute=roomenergyattr)  # -> label_text, base_pts, labels, wire_frame; plug-in component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
modeltoosm = HBModelToOSM(model=afn.model, epw_file=epw_tuscon, sim_par=simpar, measures=loadmeasure.measure, write=toggle_3, run=toggle_3)  # -> report, jsons, osw, osm, idf, sql, zsz, rdd, html; plug-in component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
roomenergyresult = HBReadRoomEnergyResult(sql=modeltoosm.sql)  # -> cooling, heating, lighting, electric_equip, gas_equip, process, hot_water, fan_electric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; plug-in component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

faceresult = HBReadFaceResult(sql=modeltoosm.sql)  # -> face_indoor_temp, face_outdoor_temp, face_energy_flow; plug-in component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
number_slider = Slider(300, range=0..300)
number_slider_2 = Slider(10, range=0..300)
colrange = LBColorRange(index="19")  # -> colors; plug-in component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
colrange_2 = LBColorRange(index="18")  # -> colors; plug-in component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
neg = Negative(Value=number_slider)
neg_2 = Negative(Value=number_slider_2)
legendpar = LBLegendParameters(min=neg, max=number_slider, colors=colrange)  # -> leg_par; plug-in component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
legendpar_2 = LBLegendParameters(min=neg_2, max=number_slider_2, colors=colrange_2)  # -> leg_par; plug-in component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
pt = Point(Point(109.8477153, 81.415335, 0))
pt_2 = Point(Point(109.8477153, 148.0667584, 0))

eui = HBEndUseIntensity(sql=modeltoosm.sql, ip=Toggle(False))  # -> eui, eui_end_use, end_uses, gross_floor; plug-in component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
panel_55 = Panel(eui.end_uses)
loadbalance = HBThermalLoadBalance(
    rooms_model=flatten(addsubface),
    cooling=roomenergyresult.cooling,
    heating=roomenergyresult.heating,
    lighting=roomenergyresult.lighting,
    electric_equip=roomenergyresult.electric_equip,
    gas_equip=roomenergyresult.gas_equip,
    process=roomenergyresult.process,
    hot_water=roomenergyresult.hot_water,
    people_gain=roomenergyresult.people_gain,
    solar_gain=roomenergyresult.solar_gain,
    infiltration_load=roomenergyresult.infiltration_load,
    mech_vent_load=roomenergyresult.mech_vent_load,
    nat_vent_load=roomenergyresult.nat_vent_load,
    face_energy_flow=faceresult.face_energy_flow)  # -> report, balance, balance_stor, norm_bal, norm_bal_stor; plug-in component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

merge_10 = Merge(Data1=eui.eui, Data2=eui.eui_end_use)  # -> simplify(flatten(Result))
merge_11 = Merge(Data1="Total EUI", Data2=flatten(panel_55))  # -> simplify(Result)
clean = CleanTree(RemoveNulls=True, RemoveInvalid=True, RemoveEmpty=False, Tree=merge_10)
long = LongestList(ListA=flatten(clean), ListB="kWh/m2", PaddingMode=2)  # -> graft(ListA), graft(ListB)
merge_12 = Merge(Data1=graft(merge_11), Data2=graft(clean), Data3=long.ListB)
join = TextJoin(Text=merge_12, Join=" ")
timeop = LBTimeIntervalOperation(data=loadbalance.norm_bal)  # -> daily, monthly, mon_per_hr; plug-in component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
data = Data(flatten(join))
join_2 = TextJoin(Text=["Energy Balance", data])
monthlychart = LBMonthlyChart(data=timeop.daily, base_pt=pt_2, stack=Toggle(True), global_title=join_2, legend_par=legendpar)  # -> report, data_mesh, data_lines, col_lines, legend, borders, labels, y_title, title; plug-in component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
monthlychart_2 = LBMonthlyChart(data=timeop.monthly, base_pt=pt, stack=Toggle(True), global_title=join_2, legend_par=legendpar_2)  # -> report, data_mesh, data_lines, col_lines, legend, borders, labels, y_title, title; plug-in component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

panel_56 = Panel(join)
