# Grasshopper definition 20230727_Baseline_EnergyMode_10_Simplified.gh (Grasshopper 1.0.7)

# ---- group: Input Plenum
rooms = Brep(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)

# ---- group: Input Rooms
rooms_2 = Brep(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)

# ----
bldgvintages = HBBuildingVintages({"ASHRAE 90.1 2019  |  IECC 2021": "2019", "ASHRAE 90.1 2016  |  IECC 2018": "2016", "ASHRAE 90.1 2013  |  IECC 2015": "2013", "ASHRAE 90.1 2010  |  IECC 2012": "2010", "ASHRAE 90.1 2007  |  IECC 2009": "2007", "ASHRAE 90.1 2004  |  IECC 2006": "2004", "1980-2004 (CBECS)": "1980_2004", "Pre-1980 (CBECS)": "pre_1980"}, selected="ASHRAE 90.1 2016  |  IECC 2018")
searchprog = HBSearchPrograms(vintage=bldgvintages, keywords="Plenum")  # -> room_prog; plug-in component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
searchprog_2 = HBSearchPrograms(vintage=bldgvintages, keywords="Office")  # -> room_prog; plug-in component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

# ---- group: Inteiror Walls
perimeter_thermal_zone_depth = Panel("4.572")
debrep = DeconstructBrep(Brep=rooms_2)  # -> Faces, Edges, Vertices
item = ListItem(List=debrep.Faces, Index=0, Wrap=True)  # -> Item, Item1, Item2
floor_to_ceiling_height = Panel("2.74")
skeleton = HBStraightSkeleton(floor_geo=item.Item, offset=perimeter_thermal_zone_depth)  # -> polyskel, perim_poly, core_poly; plug-in component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
lng = ListLength(List=flatten(skeleton.perim_poly))
lng_2 = ListLength(List=flatten(item.Item))
division = Division(A=lng, B=lng_2)
Z = UnitZ(Factor=floor_to_ceiling_height)
extr = Extrude(Base=skeleton.perim_poly, Direction=Z)
partition = PartitionList(List=extr, Size=division)
extr_2 = Extrude(Base=skeleton.core_poly, Direction=Z)  # -> graft(Extrusion)
partition_2 = PartitionList(List=skeleton.perim_poly, Size=division)
ins = InsertItems(List=partition, Item=extr_2, Indices=4, Wrap=True)

# ---- group: Boundary Condition
debrep_2 = DeconstructBrep(Brep=ins)  # -> Faces, Edges, Vertices
debrep_3 = DeconstructBrep(Brep=rooms)  # -> Faces, Edges, Vertices
panel = Panel("""1
4
7
10
13""")
item_2 = ListItem(List=debrep_2.Faces, Index=0, Wrap=True)
item_3 = ListItem(List=debrep_3.Faces, Index=panel, Wrap=True)
panel_2 = Panel("""Rm1_Wall_
Rm2_Wall_
Rm3_Wall_
Rm4_Wall_
Rm5_Wall_""")
face = HBFace(geo=flatten(item_2), name="ExposedFloor", bc="Adiabatic")  # -> report, graft(faces); plug-in component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
face_2 = HBFace(geo=debrep_2.Faces, name=graft(panel_2))  # -> report, faces; plug-in component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
face_3 = HBFace(geo=item_3, name="ExposedCeiling_", bc="Adiabatic")  # -> report, faces; plug-in component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
face_4 = HBFace(geo=debrep_3.Faces)  # -> report, faces; plug-in component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
replace = ReplaceItems(List=face_4.faces, Item=face_3.faces, Indices=panel, Wrap=False)
replace_2 = ReplaceItems(List=face_2.faces, Item=face.faces, Indices="0", Wrap=False)

# ----
item_4 = ListItem(List=searchprog, Index="0", Wrap=True)
item_5 = ListItem(List=searchprog_2, Index="36", Wrap=True)
panel_3 = Panel([item_5, item_4])

# ---- group: Rooms
panel_4 = Panel("""Room-East
Room-North
Room-West
Room-South
Room-Core""")
room = HBRoom(faces=replace_2, name=graft(panel_4), program=item_5, conditioned=Toggle(True))  # -> report, room; plug-in component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

# ---- group: Plenum
room_2 = HBRoom(faces=flatten(replace), name="L2Plenum", program=item_4, conditioned=Toggle(False))  # -> report, room; plug-in component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

# ----
all_air = HBAllAirHVACTemplates({"VAV chiller with gas boiler reheat": "VAV_Chiller_Boiler", "VAV chiller with central air source heat pump reheat": "VAV_Chiller_ASHP", "VAV chiller with district hot water reheat": "VAV_Chiller_DHW", "VAV chiller with PFP boxes": "VAV_Chiller_PFP", "VAV chiller with gas coil reheat": "VAV_Chiller_GasCoil", "VAV air-cooled chiller with gas boiler reheat": "VAV_ACChiller_Boiler", "VAV air-cooled chiller with central air source heat pump reheat": "VAV_ACChiller_ASHP", "VAV air-cooled chiller with district hot water reheat": "VAV_ACChiller_DHW", "VAV air-cooled chiller with PFP boxes": "VAV_ACChiller_PFP", "VAV air-cooled chiller with gas coil reheat": "VAV_ACChiller_GasCoil"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}, selected="PVAV with gas boiler reheat": "PVAV_Boiler")
bldgvintages_2 = HBBuildingVintages({"ASHRAE 90.1 2019  |  IECC 2021": "2019", "ASHRAE 90.1 2016  |  IECC 2018": "2016", "ASHRAE 90.1 2013  |  IECC 2015": "2013", "ASHRAE 90.1 2010  |  IECC 2012": "2010", "ASHRAE 90.1 2007  |  IECC 2009": "2007", "ASHRAE 90.1 2004  |  IECC 2006": "2004", "1980-2004 (CBECS)": "1980_2004", "Pre-1980 (CBECS)": "pre_1980"}, selected="ASHRAE 90.1 2016  |  IECC 2018")

toggle = BooleanToggle(False)
plenum = HBPlenum(rooms=room_2.room, conditioned=toggle, remove_infilt=toggle, include_floor=Toggle(True))  # -> rooms; plug-in component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
graft = GraftTree(Tree=plenum, IncludeEmptyLists=True, IncludeNullItems=True)  # -> simplify(Tree)

allairhvac = HBAllAirHVAC(rooms=flatten(room.room), system_type=all_air, vintage=bldgvintages_2, economizer="NoEconomizer")  # -> report, rooms; plug-in component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
merge = Merge(Data1=graft, Data2=allairhvac.rooms)  # -> graft(Result)

# ---- group: Plenum to Room per Level
solveadj = HBSolveAdjacency(rooms=merge, adiabatic=Toggle(False), run=Toggle(True))  # -> report, simplify(adj_rooms); plug-in component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

# ---- group: Window and Door Construction
windows = Geometry([<brep referenced from the Rhino model> x4])
aperture = HBAperture(geo=windows, name="Windows", operable=Toggle(True))  # -> report, apertures; plug-in component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

# ----
addsubface = HBAddSubface(hb_obj=flatten(solveadj.adj_rooms), sub_faces=flatten(aperture.apertures))  # -> hb_obj; plug-in component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
vizbytype = HBVisualizeByType(hb_objs=addsubface)  # -> walls, interior_walls, roofs, ceilings, exterior_floors, interior_floors, air_walls, apertures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; plug-in component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
vizbybc = HBVisualizeByBC(hb_objs=addsubface)  # -> outdoors, surface, ground, adiabatic, other, wire_frame; plug-in component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
model = HBModel(rooms=flatten(addsubface), name="20230817_MidOffice_Simplified")  # -> report, model; plug-in component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
versions = HBCheckVersions()  # -> lbt_gh, python, radiance, openstudio, energyplus; plug-in component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
panel_5 = Panel(versions.openstudio)
panel_6 = Panel(versions.lbt_gh)
geo = Geometry(vizbybc.adiabatic)
geo_2 = Geometry(vizbytype.interior_walls)
geo_3 = Geometry(vizbytype.ceilings)
geo_4 = Geometry(vizbytype.interior_floors)
geo_5 = Geometry(vizbytype.apertures)
geo_6 = Geometry(vizbytype.wire_frame)
roomenergyattr = HBRoomEnergyAttributes({"Program": "properties.energy.program_type.display_name", "Construction Set": "properties.energy.construction_set.display_name", "Is Conditioned": "properties.energy.is_conditioned", "People per Area [ppl/m2]": "properties.energy.people.people_per_area", "Area per Person [m2/ppl]": "properties.energy.people.area_per_person", "Lighting per Area [W/m2]": "properties.energy.lighting.watts_per_area"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}, selected="Is Conditioned")
toggle_2 = BooleanToggle(True)
labelrooms = HBLabelRooms(rooms_model=flatten(model.model), attribute=roomenergyattr)  # -> label_text, base_pts, labels, wire_frame; plug-in component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
simcontrol = HBSimulationControl(
    do_zone_sizing=toggle_2,
    do_system_sizing=toggle_2,
    do_plant_sizing=toggle_2,
    for_sizing_period=Toggle(False),
    for_run_period=toggle_2)  # -> sim_control; plug-in component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
shadowcalc = HBShadowCalculation(solar_dist="FullInteriorAndExterior", frequency="30", max_figures="15000")  # -> shadow_calc; plug-in component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
toggle_3 = BooleanToggle(True)
simoutput = HBSimulationOutput(
    zone_energy_use=toggle_3,
    hvac_energy_use=toggle_3,
    gains_and_losses=toggle_3,
    comfort_metrics=toggle_3,
    surface_temperature=toggle_3,
    surface_energy_flow=toggle_3)  # -> report, sim_output; plug-in component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
path = FilePath("C:\Users\admin\masterwin\thermal\epw\USA_AZ_Tucson-Davis-Monthan.AFB.722745_TMY3\USA_AZ_Tucson-Davis-Monthan.AFB.722745_TMY3.ddy")
sizingpar = HBSizingParameter(ddy_file=path, heating_fac="1", cooling_fac="1")  # -> sizing; plug-in component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
simpar = HBSimulationParameter(output=simoutput.sim_output, timestep=6, sim_control=simcontrol, shadow_calc=shadowcalc, sizing=sizingpar)  # -> sim_par; plug-in component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
toggle_4 = BooleanToggle(False)  # disabled
panel_7 = Panel("G:\My Drive\PennDesign\DoE-ARPA-E-TAL\006 - os measure\CreateTypicalDOEBuildingFromModel")  # disabled
panel_8 = Panel("90.1-2016")  # disabled
toggle_5 = BooleanToggle(False)  # disabled
path_2 = FilePath("C:\Users\admin\masterwin\thermal\epw\USA_AZ_Tucson-Davis-Monthan.AFB.722745_TMY3\USA_AZ_Tucson-Davis-Monthan.AFB.722745_TMY3.epw")
loadmeasure = HBLoadMeasure(measure_path=panel_7, template=panel_8, add_constructions=toggle_4, remove_objects=toggle_5)  # -> report, measure; disabled; plug-in component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
modeltoosm = HBModelToOSM(
    model=model.model,
    epw_file=path_2,
    sim_par=simpar,
    measures=loadmeasure.measure,
    folder="C:\Users\admin\masterwin\thermal\sim",
    write=Toggle(False),
    run="2")  # -> report, jsons, osw, osm, idf, sql, zsz, rdd, html; plug-in component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
panel_9 = Panel(modeltoosm.osm)
roomenergyresult = HBReadRoomEnergyResult(sql=modeltoosm.sql)  # -> cooling, heating, lighting, electric_equip, gas_equip, process, hot_water, fan_electric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; disabled; plug-in component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

toggle_6 = BooleanToggle(False)  # disabled
faceresult = HBReadFaceResult(sql=modeltoosm.sql)  # -> face_indoor_temp, face_outdoor_temp, face_energy_flow; disabled; plug-in component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
panel_10 = Panel("kWh/m2")  # disabled
panel_11 = Panel("Total EUI")  # disabled
number_slider = Slider(300, range=0..300)  # disabled
panel_12 = Panel("18")  # disabled
number_slider_2 = Slider(10, range=0..300)  # disabled
panel_13 = Panel("19")  # disabled
colrange = LBColorRange(index=panel_13)  # -> colors; disabled; plug-in component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
panel_14 = Panel(" ")  # disabled
colrange_2 = LBColorRange(index=panel_12)  # -> colors; disabled; plug-in component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
neg = Negative(Value=number_slider)  # disabled
neg_2 = Negative(Value=number_slider_2)  # disabled
legendpar = LBLegendParameters(min=neg, max=number_slider, colors=colrange)  # -> leg_par; disabled; plug-in component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
legendpar_2 = LBLegendParameters(min=neg_2, max=number_slider_2, colors=colrange_2)  # -> leg_par; disabled; plug-in component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
panel_15 = Panel("Energy Balance")  # disabled
panel_16 = Panel("")  # disabled
toggle_7 = BooleanToggle(True)  # disabled
toggle_8 = BooleanToggle(True)  # disabled
pt = Point(Point(109.8477153, 81.415335, 0))  # disabled
pt_2 = Point(Point(109.8477153, 148.0667584, 0))  # disabled

eui = HBEndUseIntensity(sql=modeltoosm.sql, ip=toggle_6)  # -> eui, eui_end_use, end_uses, gross_floor; disabled; plug-in component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
panel_17 = Panel(eui.end_uses)  # disabled
loadbalance = HBThermalLoadBalance(
    rooms_model=flatten(addsubface),
    cooling=roomenergyresult.cooling,
    heating=roomenergyresult.heating,
    lighting=roomenergyresult.lighting,
    electric_equip=roomenergyresult.electric_equip,
    gas_equip=roomenergyresult.gas_equip,
    process=roomenergyresult.process,
    hot_water=roomenergyresult.hot_water,
    people_gain=roomenergyresult.people_gain,
    solar_gain=roomenergyresult.solar_gain,
    infiltration_load=roomenergyresult.infiltration_load,
    mech_vent_load=roomenergyresult.mech_vent_load,
    nat_vent_load=roomenergyresult.nat_vent_load,
    face_energy_flow=faceresult.face_energy_flow)  # -> report, balance, balance_stor, norm_bal, norm_bal_stor; disabled; plug-in component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

merge_2 = Merge(Data1=eui.eui, Data2=eui.eui_end_use)  # -> simplify(flatten(Result)); disabled
merge_3 = Merge(Data1=panel_11, Data2=flatten(panel_17))  # -> simplify(Result); disabled
clean = CleanTree(RemoveNulls=True, RemoveInvalid=True, RemoveEmpty=False, Tree=merge_2)  # disabled
long = LongestList(ListA=flatten(clean), ListB=panel_10, PaddingMode=2)  # -> graft(ListA), graft(ListB); disabled
merge_4 = Merge(Data1=graft(merge_3), Data2=graft(clean), Data3=long.ListB)  # disabled
join = TextJoin(Text=merge_4, Join=panel_14)  # disabled
timeop = LBTimeIntervalOperation(data=loadbalance.norm_bal)  # -> daily, monthly, mon_per_hr; disabled; plug-in component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
data = Data(flatten(join))  # disabled
join_2 = TextJoin(Text=[panel_15, data], Join=panel_16)  # disabled
monthlychart = LBMonthlyChart(data=timeop.daily, base_pt=pt_2, stack=toggle_7, global_title=join_2, legend_par=legendpar)  # -> report, data_mesh, data_lines, col_lines, legend, borders, labels, y_title, title; disabled; plug-in component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
monthlychart_2 = LBMonthlyChart(data=timeop.monthly, base_pt=pt, stack=toggle_8, global_title=join_2, legend_par=legendpar_2)  # -> report, data_mesh, data_lines, col_lines, legend, borders, labels, y_title, title; disabled; plug-in component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

panel_18 = Panel(join)  # disabled
