# Grasshopper definition 20230817_BaselineEnergyModel_11_Swap.gh (Grasshopper 1.0.7)

config = HBConfig()  # -> python_exe, py_lib_install, rad_install, os_install, ep_install, hb_os_gem, standards, asset_report, default_sim; plug-in component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
versions = HBCheckVersions()  # -> lbt_gh, python, radiance, openstudio, energyplus; plug-in component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

windows = Geometry([<brep referenced from the Rhino model> x4])
aperture = HBAperture(geo=windows, name="Windows", operable=Toggle(True))  # -> report, apertures; plug-in component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

rooms = Brep(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)

# ---- group: Input Rooms
rooms_2 = Brep(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)

# ---- group: Input Plenum
rooms_3 = Brep(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)

# ----
panel = Panel("C:\Users\admin\masterwin\thermal\sim_\DOEPrototype\openstudio\run\in.osm")
panel_2 = Panel(versions.lbt_gh)
panel_3 = Panel(versions.openstudio)
panel_4 = Panel([config.python_exe, config.py_lib_install])
roomsolid = HBRoomFromSolid(geo=flatten(rooms), conditioned=True)  # -> report, rooms; plug-in component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

# ---- group: Interior Walls
floor_to_ceiling_height = Panel("2.74")
perimeter_thermal_zone_depth = Panel("4.572")
debrep = DeconstructBrep(Brep=rooms_2)  # -> Faces, Edges, Vertices
item = ListItem(List=debrep.Faces, Index=0, Wrap=True)  # -> Item, Item1, Item2
skeleton = HBStraightSkeleton(floor_geo=item.Item, offset=perimeter_thermal_zone_depth)  # -> polyskel, perim_poly, core_poly; plug-in component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
lng = ListLength(List=flatten(skeleton.perim_poly))
lng_2 = ListLength(List=flatten(item.Item))
Z = UnitZ(Factor=floor_to_ceiling_height)
division = Division(A=lng, B=lng_2)
extr = Extrude(Base=skeleton.perim_poly, Direction=Z)
partition = PartitionList(List=extr, Size=division)
extr_2 = Extrude(Base=skeleton.core_poly, Direction=Z)  # -> graft(Extrusion)
partition_2 = PartitionList(List=skeleton.perim_poly, Size=division)
ins = InsertItems(List=partition, Item=extr_2, Indices=4, Wrap=True)

# ---- group: Boundary Condition
panel_5 = Panel("""1
4
7
10
13""")
panel_6 = Panel("""Rm1_Wall_
Rm2_Wall_
Rm3_Wall_
Rm4_Wall_
Rm5_Wall_""")
debrep_2 = DeconstructBrep(Brep=ins)  # -> Faces, Edges, Vertices
debrep_3 = DeconstructBrep(Brep=rooms_3)  # -> Faces, Edges, Vertices
item_2 = ListItem(List=debrep_2.Faces, Index=0, Wrap=True)
item_3 = ListItem(List=debrep_3.Faces, Index=panel_5, Wrap=True)
face = HBFace(geo=flatten(item_2), name="ExposedFloor", bc="Adiabatic")  # -> report, graft(faces); plug-in component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
face_2 = HBFace(geo=debrep_2.Faces, name=graft(panel_6))  # -> report, faces; plug-in component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
face_3 = HBFace(geo=item_3, name="ExposedCeiling_", bc="Adiabatic")  # -> report, faces; plug-in component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
face_4 = HBFace(geo=debrep_3.Faces)  # -> report, faces; plug-in component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
replace = ReplaceItems(List=face_2.faces, Item=face.faces, Indices="0", Wrap=False)
replace_2 = ReplaceItems(List=face_4.faces, Item=face_3.faces, Indices=panel_5, Wrap=False)

# ----
loademodel = HBLoadGbXMLOSMIDF(model_file=panel, load=Toggle(True))  # -> report, model; plug-in component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
versioner = LBVersioner(update=Toggle(False), version="1.6.8")  # -> Vviiiiiz; plug-in component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
syncghfile = LBSyncGrasshopperFile(sync=Toggle(False))  # -> report; plug-in component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
model = HBModel(rooms=flatten(roomsolid.rooms), name="DOEPrototype")  # -> report, model; plug-in component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
panel_7 = Panel(syncghfile)
panel_8 = Panel("C:\Users\admin\masterwin\thermal\mea\CreateDOEPrototypeBuilding")
path = FilePath("C:\Users\admin\masterwin\thermal\epw\USA_AZ_Tucson-Davis-Monthan.AFB.722745_TMY3\USA_AZ_Tucson-Davis-Monthan.AFB.722745_TMY3.epw")
create_doe_prototype_building = CreateDOEPrototypeBuilding(
    measure_path=panel_8,
    building_type="MediumOffice",
    template="90.1-2016",
    climate_zone="ASHRAE 169-2013-1A",
    epw_file="Not Applicable")  # -> report, measure; plug-in component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
toggle = BooleanToggle(False)
roomenergyattr = HBRoomEnergyAttributes({"Program": "properties.energy.program_type.display_name", "Construction Set": "properties.energy.construction_set.display_name", "Is Conditioned": "properties.energy.is_conditioned", "People per Area [ppl/m2]": "properties.energy.people.people_per_area", "Area per Person [m2/ppl]": "properties.energy.people.area_per_person", "Lighting per Area [W/m2]": "properties.energy.lighting.watts_per_area"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}, selected="Infiltration per Exterior Area [m3/s-m2]": "properties.energy.infiltration.flow_per_exterior_area")
faceenergyattr = HBFaceEnergyAttributes({"Construction": "properties.energy.construction.display_name", "Materials": "properties.energy.construction.layers", "Thickness [m]": "properties.energy.construction.thickness", "Density [kg/m2]": "properties.energy.construction.mass_area_density", "Heat Capacity [kg/K-m2]": "properties.energy.construction.area_heat_capacity", "R-Value [m2-K/W]": "properties.energy.construction.r_value", "U-Value [W/m2-K]": "properties.energy.construction.u_value", "U-Factor [W/m2-K]": "properties.energy.construction.u_factor", "SHGC [Unshaded]": "properties.energy.construction.shgc", "Solar Transmitance [Unshaded]": "properties.energy.construction.solar_transmittance", "Visible Transmitance [Unshaded]": "properties.energy.construction.visible_transmittance", "Solar Reflectance [Outside]": "properties.energy.construction.outside_solar_reflectance", "Solar Reflectance [Inside]": "properties.energy.construction.inside_solar_reflectance", "Fraction Area Operable": "properties.energy.vent_opening.fraction_area_operable", "Fraction Height Operable": "properties.energy.vent_opening.fraction_height_operable", "Discharge Coefficient": "properties.energy.vent_opening.discharge_coefficient"}, selected="Construction")
modeltoosm = HBModelToOSM(
    model=model.model,
    epw_file=path,
    measures=create_doe_prototype_building.measure,
    folder="C:\Users\admin\masterwin\thermal\sim_",
    write=toggle,
    run=toggle)  # -> report, jsons, osw, osm, idf, sql, zsz, rdd, html; plug-in component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
panel_9 = Panel("C:\Users\admin\masterwin\thermal\sim_\DOEPrototype\openstudio\run\eplusout.sql")
vizbybc = HBVisualizeByBC(hb_objs=loademodel.model)  # -> outdoors, surface, ground, adiabatic, other, wire_frame; plug-in component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
vizbytype = HBVisualizeByType(hb_objs=loademodel.model)  # -> walls, interior_walls, roofs, ceilings, exterior_floors, interior_floors, air_walls, apertures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; plug-in component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
labelrooms = HBLabelRooms(rooms_model=flatten(loademodel.model), attribute=roomenergyattr, txt_height="1")  # -> label_text, base_pts, labels, wire_frame; plug-in component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
lablefaces = HBLabelFaces(hb_objs=flatten(loademodel.model), attribute=faceenergyattr, sub_faces="1", txt_height="1")  # -> label_text, base_pts, labels, wire_frame; plug-in component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
deconstructmodel = HBDeconstructModel(model=loademodel.model)  # -> rooms, faces, apertures, doors, shades; plug-in component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
bldgvintages = HBBuildingVintages({"ASHRAE 90.1 2019  |  IECC 2021": "2019", "ASHRAE 90.1 2016  |  IECC 2018": "2016", "ASHRAE 90.1 2013  |  IECC 2015": "2013", "ASHRAE 90.1 2010  |  IECC 2012": "2010", "ASHRAE 90.1 2007  |  IECC 2009": "2007", "ASHRAE 90.1 2004  |  IECC 2006": "2004", "1980-2004 (CBECS)": "1980_2004", "Pre-1980 (CBECS)": "pre_1980"}, selected="ASHRAE 90.1 2016  |  IECC 2018")
constructiontypes = HBConstructionTypes({"SteelFramed", "WoodFramed", "Mass", "Metal Building"}, selected="SteelFramed")
opendir = LBOpenDirectory(file_path=panel_9)  # -> report; disabled; plug-in component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
geo = Geometry(vizbytype.doors)
geo_2 = Geometry(vizbybc.adiabatic)
geo_3 = Geometry(vizbytype.interior_walls)
geo_4 = Geometry(vizbytype.ceilings)
geo_5 = Geometry(vizbytype.interior_floors)
geo_6 = Geometry(vizbytype.apertures)
geo_7 = Geometry(vizbytype.wire_frame)
floorheight = HBRoomsByFloorHeight(rooms=flatten(deconstructmodel.rooms))  # -> flr_hgts, rooms; plug-in component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
eui = HBEndUseIntensity(sql=panel_9)  # -> eui, eui_end_use, end_uses, gross_floor; plug-in component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
searchprog = HBSearchPrograms(vintage=bldgvintages, keywords="Plenum")  # -> room_prog; plug-in component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
searchprog_2 = HBSearchPrograms(vintage=bldgvintages, keywords="MediumOffice")  # -> room_prog; plug-in component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
panel_10 = Panel(eui.end_uses)
bang = ExplodeTree(Data=simplify(floorheight.rooms))  # -> Branch0, Branch1, Branch2, Branch3, Branch4, Branch5
panel_11 = Panel("""Room-East
Room-North
Room-West
Room-South
Room-Core""")
panel_12 = Panel(eui.eui_end_use)
item_4 = ListItem(List=searchprog, Index="0", Wrap=True)
item_5 = ListItem(List=searchprog_2, Index="8", Wrap=True)
data = Data([item_5, item_4])
panel_13 = Panel(data)
all_air = HBAllAirHVACTemplates({"VAV chiller with gas boiler reheat": "VAV_Chiller_Boiler", "VAV chiller with central air source heat pump reheat": "VAV_Chiller_ASHP", "VAV chiller with district hot water reheat": "VAV_Chiller_DHW", "VAV chiller with PFP boxes": "VAV_Chiller_PFP", "VAV chiller with gas coil reheat": "VAV_Chiller_GasCoil", "VAV air-cooled chiller with gas boiler reheat": "VAV_ACChiller_Boiler", "VAV air-cooled chiller with central air source heat pump reheat": "VAV_ACChiller_ASHP", "VAV air-cooled chiller with district hot water reheat": "VAV_ACChiller_DHW", "VAV air-cooled chiller with PFP boxes": "VAV_ACChiller_PFP", "VAV air-cooled chiller with gas coil reheat": "VAV_ACChiller_GasCoil"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}, selected="PVAV with gas boiler reheat": "PVAV_Boiler")
bldgvintages_2 = HBBuildingVintages({"ASHRAE 90.1 2019  |  IECC 2021": "2019", "ASHRAE 90.1 2016  |  IECC 2018": "2016", "ASHRAE 90.1 2013  |  IECC 2015": "2013", "ASHRAE 90.1 2010  |  IECC 2012": "2010", "ASHRAE 90.1 2007  |  IECC 2009": "2007", "ASHRAE 90.1 2004  |  IECC 2006": "2004", "1980-2004 (CBECS)": "1980_2004", "Pre-1980 (CBECS)": "pre_1980"}, selected="ASHRAE 90.1 2016  |  IECC 2018")
panel_14 = Panel("20230923_DOEPrototype_GH")
roomenergyattr_2 = HBRoomEnergyAttributes({"Program": "properties.energy.program_type.display_name", "Construction Set": "properties.energy.construction_set.display_name", "Is Conditioned": "properties.energy.is_conditioned", "People per Area [ppl/m2]": "properties.energy.people.people_per_area", "Area per Person [m2/ppl]": "properties.energy.people.area_per_person", "Lighting per Area [W/m2]": "properties.energy.lighting.watts_per_area"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}, selected="Infiltration per Exterior Area [m3/s-m2]": "properties.energy.infiltration.flow_per_exterior_area")
faceenergyattr_2 = HBFaceEnergyAttributes({"Construction": "properties.energy.construction.display_name", "Materials": "properties.energy.construction.layers", "Thickness [m]": "properties.energy.construction.thickness", "Density [kg/m2]": "properties.energy.construction.mass_area_density", "Heat Capacity [kg/K-m2]": "properties.energy.construction.area_heat_capacity", "R-Value [m2-K/W]": "properties.energy.construction.r_value", "U-Value [W/m2-K]": "properties.energy.construction.u_value", "U-Factor [W/m2-K]": "properties.energy.construction.u_factor", "SHGC [Unshaded]": "properties.energy.construction.shgc", "Solar Transmitance [Unshaded]": "properties.energy.construction.solar_transmittance", "Visible Transmitance [Unshaded]": "properties.energy.construction.visible_transmittance", "Solar Reflectance [Outside]": "properties.energy.construction.outside_solar_reflectance", "Solar Reflectance [Inside]": "properties.energy.construction.inside_solar_reflectance", "Fraction Area Operable": "properties.energy.vent_opening.fraction_area_operable", "Fraction Height Operable": "properties.energy.vent_opening.fraction_height_operable", "Discharge Coefficient": "properties.energy.vent_opening.discharge_coefficient"}, selected="Construction")

analysisperiod = LBAnalysisPeriod(start_month="1", start_day=1, start_hour=0, end_month="3")  # -> period, hoys, dates; plug-in component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

toggle_2 = BooleanToggle(True)
toggle_3 = BooleanToggle(True)
simoutput = HBSimulationOutput(
    zone_energy_use=toggle_2,
    hvac_energy_use=toggle_2,
    gains_and_losses=toggle_2,
    comfort_metrics=toggle_2,
    surface_temperature=toggle_2,
    surface_energy_flow=toggle_2)  # -> report, sim_output; plug-in component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
simcontrol = HBSimulationControl(
    do_zone_sizing=toggle_3,
    do_system_sizing=toggle_3,
    do_plant_sizing=toggle_3,
    for_sizing_period=Toggle(False),
    for_run_period=toggle_3)  # -> sim_control; plug-in component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
shadowcalc = HBShadowCalculation(solar_dist="FullInteriorAndExterior", frequency="30", max_figures="15000")  # -> shadow_calc; plug-in component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
toggle_4 = BooleanToggle(False)
panel_15 = Panel("C:\Users\admin\masterwin\thermal\mea\CreateTypicalDOEBuildingFromModel")
panel_16 = Panel("Forced Air")
create_typical_doe_building_from_model = CreateTypicalDOEBuildingFromModel(
    measure_path=panel_15,
    template="90.1-2016",
    system_type="Inferred",
    swh_src="Inferred",
    add_constructions=toggle_4,
    add_elevators=toggle_4,
    add_exterior_lights=Toggle(True),
    add_hvac=Toggle(False))  # -> report, measure; plug-in component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
path_2 = FilePath("C:\Users\admin\masterwin\thermal\epw\USA_HI_Honolulu.Intl.AP.911820_TMY3\USA_HI_Honolulu.Intl.AP.911820_TMY3.epw")
path_3 = FilePath("C:\Users\admin\masterwin\thermal\epw\USA_HI_Honolulu.Intl.AP.911820_TMY3\USA_HI_Honolulu.Intl.AP.911820_TMY3.ddy")
panel_17 = Panel(path_3)
sizingpar = HBSizingParameter(ddy_file=panel_17, heating_fac="1", cooling_fac="1")  # -> sizing; plug-in component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
simpar = HBSimulationParameter(
    output=simoutput.sim_output,
    run_period=analysisperiod.period,
    timestep=6,
    sim_control=simcontrol,
    shadow_calc=shadowcalc,
    sizing=sizingpar)  # -> sim_par; plug-in component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
panel_18 = Panel(path_2)
constrsetclimate = HBConstructionSetByClimate(climate_zone="2B", vintage=bldgvintages, constr_type=constructiontypes)  # -> constr_set; plug-in component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
room = HBRoom(faces=replace, name=graft(panel_11), constr_set=constrsetclimate, conditioned=Toggle(True))  # -> report, room; plug-in component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
room_2 = HBRoom(faces=flatten(replace_2), name="L2Plenum", constr_set=constrsetclimate, conditioned=Toggle(False))  # -> report, room; plug-in component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

# ----
# Program_type from Room
deconstrprogram = HBDeconstructProgramType(rooms=flatten(bang.Branch2))  # -> space_types; inputs rooms: list
#   port rooms: A ProgramType object or text for the identifier of a ProgramType to be looked up in the program type library.
# ---------- deconstrprogram: Python ----------
try:  # import the core honeybee dependencies
    from honeybee.model import Model
    from honeybee.colorobj import ColorRoom
except ImportError as e:
    raise ImportError('\nFailed to import honeybee:\n\t{}'.format(e))

try:  # import the ladybug_rhino dependencies
    from ladybug_rhino.grasshopper import all_required_inputs, list_to_data_tree
except ImportError as e:
    raise ImportError('\nFailed to import ladybug_rhino:\n\t{}'.format(e))


if True:
    # extract any rooms from input Models
    in_rooms = []
    for hb_obj in _rooms:
        if isinstance(hb_obj, Model):
            in_rooms.extend(hb_obj.rooms)
        else:
            in_rooms.append(hb_obj)
    
    # Get unique spc_types from rooms
    space_type_str = "properties.energy.program_type.identifier"
    color_obj = ColorRoom(in_rooms, space_type_str)
    # Since it includes infil, actually space
    unique_space_types = color_obj.attributes_unique
    
    # loop through each of the rooms and get the attributes
    people = [[] for st in unique_space_types]
    lighting = [[] for st in unique_space_types]
    electric_equip = [[] for st in unique_space_types]
    gas_equip = [[] for st in unique_space_types]
    hot_water = [[] for st in unique_space_types]
    infiltration = [[] for st in unique_space_types]
    ventilation = [[] for st in unique_space_types]
    setpoint = [[] for st in unique_space_types]
    space_types = [[] for st in unique_space_types]
    
    for atr, room in zip(color_obj.attributes, in_rooms):
        atr_i = unique_space_types.index(atr)
        prog = room.properties.energy.program_type
        people[atr_i].append(prog.people)
        lighting[atr_i].append(prog.lighting)
        electric_equip[atr_i].append(prog.electric_equipment)
        gas_equip[atr_i].append(prog.gas_equipment)
        hot_water[atr_i].append(prog.service_hot_water)
        infiltration[atr_i].append(prog.infiltration)
        ventilation[atr_i].append(prog.ventilation)
        setpoint[atr_i].append(prog.setpoint)
        space_types[atr_i].append(prog)
        
    setpt = setpoint
    print(setpt)
    
    people = list_to_data_tree(people)
    lighting = list_to_data_tree(lighting)
    electric_equip = list_to_data_tree(electric_equip)
    gas_equip = list_to_data_tree(gas_equip)
    hot_water = list_to_data_tree(hot_water)
    infiltration = list_to_data_tree(infiltration)
    ventilation = list_to_data_tree(ventilation)
    setpoint = list_to_data_tree(setpoint)
    space_types = list_to_data_tree(space_types)
# ---------- end deconstrprogram ----------
deconstrprogram_2 = HBDeconstructProgramType(rooms=flatten(bang.Branch3))  # -> space_types; inputs rooms: list; same code as deconstrprogram
applyprogram = HBApplyProgramType(rooms=flatten(room.room), program=deconstrprogram)  # -> report, rooms; plug-in component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
applyprogram_2 = HBApplyProgramType(rooms=flatten(room_2.room), program=deconstrprogram_2)  # -> report, rooms; plug-in component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

# ----
# Correction: Needs to be flattened or else
#  we get outdoor roof/ceiling for plenum interior
merge = Merge(Data1=applyprogram.rooms, Data2=applyprogram_2.rooms)  # -> flatten(Result)

# ---- group: Plenum to Room per Level
toggle_5 = BooleanToggle(True)
solveadj = HBSolveAdjacency(rooms=merge, adiabatic=Toggle(False), overwrite=toggle_5, run=toggle_5)  # -> report, simplify(adj_rooms); plug-in component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

# ----
addsubface = HBAddSubface(hb_obj=flatten(solveadj.adj_rooms), sub_faces=flatten(aperture.apertures))  # -> hb_obj; plug-in component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
applysetpointvals = HBApplySetpointValues(room_or_program=flatten(addsubface), cooling_setpt="29", heating_setpt="20")  # -> report, mod_obj; plug-in component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
allairhvac = HBAllAirHVAC(rooms=flatten(applysetpointvals.mod_obj), system_type=all_air, vintage=bldgvintages_2)  # -> report, rooms; plug-in component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
model_2 = HBModel(rooms=flatten(allairhvac.rooms), name="20230817_DOEPrototype_GH")  # -> report, model; plug-in component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
vizbytype_2 = HBVisualizeByType(hb_objs=model_2.model)  # -> walls, interior_walls, roofs, ceilings, exterior_floors, interior_floors, air_walls, apertures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; plug-in component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
vizbybc_2 = HBVisualizeByBC(hb_objs=model_2.model)  # -> outdoors, surface, ground, adiabatic, other, wire_frame; plug-in component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
labelrooms_2 = HBLabelRooms(rooms_model=flatten(model_2.model), attribute=roomenergyattr_2, txt_height="1")  # -> label_text, base_pts, labels, wire_frame; plug-in component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
lablefaces_2 = HBLabelFaces(hb_objs=flatten(model_2.model), attribute=faceenergyattr_2, txt_height="1")  # -> label_text, base_pts, labels, wire_frame; plug-in component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
geo_8 = Geometry(vizbybc_2.surface)
geo_9 = Geometry(vizbytype_2.interior_walls)
geo_10 = Geometry([vizbytype_2.roofs, vizbytype_2.exterior_floors])
geo_11 = Geometry([vizbytype_2.interior_floors, vizbytype_2.ceilings])
geo_12 = Geometry(vizbytype_2.apertures)
geo_13 = Geometry(vizbytype_2.doors)
geo_14 = Geometry(vizbytype_2.wire_frame)
data_2 = Data(labelrooms_2.labels)
panel_19 = Panel("C:\Users\admin\masterwin\thermal\sim_\20230923_DOEPrototype_GH\openstudio\run\in.osm")
panel_20 = Panel(panel_18)
modeltoosm_2 = HBModelToOSM(
    model=model_2.model,
    epw_file=panel_18,
    sim_par=simpar,
    folder="C:\Users\admin\masterwin\thermal\sim_",
    write=Toggle(True),
    run="2")  # -> report, jsons, osw, osm, idf, sql, zsz, rdd, html; plug-in component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
toggle_6 = BooleanToggle(False)
file = ReadFile(File="C:\Users\admin\masterwin\thermal\lbt\swap_gh.py", PerLineParse=False)
swaposm = SwapOSM(
    Code=file,
    _osm="C:\Users\admin\masterwin\thermal\simops\run\in.osm",
    _epw=panel_20,
    _mea=create_typical_doe_building_from_model.measure,
    Run_swap_=Toggle(True),
    Run_sim_=toggle_6,
    Update_=toggle_6)  # -> Out, Osm, Idf, Sql, Zsz, Rdd, Html, Err
panel_21 = Panel(modeltoosm_2.osm)
panel_22 = Panel("C:\Users\admin\masterwin\thermal\simops\run\run\eplusout.sql")
panel_23 = Panel("C:\Users\admin\masterwin\thermal\simops\run\in_swap\run\eplusout.sql")
panel_24 = Panel(swaposm.Sql)
opendir_2 = LBOpenDirectory(file_path=swaposm.Html)  # -> report; disabled; plug-in component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
eui_2 = HBEndUseIntensity(sql=panel_22)  # -> eui, eui_end_use, end_uses, gross_floor; plug-in component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
eui_3 = HBEndUseIntensity(sql=panel_9)  # -> eui, eui_end_use, end_uses, gross_floor; plug-in component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
panel_25 = Panel(swaposm.Out)
config_2 = HBConfig()  # -> python_exe, py_lib_install, rad_install, os_install, ep_install, hb_os_gem, standards, asset_report, default_sim; plug-in component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
versions_2 = HBCheckVersions()  # -> lbt_gh, python, radiance, openstudio, energyplus; plug-in component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
panel_26 = Panel(eui_3.eui)
panel_27 = Panel(eui_3.end_uses)
panel_28 = Panel(eui_2.eui)
panel_29 = Panel(eui_2.end_uses)
panel_30 = Panel([config_2.python_exe, config_2.py_lib_install])
panel_31 = Panel([versions_2.lbt_gh, versions_2.python, versions_2.radiance, versions_2.openstudio, versions_2.energyplus])
panel_32 = Panel(eui_3.eui_end_use)
panel_33 = Panel(eui_2.eui_end_use)
panel_34 = Panel("""18.747
9.605
0.483
0.48
0.4
6.479
16.536
6.955
0.002
3.251""")
