# Grasshopper definition baseline_CZ1A_L123.gh (Grasshopper 1.0.7)

opaquemat = HBOpaqueMaterial(
    name="100mm Normalweight Concrete floor",
    thickness="0.101600",
    conductivity="2.31",
    density="2322",
    spec_heat="832",
    roughness="MediumSmooth",
    therm_absp="0.9",
    sol_absp="0.7",
    vis_absp="0.7")  # -> mat; plug-in component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

opaquematnomass = HBOpaqueMaterialNoMass(
    name="Typical Insulation R-0.54",
    r_value="0.094503",
    roughness="Smooth",
    therm_absp="0.9",
    sol_absp="0.7",
    vis_absp="0.7")  # -> mat; plug-in component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

opaquematnomass_2 = HBOpaqueMaterialNoMass(
    name="Typical Insulation R-5.89",
    r_value="1.036522",
    roughness="Smooth",
    therm_absp="0.9",
    sol_absp="0.7",
    vis_absp="0.7")  # -> mat; plug-in component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

opaquematnomass_3 = HBOpaqueMaterialNoMass(
    name="Typical Insulation R-19.72",
    r_value="3.472204",
    roughness="Smooth",
    therm_absp="0.9",
    sol_absp="0.7",
    vis_absp="0.7")  # -> mat; plug-in component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

opaquemat_2 = HBOpaqueMaterial(
    name="Acoustic Tile 1/2 in.",
    thickness="0.0127",
    conductivity="0.057633",
    density="288.332341",
    spec_heat="795.492",
    roughness="MediumSmooth",
    therm_absp="0.9",
    sol_absp="0.00",
    vis_absp="0.00")  # -> mat; plug-in component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

searchmats = HBSearchMaterials(keywords="CP02 Carpet Pad")  # -> flatten(opaque_mats), window_mats; plug-in component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
searchmats_2 = HBSearchMaterials(keywords="25mm Stucco")  # -> flatten(opaque_mats), window_mats; plug-in component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
searchmats_3 = HBSearchMaterials(keywords="5/8 in. Gypsum Board")  # -> flatten(opaque_mats), window_mats; plug-in component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
searchmats_4 = HBSearchMaterials(keywords="8 in. Normalweight Concrete Floor")  # -> opaque_mats, window_mats; plug-in component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
searchmats_5 = HBSearchMaterials(keywords="Typical Carpet pad")  # -> opaque_mats, window_mats; plug-in component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
searchmats_6 = HBSearchMaterials(keywords="Typical Carpet pad")  # -> flatten(opaque_mats), window_mats; plug-in component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
searchmats_7 = HBSearchMaterials(keywords="4 in. Normalweight concrete floor")  # -> flatten(opaque_mats), window_mats; plug-in component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
opaquematnomass_4 = HBOpaqueMaterialNoMass(
    name="Typical Insulation R-2.38",
    r_value="0.418404",
    roughness="Smooth",
    therm_absp="0.900000",
    sol_absp="0.7",
    vis_absp="0.7")  # -> mat; plug-in component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
searchmats_8 = HBSearchMaterials(keywords="Roof Membrane - Highly")  # -> flatten(opaque_mats), window_mats; plug-in component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
searchmats_9 = HBSearchMaterials(keywords="Metal Roof Surface")  # -> flatten(opaque_mats), window_mats; plug-in component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
searchmats_10 = HBSearchMaterials(keywords="F08 Metal surface")  # -> flatten(opaque_mats), window_mats; plug-in component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
opaquematnomass_5 = HBOpaqueMaterialNoMass(
    name="Typical Insulation R-1.85",
    r_value="0.326262",
    roughness="Smooth",
    therm_absp="0.900000",
    sol_absp="0.7",
    vis_absp="0.7")  # -> mat; plug-in component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
searchconstrs = HBSearchConstructions(keywords="U 0.57 SHGC 0.25 Simple Glazing")  # -> opaque_constrs, window_constrs, shade_constrs; plug-in component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
opaquemat_3 = HBOpaqueMaterial(
    name="Metal Roof Surface",
    thickness="0.000800",
    conductivity="45.280000",
    density="7824.000000",
    spec_heat="500.000000",
    roughness="Smooth",
    therm_absp="0.900000",
    sol_absp="0.700000",
    vis_absp="0.700000")  # -> mat; plug-in component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
searchmats_11 = HBSearchMaterials(keywords="G01 13mm gypsum board")  # -> opaque_mats, window_mats; plug-in component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
merge = Merge(Data1=searchmats_4.opaque_mats, Data2=searchmats_5.opaque_mats)
item = ListItem(List=searchmats_8.opaque_mats, Index=Slider(1, range=0..3), Wrap=True)
merge_2 = Merge(Data1=searchmats.opaque_mats, Data2=opaquemat)
merge_3 = Merge(Data1=opaquemat, Data2=searchmats.opaque_mats)
merge_4 = Merge(Data1=opaquematnomass, Data2=searchmats_7.opaque_mats, Data3=searchmats_6.opaque_mats)
panel = Panel(searchmats_9.opaque_mats)
merge_5 = Merge(Data1=searchmats_11.opaque_mats, Data2=searchmats_11.opaque_mats)
merge_6 = Merge(Data1=searchmats_10.opaque_mats, Data2=opaquematnomass_5)
opaqueconstr = HBOpaqueConstruction(name="Plenum Acoustic Tile", materials=opaquemat_2)  # -> constr; plug-in component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
panel_2 = Panel(item)
merge_7 = Merge(Data1=item, Data2=opaquematnomass_3, Data3=opaquemat_3)
merge_8 = Merge(Data1=searchmats_2.opaque_mats, Data2=searchmats_3.opaque_mats, Data3=opaquematnomass_2, Data4=searchmats_3.opaque_mats)
panel_3 = Panel("""DOE-Typical Insulated Exterior Mass;
Typical Insulated Exterior Mass Floor R-3.11""")
opaqueconstr_2 = HBOpaqueConstruction(name="Typical Insulated Carpeted 8in Slab Floor", materials=merge)  # -> constr; plug-in component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
opaqueconstr_3 = HBOpaqueConstruction(name="Typical IEAD Roof R-20.83", materials=merge_7)  # -> constr; plug-in component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
opaqueconstr_4 = HBOpaqueConstruction(name="Typical Insulated Steel Framed Exterior Wall R-8.06", materials=merge_8)  # -> constr; plug-in component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
opaqueconstr_5 = HBOpaqueConstruction(name="Typical Overhead Door R-3.23", materials=opaquematnomass_4)  # -> constr; plug-in component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
opaqueconstr_6 = HBOpaqueConstruction(name=panel_3, materials=merge_4)  # -> constr; plug-in component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
opaqueconstr_7 = HBOpaqueConstruction(name="Typical Insulated Metal Door R-2.7", materials=merge_6)  # -> constr; plug-in component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
opaqueconstr_8 = HBOpaqueConstruction(name="Typical Interior Wall", materials=merge_5)  # -> constr; plug-in component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
opaqueconstr_9 = HBOpaqueConstruction(name="Typical Interior Floor", materials=merge_2)  # -> constr; plug-in component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
opaqueconstr_10 = HBOpaqueConstruction(name="Typical Interior Ceiling", materials=merge_3)  # -> constr; plug-in component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
groundsubset = HBGroundConstructionSubset(ground_floor=opaqueconstr_2)  # -> ground_set; plug-in component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
subfacesubset = HBSubfaceSubset(
    window=searchconstrs.window_constrs,
    operable=searchconstrs.window_constrs,
    exterior_door=opaqueconstr_7,
    overhead_door=opaqueconstr_5,
    glass_door=searchconstrs.window_constrs)  # -> subface_set; plug-in component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
panel_4 = Panel("ground set")
panel_5 = Panel("interior set")
panel_6 = Panel("floor/ceiling")
interiorsubset = HBInteriorConstructionSubset(ceiling=opaqueconstr_10, interior_floor=opaqueconstr)  # -> interior_set; plug-in component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
exteriorsubset = HBExteriorConstructionSubset(exterior_wall=opaqueconstr_4, exterior_roof=opaqueconstr_3, exposed_floor=opaqueconstr_6)  # -> exterior_set; plug-in component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
panel_7 = Panel("exterior set")
interiorsubset_2 = HBInteriorConstructionSubset(interior_wall=opaqueconstr_8, ceiling=opaqueconstr, interior_floor=opaqueconstr_9)  # -> interior_set; plug-in component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
constructionset = HBConstructionSet(exterior_subset=exteriorsubset, interior_subset=interiorsubset)  # -> constr_set; plug-in component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
constructionset_2 = HBConstructionSet(
    exterior_subset=exteriorsubset,
    ground_subset=groundsubset,
    interior_subset=interiorsubset_2,
    subface_subset=subfacesubset)  # -> constr_set; plug-in component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

# ---- group: Internal Mass
opaquemat_4 = HBOpaqueMaterial(
    name="Std Wood 6inch",
    thickness="0.15",
    conductivity="0.12",
    density="540",
    spec_heat="1210",
    roughness="MediumSmooth",
    therm_absp="0.9",
    sol_absp="0.7",
    vis_absp="0.7")  # -> mat; plug-in component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
opaqueconstr_11 = HBOpaqueConstruction(name="InteriorFurnishings", materials=opaquemat_4)  # -> constr; plug-in component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

# ----
rooms = Brep([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])

# ---- group: Inteiror Walls
perimeter_thermal_zone_depth = Panel("4.572")
debrep = DeconstructBrep(Brep=rooms)  # -> Faces, Edges, Vertices
item_2 = ListItem(List=debrep.Faces, Index=0, Wrap=True)  # -> Item, Item1, Item2
skeleton = HBStraightSkeleton(floor_geo=item_2.Item, offset=perimeter_thermal_zone_depth)  # -> polyskel, perim_poly, core_poly; plug-in component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
floor_to_ceiling_height = Panel("2.74")
lng = ListLength(List=flatten(skeleton.perim_poly))
lng_2 = ListLength(List=flatten(item_2.Item))
division = Division(A=lng, B=lng_2)
Z = UnitZ(Factor=floor_to_ceiling_height)
extr = Extrude(Base=skeleton.perim_poly, Direction=Z)
partition = PartitionList(List=extr, Size=division)
extr_2 = Extrude(Base=skeleton.core_poly, Direction=Z)  # -> graft(Extrusion)
partition_2 = PartitionList(List=skeleton.perim_poly, Size=division)
ins = InsertItems(List=partition, Item=extr_2, Indices=4, Wrap=True)
clean = CleanTree(RemoveNulls=True, RemoveInvalid=True, RemoveEmpty=True, Tree=ins)

# ---- group: Plenum
core_poly = Geometry(graft(skeleton.core_poly))
perim_poly = Geometry(skeleton.perim_poly)
edges = BrepEdges(Brep=item_2.Item)  # -> Naked, Interior, NonManifold
partition_3 = PartitionList(List=perim_poly, Size=division)
plenum_height = Panel("1.22")
join = JoinCurves(Curves=edges.Naked, Preserve=False)
Z_2 = UnitZ(Factor=plenum_height)
addition = Addition(A=plenum_height, B=floor_to_ceiling_height)
merge_9 = Merge(Data1=partition_3, Data2=core_poly)
item_3 = ListItem(List=flatten(item_2.Item), Index=0, Wrap=True)  # -> Item, Item1, Item2
extr_3 = Extrude(Base=join, Direction=Z_2)  # -> flatten(Extrusion)
move = Move(Geometry=merge_9, Motion=Z)  # -> Geometry, Transform
Z_3 = UnitZ(Factor=addition)
bang = ExplodeTree(Data=simplify(move.Geometry))  # -> Branch0, Branch1, Branch2
move_2 = Move(Geometry=extr_3, Motion=Z)  # -> Geometry, Transform
move_3 = Move(Geometry=item_3.Item2, Motion=Z_3)  # -> Geometry, Transform
item_4 = ListItem(List=move_2.Geometry, Index=0, Wrap=True)  # -> Item, Item1, Item2
move_4 = Move(Geometry=bang.Branch1, Motion=Z_2)  # -> Geometry, Transform
move_5 = Move(Geometry=bang.Branch0, Motion=Z_2)  # -> Geometry, Transform
merge_10 = Merge(Data1=move_3.Geometry, Data2=bang.Branch2, Data3=item_4.Item2)  # -> flatten(Result)
merge_11 = Merge(Data1=bang.Branch1, Data2=move_4.Geometry, Data3=item_4.Item1)  # -> flatten(Result)
merge_12 = Merge(Data1=bang.Branch0, Data2=move_5.Geometry, Data3=item_4.Item)  # -> flatten(Result)
entwine = Entwine(Branch00=merge_12, Branch01=merge_11, Branch02=merge_10, FlattenInputs=True)
join_2 = BrepJoin(Breps=entwine)  # -> Breps, Closed
graft = GraftTree(Tree=join_2.Breps, IncludeEmptyLists=True, IncludeNullItems=True)

# ----
bldgvintages = HBBuildingVintages({"ASHRAE 90.1 2019  |  IECC 2021": "2019", "ASHRAE 90.1 2016  |  IECC 2018": "2016", "ASHRAE 90.1 2013  |  IECC 2015": "2013", "ASHRAE 90.1 2010  |  IECC 2012": "2010", "ASHRAE 90.1 2007  |  IECC 2009": "2007", "ASHRAE 90.1 2004  |  IECC 2006": "2004", "1980-2004 (CBECS)": "1980_2004", "Pre-1980 (CBECS)": "pre_1980"}, selected="ASHRAE 90.1 2016  |  IECC 2018")
constructiontypes = HBConstructionTypes({"SteelFramed", "WoodFramed", "Mass", "Metal Building"}, selected="SteelFramed")
constrsetclimate = HBConstructionSetByClimate(climate_zone="1A", vintage=bldgvintages, constr_type=constructiontypes)  # -> constr_set; plug-in component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
searchprog = HBSearchPrograms(vintage=bldgvintages, keywords="Whole")  # -> room_prog; plug-in component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

panel_8 = Panel(bldgvintages)
decnstrconstrsetint = HBDeconstructConstructionSetInterior(constr_set=constrsetclimate)  # -> interior_wall, ceiling, interior_floor, interior_window, interior_door, int_glass_door; plug-in component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
searchmats_12 = HBSearchMaterials(keywords="carpet")  # -> opaque_mats, window_mats; plug-in component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
decnstrconstrset = HBDeconstructConstructionSet(constr_set=constrsetclimate)  # -> exterior_wall, exterior_roof, exposed_floor, ground_wall, ground_roof, ground_floor, window, skylight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; plug-in component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
searchprog_2 = HBSearchPrograms(vintage=bldgvintages, keywords="Plenum")  # -> room_prog; plug-in component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
panel_9 = Panel(searchprog)
panel_10 = Panel(searchprog_2)

# ---- group: Names Perimeter Zones by Orientation
panel_12 = Panel("""custom_office_bt_perimeterRms
custom_office_md_perimeterRms
custom_office_tp_perimeterRms""")
panel_13 = Panel("""custom_office_bt_core
custom_office_md_core
custom_office_tp_core""")
area = Area(Geometry=partition)  # -> Area, Centroid
avr = Average(Input=area.Centroid)
subtraction = Subtraction(A=area.Centroid, B=avr)
python = GhPythonScript(x=subtraction)  # -> a
# ---------- python: Python ----------
if x is None: 
    a = None
else:
    eps = 1e-5 
    px, py = x[0], x[1]

    if abs(abs(px) - abs(py)) < eps:
        if (px * py) > 0.0:
            a = "2" if px > 0.0 else "4"
        else:
            a = "3" if py > 0.0 else "1"
            
    elif abs(px) > abs(py):
        a = "2" if px > 0.0 else "4" 
    else:
        a = "3" if py > 0.0 else "1"
# ---------- end python ----------
concat = Concatenate(FragmentA=graft(panel_12), FragmentB=python)  # -> simplify(Result)
ins_2 = InsertItems(List=concat, Item=graft(panel_13), Indices=4, Wrap=True)  # -> simplify(List)
panel_14 = Panel(ins_2)

# ----
item_5 = ListItem(List=searchprog, Index="3", Wrap=True)
item_6 = ListItem(List=searchprog_2, Index="0", Wrap=True)
panel_15 = Panel(item_6)
panel_16 = Panel(item_5)

# ---- group: Rooms
roomsolid = HBRoomFromSolid(geo=clean, name=ins_2, constr_set=constructionset_2, conditioned=Toggle(True), roof_angle=5)  # -> report, simplify(rooms); plug-in component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

# ---- group: Names Perimeter Zones by Orientation
panel_17 = Panel("""FirstFloor_Plenum
MidFloor_Plenum
TopFloor_Plenum""")
concat_2 = Concatenate(FragmentA=panel_17)  # -> simplify(graft(Result))

# ---- group: Plenum
roomsolid_2 = HBRoomFromSolid(geo=graft, name=concat_2, constr_set=constructionset, program=item_6, conditioned=Toggle(False), roof_angle=5)  # -> report, rooms; plug-in component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

# ----
roomattr = HBRoomAttributes({"Display Name": "display_name", "Simulation Name (Identifier)": "identifier", "Multiplier": "multiplier", "Story": "story", "Volume": "volume", "Gross Floor Area": "floor_area", "Exposed Area": "exposed_area", "Exterior Wall Area": "exterior_wall_area", "Exterior Aperture Area": "exterior_aperture_area", "Average Floor Elevation": "average_floor_height"}, selected="Gross Floor Area")
roomsbyattr = HBRoomsByAttribute(rooms=graft(roomsolid.rooms), attribute=roomattr)  # -> values, rooms; plug-in component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
roomsbyattr_2 = HBRoomsByAttribute(rooms=graft(roomsolid_2.rooms), attribute=roomattr)  # -> values, rooms; plug-in component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

deconstrprogram = HBDeconstructProgramType(program=item_6)  # -> people, lighting, electric_equip, gas_equip, hot_water, infiltration, ventilation, setpoint; plug-in component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

# ---- group: Room Program
deconstrprogram_2 = HBDeconstructProgramType(program=item_5)  # -> people, lighting, electric_equip, gas_equip, hot_water, infiltration, ventilation, setpoint; plug-in component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
programtype = HBProgramType(
    name="custom_office_prog_perimeterRms",
    people=deconstrprogram_2.people,
    lighting=deconstrprogram_2.lighting,
    electric_equip=deconstrprogram_2.electric_equip,
    infiltration=deconstrprogram_2.infiltration,
    ventilation=deconstrprogram_2.ventilation,
    setpoint=deconstrprogram_2.setpoint)  # -> program; plug-in component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
programtype_2 = HBProgramType(
    name="custom_office_prog_core",
    people=deconstrprogram_2.people,
    lighting=deconstrprogram_2.lighting,
    electric_equip=deconstrprogram_2.electric_equip,
    ventilation=deconstrprogram_2.ventilation,
    setpoint=deconstrprogram_2.setpoint)  # -> program; plug-in component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

# ---- group: Ideal HVAC
idealair = HBIdealAir(rooms=flatten(roomsolid.rooms), economizer="NoEconomizer", sensible_hr="0", heat_limit="NoLimit", cool_limit="NoLimit")  # -> report, rooms; plug-in component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

# ----
versions = HBCheckVersions()  # -> lbt_gh, python, radiance, openstudio, energyplus; plug-in component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
toggle = BooleanToggle(False)  # disabled
toggle_2 = BooleanToggle(False)  # disabled
panel_18 = Panel("1.6.0")  # disabled
syncghfile = LBSyncGrasshopperFile(sync=toggle)  # -> report; disabled; plug-in component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
versioner = LBVersioner(update=toggle_2, version=panel_18)  # -> Vviiiiiz; disabled; plug-in component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
panel_19 = Panel(versions.openstudio)
panel_20 = Panel(versions.lbt_gh)
programtype_3 = HBProgramType(
    name="custom_plenum_prog_Rms",
    people=deconstrprogram.people,
    lighting=deconstrprogram.lighting,
    electric_equip=deconstrprogram.electric_equip,
    gas_equip=deconstrprogram.gas_equip,
    hot_water=deconstrprogram.hot_water,
    infiltration=deconstrprogram.infiltration,
    ventilation=deconstrprogram.ventilation,
    setpoint=deconstrprogram.setpoint)  # -> program; plug-in component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
panel_21 = Panel(syncghfile)  # disabled
panel_22 = Panel("""0
0
0
0
0
0
0
0
0
0
0
0
0
0
0
0
0
0
0
0
0
0
0
0""")
panel_23 = Panel("""0
0
0
0
0
1
1
1
1
1
1
1
1
1
1
1
1
1
1
1
1
0
0
0""")
panel_24 = Panel("""0
0
0
0
0
1
1
1
1
1
1
1
1
1
1
1
1
1
0
0
0
0
0
0""")
panel_25 = Panel("""0
0
0
0
0
0
0
0
0
0
0
0
0
0
0
0
0
0
0
0
0
0
0
0""")
panel_26 = Panel("""0
0
0
0
0
1
1
1
1
1
1
1
1
1
1
1
1
1
1
1
1
0
0
0""")
panel_27 = Panel("""0
0
0
0
0
1
1
1
1
1
1
1
1
1
1
1
1
1
0
0
0
0
0
0""")

# ---- group: Internal Mass Definition
srf_area_per_flr_space_area = Panel("2")
flatten = FlattenTree(Tree=roomsbyattr_2.values, Path="{0}")
multiplication = Multiplication(A=flatten, B=srf_area_per_flr_space_area)
internalmass = HBInternalMass(rooms=roomsolid_2.rooms, geo_or_area=multiplication, construction=opaqueconstr_11, name="Internal Mass Definition 1")  # -> report, rooms; plug-in component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

# ---- group: Plenum Rooms
toggle_3 = BooleanToggle(False)
plenum = HBPlenum(rooms=internalmass.rooms, conditioned=Toggle(False), remove_infilt=toggle_3, include_floor=toggle_3)  # -> rooms; plug-in component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
graft_2 = GraftTree(Tree=plenum, IncludeEmptyLists=True, IncludeNullItems=True)  # -> simplify(Tree)

# ---- group: Perimeter Rooms
cull_i = CullIndex(List=idealair.rooms, Indices="4", Wrap=True)
applyprogram = HBApplyProgramType(rooms=cull_i, program=programtype)  # -> report, simplify(rooms); plug-in component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

# ---- group: Cores
item_7 = ListItem(List=idealair.rooms, Index="4", Wrap=True)
applyprogram_2 = HBApplyProgramType(rooms=item_7, program=programtype_2)  # -> report, rooms; plug-in component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

# ----
weeklyschedule = HBWeeklySchedule(
    sun=panel_25,
    mon=panel_26,
    tue=panel_26,
    wed=panel_26,
    thu=panel_26,
    fri=panel_26,
    sat=panel_27,
    holiday=panel_25,
    summer_des=panel_26,
    winter_des=panel_27,
    name="HVACOperatiion Schd",
    type_limit="On-Off")  # -> report, schedule, idf_year, idf_week, idf_days; plug-in component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
weeklyschedule_2 = HBWeeklySchedule(
    sun=panel_22,
    mon=panel_23,
    tue=panel_23,
    wed=panel_23,
    thu=panel_23,
    fri=panel_23,
    sat=panel_24,
    holiday=panel_22,
    summer_des=panel_23,
    winter_des=panel_24,
    name="Hours_of _operation",
    type_limit="Fractional")  # -> report, schedule, idf_year, idf_week, idf_days; plug-in component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
searchschs = HBSearchSchedules(keywords="Medium Office")  # -> schedules, type_limits; plug-in component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
ins_3 = InsertItems(List=applyprogram.rooms, Item=applyprogram_2.rooms, Indices="4", Wrap=True)
panel_28 = Panel(searchschs.schedules)
applyprogram_3 = HBApplyProgramType(rooms=flatten(graft_2), program=programtype_3)  # -> report, rooms; plug-in component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

# ---- group: Rooms Per Level
solveadj = HBSolveAdjacency(rooms=ins_3, adiabatic=Toggle(False), run=Toggle(True))  # -> report, simplify(adj_rooms); plug-in component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

# ---- group: Internal Mass Definition
flatten_2 = FlattenTree(Tree=roomsbyattr.values, Path="{0}")
srf_area_per_flr_space_area_2 = Panel("2")
path_mapper = PathMapper(flatten_2, source="{A}(i)", target="{i\5}")
multiplication_2 = Multiplication(A=path_mapper, B=srf_area_per_flr_space_area_2)
internalmass_2 = HBInternalMass(
    rooms=solveadj.adj_rooms,
    geo_or_area=flatten(multiplication_2),
    construction=opaqueconstr_11,
    name="Internal Mass Definition 1")  # -> report, simplify(rooms); plug-in component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

# ----
panel_29 = Panel("""0.05
0.05
0.05
0.05
0.1
0.08623256
0.25869768
0.25869768
0.25869768
0.25869768
0.25869768
0.25869768
0.25869768
0.25869768
0.25869768
0.25869768
0.4311628
0.25869768
0.25869768
0.17246512
0.17246512
0.08623256
0.04311628
0.04311628""")
panel_30 = Panel("""0.05
0.05
0.05
0.05
0.05
0.08623256
0.08623256
0.25869768
0.25869768
0.25869768
0.25869768
0.12934884
0.12934884
0.12934884
0.12934884
0.12934884
0.04311628
0.04311628
0.05
0.05
0.05
0.05
0.05
0.05""")
panel_31 = Panel("""0.230755381
0.230755381
0.230755381
0.230755381
0.230755381
0.381234796
0.381234796
0.857778291
0.476543495
0.476543495
0.476543495
0.333580447
0.333580447
0.333580447
0.333580447
0.333580447
0.285926097
0.285926097
0.230755381
0.230755381
0.230755381
0.230755381
0.230755381
0.230755381""")
panel_32 = Panel("""0
0
0
0
0
0.05
0.05
0.05
0.05
0.05
0.05
0.05
0.05
0.05
0.05
0.05
0.05
0
0
0
0
0
0
0""")
panel_33 = Panel("""0
0
0
0
0
1
1
1
1
1
1
1
1
1
1
1
1
1
1
1
1
0.05
0.05
0.05""")
panel_34 = Panel("""0.05
0.05
0.05
0.05
0.05
0.04311628
0.04311628
0.04311628
0.04311628
0.04311628
0.04311628
0.04311628
0.04311628
0.04311628
0.04311628
0.04311628
0.04311628
0.05
0.05
0.05
0.05
0.05
0.05
0.05""")
panel_35 = Panel("""1
1
1
1
1
1
1
1
1
1
1
1
1
1
1
1
1
1
1
1
1
1
1
1""")
panel_36 = Panel("""0
0
0
0
0
0
0
0
0
0
0
0
0
0
0
0
0
0
0
0
0
0
0
0""")
panel_37 = Panel("""0.230755381
0.230755381
0.230755381
0.230755381
0.230755381
0.285926097
0.285926097
0.285926097
0.285926097
0.285926097
0.285926097
0.285926097
0.285926097
0.285926097
0.285926097
0.285926097
0.285926097
0.230755381
0.230755381
0.230755381
0.230755381
0.230755381
0.230755381
0.230755381""")
panel_38 = Panel("""0.307673841
0.307673841
0.307673841
0.307673841
0.307673841
0.381234796
0.381234796
0.857778291
0.857778291
0.857778291
0.857778291
0.476543495
0.476543495
0.476543495
0.476543495
0.476543495
0.476543495
0.381234796
0.381234796
0.381234796
0.381234796
0.381234796
0.381234796
0.381234796""")
panel_39 = Panel("""1
1
1
1
1
1
1
1
1
1
1
1
1
1
1
1
1
1
1
1
1
1
1
1""")
panel_40 = Panel("""0
0
0
0
0
0
0
0
0
0
0
0
0
0
0
0
0
0
0
0
0
0
0
0""")
panel_41 = Panel("""0
0
0
0
0
0.1
0.2
0.95
0.95
0.95
0.95
0.3
0.95
0.95
0.95
0.95
0.3
0.1
0.1
0.1
0.1
0.05
0.05
0.05""")
panel_42 = Panel("""0
0
0
0
0
0.1
0.1
0.3
0.3
0.3
0.3
0.1
0.1
0.1
0.1
0.1
0.05
0.05
0
0
0
0
0
0""")
panel_43 = Panel("""0
0
0
0
0
0
0
0
0
0
0
0
0
0
0
0
0
0
0
0
0
0
0
0""")
merge_13 = Merge(Data1=applyprogram_3.rooms, Data2=internalmass_2.rooms)

# ---- group: Window and Door Construction
windows = Geometry([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])
doors = Geometry([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])
aperture = HBAperture(geo=windows, name="Windows", operable=Toggle(True), ep_constr=decnstrconstrset.window)  # -> report, apertures; plug-in component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
door = HBDoor(geo=doors, name="Doors", ep_constr=decnstrconstrset.exterior_door)  # -> report, doors; plug-in component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

# ---- group: Plenum to Room per Level
solveadj_2 = HBSolveAdjacency(rooms=merge_13, adiabatic=Toggle(False), run=Toggle(True))  # -> report, simplify(adj_rooms); plug-in component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

# ----
weeklyschedule_3 = HBWeeklySchedule(
    sun=panel_37,
    mon=panel_38,
    tue=panel_38,
    wed=panel_38,
    thu=panel_38,
    fri=panel_38,
    sat=panel_31,
    holiday=panel_37,
    summer_des=panel_39,
    winter_des=panel_40,
    name="BLDG_EQUIP_SCH",
    type_limit="Fractional")  # -> report, schedule, idf_year, idf_week, idf_days; plug-in component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
weeklyschedule_4 = HBWeeklySchedule(
    sun=panel_32,
    mon=panel_41,
    tue=panel_41,
    wed=panel_41,
    thu=panel_41,
    fri=panel_41,
    sat=panel_42,
    holiday=panel_32,
    summer_des=panel_33,
    winter_des=panel_43,
    name="BLDG_OCC_SCH",
    type_limit="Fractional")  # -> report, schedule, idf_year, idf_week, idf_days; plug-in component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
weeklyschedule_5 = HBWeeklySchedule(
    sun=panel_34,
    mon=panel_29,
    tue=panel_29,
    wed=panel_29,
    thu=panel_29,
    fri=panel_29,
    sat=panel_30,
    holiday=panel_34,
    summer_des=panel_35,
    winter_des=panel_36,
    name="BLDG_LIGHT_SCH",
    type_limit="Fractional")  # -> report, schedule, idf_year, idf_week, idf_days; plug-in component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
panel_44 = Panel("""0
0
0
0
0
0
0.16
0.14
0.21
0.18
0.25
0.21
0.13
0.08
0.04
0.05
0.06
0
0
0
0
0
0
0""")
panel_45 = Panel("""0
0
0
0
0
0
0
0
0
0
0
0
0
0
0
0
0
0
0
0
0
0
0
0""")
panel_46 = Panel("""0
0
0
0
0
0
0.16
0.14
0.21
0.18
0.25
0.21
0.13
0.08
0.04
0.05
0.06
0
0
0
0
0
0
0""")
panel_47 = Panel("""0
0
0
0
0
0
0
0
0
0
0
0
0
0
0
0
0
0
0
0
0
0
0
0""")
panel_48 = Panel("""1
1
1
1
1
0.25
0.25
0.25
0.25
0.25
0.25
0.25
0.25
0.25
0.25
0.25
0.25
0.25
0.25
0.25
0.25
1
1
1""")
panel_49 = Panel("""0
0
0
0
0
0.144
1
0.144
0.144
0.144
0.144
1
0.144
0.144
0.144
0.144
1
0.144
0
0
0
0
0
0""")
panel_50 = Panel("""0
0
0
0
0
0
0
0
0
0
0
0
0
0
0
0
0
0
0
0
0
0
0
0""")
panel_51 = Panel("""0
0
0
0
0
0
0.35
0.69
0.43
0.37
0.43
0.58
0.48
0.37
0.37
0.46
0.62
0.12
0.04
0.04
0
0
0
0""")
panel_52 = Panel("""0.69
0.69
0.69
0.69
0.69
0.69
0.69
0.69
0.69
0.69
0.69
0.69
0.69
0.69
0.69
0.69
0.69
0.69
0.69
0.69
0.69
0.69
0.69
0.69""")
panel_53 = Panel("""0
0
0
0
0
0
0.35
0.69
0.43
0.37
0.43
0.58
0.48
0.37
0.37
0.46
0.62
0.12
0.04
0.04
0
0
0
0""")
panel_54 = Panel("""0.69
0.69
0.69
0.69
0.69
0.69
0.69
0.69
0.69
0.69
0.69
0.69
0.69
0.69
0.69
0.69
0.69
0.69
0.69
0.69
0.69
0.69
0.69
0.69""")
panel_55 = Panel("""1
1
1
1
1
1
1
1
1
1
1
1
1
1
1
1
1
1
1
1
1
1
1
1""")
weeklyschedule_6 = HBWeeklySchedule(
    sun=panel_49,
    mon=panel_50,
    tue=panel_50,
    wed=panel_50,
    thu=panel_50,
    fri=panel_50,
    sat=panel_49,
    holiday=panel_49,
    summer_des=panel_50,
    winter_des=panel_49,
    name="INFIL_Door_Opening_SCH",
    type_limit="Fractional")  # -> report, schedule, idf_year, idf_week, idf_days; plug-in component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
weeklyschedule_7 = HBWeeklySchedule(
    sun=panel_45,
    mon=panel_51,
    tue=panel_51,
    wed=panel_51,
    thu=panel_51,
    fri=panel_51,
    sat=panel_44,
    holiday=panel_45,
    summer_des=panel_52,
    winter_des=panel_45,
    name="BLDG_ELEVATORS",
    type_limit="Fractional")  # -> report, schedule, idf_year, idf_week, idf_days; plug-in component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
weeklyschedule_8 = HBWeeklySchedule(
    sun=panel_47,
    mon=panel_53,
    tue=panel_53,
    wed=panel_53,
    thu=panel_53,
    fri=panel_53,
    sat=panel_46,
    holiday=panel_47,
    summer_des=panel_54,
    winter_des=panel_47,
    name="ELEV_LIGHT_FAN_SCH_ADD_DF",
    type_limit="Fractional")  # -> report, schedule, idf_year, idf_week, idf_days; plug-in component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
weeklyschedule_9 = HBWeeklySchedule(
    sun=panel_55,
    mon=panel_48,
    tue=panel_48,
    wed=panel_48,
    thu=panel_48,
    fri=panel_48,
    sat=panel_55,
    holiday=panel_55,
    summer_des=panel_48,
    winter_des=panel_55,
    name="INFIL_SCH_PNNL",
    type_limit="Fractional")  # -> report, schedule, idf_year, idf_week, idf_days; plug-in component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
addsubface = HBAddSubface(hb_obj=flatten(solveadj_2.adj_rooms), sub_faces=flatten([aperture.apertures, door.doors]))  # -> hb_obj; plug-in component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

# ---- group: Nat. Vent.
panel_56 = Panel("29")  # disabled
panel_57 = Panel("20")  # disabled
panel_58 = Panel("21")  # disabled
panel_59 = Panel("28.5")  # disabled
applysetpointvals = HBApplySetpointValues(room_or_program=flatten(addsubface), cooling_setpt=panel_56, heating_setpt=panel_57)  # -> report, mod_obj; disabled; plug-in component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
ventcontrol = HBVentilationControl(min_in_temp=panel_58, max_in_temp=panel_59)  # -> vent_cntrl; disabled; plug-in component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
toggle_4 = BooleanToggle(False)  # disabled
windowopen = HBWindowOpening(rooms=flatten(applysetpointvals.mod_obj), vent_cntrl=ventcontrol, wind_cross_vent=toggle_4)  # -> report, rooms; disabled; plug-in component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

# ----
panel_60 = Panel("20")  # disabled
panel_61 = Panel("27")  # disabled
panel_62 = Panel("""0
0
0
0
0
0.04
0.04
0.04
0.04
0.04
0.06
0.06
0.09
0.06
0.04
0.04
0.04
0
0
0
0
0
0
0""")
panel_63 = Panel("""0
0
0
0
0
0.07
0.19
0.35
0.38
0.39
0.47
0.57
0.54
0.34
0.33
0.44
0.26
0.21
0.15
0.17
0.08
0.05
0.05
0.05""")
panel_64 = Panel("""0
0
0
0
0
0.07
0.11
0.15
0.21
0.19
0.23
0.2
0.19
0.15
0.13
0.14
0.14
0.07
0
0
0
0
0
0""")
versions_2 = HBCheckVersions()  # -> lbt_gh, python, radiance, openstudio, energyplus; plug-in component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
panel_65 = Panel(addsubface)
panel_66 = Panel(versions_2.lbt_gh)
panel_67 = Panel(versions_2.openstudio)
weeklyschedule_10 = HBWeeklySchedule(
    sun=panel_62,
    mon=panel_63,
    tue=panel_63,
    wed=panel_63,
    thu=panel_63,
    fri=panel_63,
    sat=panel_64,
    holiday=panel_62,
    summer_des=panel_63,
    winter_des=panel_64,
    name="BLDG_SWH_SCH",
    type_limit="Fractional")  # -> report, schedule, idf_year, idf_week, idf_days; plug-in component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
roomenergyattr = HBRoomEnergyAttributes({"Program": "properties.energy.program_type.display_name", "Construction Set": "properties.energy.construction_set.display_name", "Is Conditioned": "properties.energy.is_conditioned", "People per Area [ppl/m2]": "properties.energy.people.people_per_area", "Area per Person [m2/ppl]": "properties.energy.people.area_per_person", "Lighting per Area [W/m2]": "properties.energy.lighting.watts_per_area"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}, selected="Program")
roomattr_2 = HBRoomAttributes({"Display Name": "display_name", "Simulation Name (Identifier)": "identifier", "Multiplier": "multiplier", "Floor Area Excluded": "exclude_floor_area", "Story": "story", "Volume": "volume", "Gross Floor Area": "floor_area", "Exposed Area": "exposed_area", "Exterior Wall Area": "exterior_wall_area", "Exterior Aperture Area": "exterior_aperture_area", "Average Floor Elevation": "average_floor_height"}, selected="Simulation Name (Identifier)")
vizbytype = HBVisualizeByType(hb_objs=addsubface)  # -> walls, interior_walls, roofs, ceilings, exterior_floors, interior_floors, air_walls, apertures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; plug-in component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
vizbybc = HBVisualizeByBC(hb_objs=addsubface)  # -> outdoors, surface, ground, adiabatic, other, wire_frame; plug-in component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
model = HBModel(rooms=flatten(addsubface), name="20231127_MidOffice_Baseline_Measure")  # -> report, model; plug-in component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
geo = Geometry(vizbybc.ground)
geo_2 = Geometry(vizbybc.wire_frame)
geo_3 = Geometry(vizbybc.outdoors)
geo_4 = Geometry(vizbytype.interior_walls)
geo_5 = Geometry(vizbytype.ceilings)
geo_6 = Geometry(vizbytype.interior_floors)
geo_7 = Geometry(vizbytype.apertures)
geo_8 = Geometry(vizbytype.doors)
geo_9 = Geometry(vizbytype.wire_frame)
afn = HBAirflowNewtwork(model=model.model)  # -> report, model; disabled; plug-in component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
toggle_5 = BooleanToggle(True)
deconstructmodel = HBDeconstructModel(model=model.model)  # -> rooms, faces, apertures, doors, shades; plug-in component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
labelrooms = HBLabelRooms(rooms_model=flatten(deconstructmodel.rooms), attribute=roomenergyattr)  # -> label_text, base_pts, labels, wire_frame; plug-in component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
panel_68 = Panel(labelrooms.label_text)
simcontrol = HBSimulationControl(
    do_zone_sizing=toggle_5,
    do_system_sizing=toggle_5,
    do_plant_sizing=toggle_5,
    for_sizing_period=Toggle(False),
    for_run_period=toggle_5)  # -> sim_control; plug-in component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
shadowcalc = HBShadowCalculation(solar_dist="FullInteriorAndExterior", frequency="30", max_figures="15000")  # -> shadow_calc; plug-in component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
toggle_6 = BooleanToggle(True)
panel_69 = Panel("1")  # disabled
ddy_1a_sv = FilePath("C:\Users\admin\masterwin\thermal\epw\USA_HI_Honolulu.Intl.AP.911820_TMY3\USA_HI_Honolulu.Intl.AP.911820_TMY3.ddy")
simoutput = HBSimulationOutput(
    zone_energy_use=toggle_6,
    hvac_energy_use=toggle_6,
    gains_and_losses=toggle_6,
    comfort_metrics=toggle_6,
    surface_temperature=toggle_6,
    surface_energy_flow=toggle_6)  # -> report, sim_output; plug-in component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
customoutput = HBCustomSimulationOutput(base_sim_output=simoutput.sim_output, output_names="AFN Surface Venting Window or Door Opening Factor")  # -> report, sim_output; plug-in component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
analysisperiod = LBAnalysisPeriod(start_month=panel_69, start_day=1, start_hour=0, end_month=panel_69)  # -> period, hoys, dates; plug-in component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
panel_70 = Panel("C:\Users\admin\masterwin\thermal\mea\CreateTypicalDOEBuildingFromModel")
panel_71 = Panel(ddy_1a_sv)
panel_72 = Panel("C:\CreateTypicalDOEBuildingFromModel")
sizingpar = HBSizingParameter(ddy_file=ddy_1a_sv, heating_fac="1", cooling_fac="1")  # -> sizing; plug-in component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
path = FilePath(panel_70)
simpar = HBSimulationParameter(
    output=customoutput.sim_output,
    run_period=analysisperiod.period,
    timestep=6,
    sim_control=simcontrol,
    shadow_calc=shadowcalc,
    sizing=sizingpar)  # -> sim_par; plug-in component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
panel_73 = Panel(path)
toggle_7 = BooleanToggle(True)
toggle_8 = BooleanToggle(True)
toggle_9 = BooleanToggle(False)
epw_1a_sv = FilePath("C:\Users\admin\masterwin\thermal\epw\USA_HI_Honolulu.Intl.AP.911820_TMY3\USA_HI_Honolulu.Intl.AP.911820_TMY3.epw")
modeltoosm = HBModelToOSM(model=model.model, epw_file=epw_1a_sv, sim_par=simpar, write=Toggle(False), run="2")  # -> report, jsons, osw, osm, idf, sql, zsz, rdd, html; plug-in component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
create_typical_doe_building_from_model = CreateTypicalDOEBuildingFromModel(
    measure_path=panel_73,
    template="90.1-2016",
    system_type="Inferred",
    swh_src="Inferred",
    add_constructions=toggle_9,
    add_space_type_loads=toggle_9,
    add_elevators=toggle_7,
    add_internal_mass=toggle_9,
    add_exterior_lights=toggle_8,
    add_exhaust=toggle_7,
    add_swh=toggle_8,
    add_thermostat=Toggle(True),
    add_hvac=toggle_9,
    add_refrigeration=toggle_9,
    remove_objects=toggle_8)  # -> report, measure; plug-in component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
panel_74 = Panel(epw_1a_sv)
panel_75 = Panel(modeltoosm.osm)
opendir = LBOpenDirectory(file_path=panel_75)  # -> report; disabled; plug-in component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
swaposm = SwapOSM(
    osm=panel_75,
    epw=epw_1a_sv,
    mea=create_typical_doe_building_from_model.measure,
    run_swap=Toggle(False),
    run_sim=Toggle(False),
    update=Toggle(False))  # -> out, osm, osm_swap, idf, sql, zsz, rdd, html, err; inputs mea: list
# ---------- swaposm: Python ----------
"""Run swap.py from subprocess on LBT python."""
from __future__ import print_function
import sys
import os
import json
from pprint import pprint
from subprocess import Popen, PIPE, STDOUT
from honeybee.config import folders as hb_config
from honeybee_energy.config import folders as hbe_config
from honeybee_energy.measure import Measure
from ladybug_rhino.download import download_file


# Global
path = os.path
SWAP_URL = "https://raw.githubusercontent.com/saeranv/thermal/main/lbt/swap.py"
SWAP_NAME = "swap.py"
IS_TTY = sys.stdin.isatty() or len(sys.argv) > 1


def run_subproc(cmds):
    """Run subprocess for list of commands (cmds)."""

    print("Running command:\n{}\n".format(" ".join(cmds)))
    p = Popen(cmds, shell=True, stdout=PIPE, stderr=PIPE)
    _stdout, _stderr = p.communicate()

    assert p.returncode == 0, \
        "stdout:\n{}\nstderr:\n{}".format(_stdout, _stderr)
    return _stdout, _stderr


def update_swap(_swap_fpath):
    """Update swap.py from github and confirm in lbt scripts path."""

    _ = download_file(SWAP_URL, _swap_fpath)
    print("## Downloaded {} from {}.".format(SWAP_NAME, SWAP_URL))

    assert path.exists(_swap_fpath), \
        "Path {} not exist.\n".format(_swap_fpath)


def update_pip(_lbt_pytexe, _ops_version):
    """Update openstudio SDK via pip."""

    # Check if pip opesntudio is updated
    cmds = [_lbt_pytexe, "-m", "pip", "list"]
    _stdout = run_subproc(cmds)[0]
    pkgs = _stdout.decode("utf-8").strip().split("\n")
    is_pip_match = False
    for pkg in pkgs:
        if "openstudio" in pkg:
            _ops_version_ = pkg.split("openstudio")[1].strip()
            print("## Found openstudio {} in pip.".format(_ops_version_))
            is_pip_match = _ops_version_ == _ops_version
            break

    if not is_pip_match:
        # Pip install openstudio if not in pip or version wrong
        _ops_pkg = "openstudio=={}".format(_ops_version)
        cmds = [_lbt_pytexe, "-m", "pip", "install", _ops_pkg]

        _stdout, _stderr = run_subproc(cmds)
        if _stdout: print(_stdout.decode("utf-8").strip())
        if _stderr: print(_stderr.decode("utf-8").strip())


def dump_mea(measure, osm_fpath):
    """Dump measure to osw file."""

    osw_fpath = path.join(path.dirname(osm_fpath), "workflow.osw")
    osw_dict = measure.to_osw_dict()
    osw_dict["measure_paths"] = [measure.folder]
    with open(osw_fpath, "w") as fp:
        json.dump(osw_dict, fp, indent=4)
    return osw_fpath

if IS_TTY:
    # Label bool, fpath inputs
    run_swap_, run_sim_, update_ = True, True, True
    _osm, _epw, _mea_dpath = sys.argv[-3:]
    mea = Measure(_mea_dpath)

if run_swap_ or run_sim_ or update_:

    # # Overwrite
    # update_ = False
    # run_swap_ = False
    # run_sim_ = False
    _osw_swap, _osm_swap = None, None
    swap_fpath = path.join(hb_config.python_scripts_path, SWAP_NAME)
    lbt_pytexe = hb_config.python_exe_path
    lbt_opsexe = hbe_config.openstudio_exe
    opsv_ = hbe_config.openstudio_version
    ops_version = "{}.{}.{}".format(opsv_[0], opsv_[1], opsv_[2])
    runsim_dpath = path.join(path.dirname(_osm), "run") # sim dpath is child
    # # TODO: only for debugging
    # swap_fpath = path.abspath(path.join(_epw, "../../../lbt", SWAP_NAME))

    # Update/confirm swap_fpath exists
    if update_ or (not path.exists(swap_fpath)):
        _ = update_swap(swap_fpath)
        _ = update_pip(lbt_pytexe, ops_version)

    if run_swap_:
        # Run swap
        print("\n## Running swap.py on lbtpyt.exe")

        # Update measure, and run swap_win.py
        _osw = dump_mea(_mea[0], _osm)
        swap_cmds = [lbt_pytexe, swap_fpath, _osw, _osm, _epw]
        stdout, stderr = run_subproc(swap_cmds)
        _osm_swap, _osw_swap = \
            stdout.decode('utf-8').strip().split("\n")[-2:]
        if stdout: print(stdout.decode('utf-8'))
        if stderr: print(stderr.decode('utf-8'))

    if run_sim_:
        # Run workflow.osw
        print("\n## Running workflow.osw on openstudio.exe")

        if not _osw_swap:
            _osw_swap = path.join(runsim_dpath, "workflow_swap.osw")

        assert path.exists(_osw_swap), \
            "OSW not found at {}".format(_osw_swap)

        sim_cmds = [lbt_opsexe, "run", "-w", _osw_swap]
        stdout, stderr = run_subproc(sim_cmds)
        if stdout: print(stdout)
        if stderr: print(stderr)

        # Get outputs
        # print(runsim_dpath, ":\n", os.listdir(runsim_dpath))
        _sql = path.join(runsim_dpath, "eplusout.sql")
        _err = path.join(runsim_dpath, "eplusout.err")
        if path.exists(_sql):
            osm = path.join(runsim_dpath, "in.osm")
            idf = path.join(runsim_dpath, "in.idf")
            zsz = path.join(runsim_dpath, "epluszsz.csv")
            rdd = path.join(runsim_dpath, "eplus.rdd")
            html = path.join(runsim_dpath, "eplustbl.htm")
            sql = _sql
            print(osm, idf, zsz, rdd, html, err, sql, sep="\n")
        if path.exists(_err):
            err = _err
# ---------- end swaposm ----------
roomenergyresult = HBReadRoomEnergyResult(sql=swaposm.sql)  # -> cooling, heating, lighting, electric_equip, gas_equip, process, hot_water, fan_electric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; disabled; plug-in component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
panel_76 = Panel(swaposm.osm_swap)
panel_77 = Panel(swaposm.osm)
panel_78 = Panel(swaposm.out)
monthlychart = LBMonthlyChart()  # -> report, data_mesh, data_lines, col_lines, legend, borders, labels, y_title, title, vis_set; plug-in component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
monthlychart_2 = LBMonthlyChart()  # -> report, data_mesh, data_lines, col_lines, legend, borders, labels, y_title, title, vis_set; plug-in component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
monthlychart_3 = LBMonthlyChart()  # -> report, data_mesh, data_lines, col_lines, legend, borders, labels, y_title, title, vis_set; plug-in component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
monthlychart_4 = LBMonthlyChart()  # -> report, data_mesh, data_lines, col_lines, legend, borders, labels, y_title, title, vis_set; plug-in component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
monthlychart_5 = LBMonthlyChart()  # -> report, data_mesh, data_lines, col_lines, legend, borders, labels, y_title, title, vis_set; plug-in component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
monthlychart_6 = LBMonthlyChart()  # -> report, data_mesh, data_lines, col_lines, legend, borders, labels, y_title, title, vis_set; plug-in component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
monthlychart_7 = LBMonthlyChart()  # -> report, data_mesh, data_lines, col_lines, legend, borders, labels, y_title, title, vis_set; plug-in component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
monthlychart_8 = LBMonthlyChart()  # -> report, data_mesh, data_lines, col_lines, legend, borders, labels, y_title, title, vis_set; plug-in component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
monthlychart_9 = LBMonthlyChart()  # -> report, data_mesh, data_lines, col_lines, legend, borders, labels, y_title, title, vis_set; plug-in component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
monthlychart_10 = LBMonthlyChart()  # -> report, data_mesh, data_lines, col_lines, legend, borders, labels, y_title, title, vis_set; plug-in component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
monthlychart_11 = LBMonthlyChart()  # -> report, data_mesh, data_lines, col_lines, legend, borders, labels, y_title, title, vis_set; plug-in component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
monthlychart_12 = LBMonthlyChart()  # -> report, data_mesh, data_lines, col_lines, legend, borders, labels, y_title, title, vis_set; plug-in component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
monthlychart_13 = LBMonthlyChart()  # -> report, data_mesh, data_lines, col_lines, legend, borders, labels, y_title, title, vis_set; plug-in component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
monthlychart_14 = LBMonthlyChart()  # -> report, data_mesh, data_lines, col_lines, legend, borders, labels, y_title, title, vis_set; plug-in component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
monthlychart_15 = LBMonthlyChart()  # -> report, data_mesh, data_lines, col_lines, legend, borders, labels, y_title, title, vis_set; plug-in component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
monthlychart_16 = LBMonthlyChart()  # -> report, data_mesh, data_lines, col_lines, legend, borders, labels, y_title, title, vis_set; plug-in component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
monthlychart_17 = LBMonthlyChart()  # -> report, data_mesh, data_lines, col_lines, legend, borders, labels, y_title, title, vis_set; plug-in component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
monthlychart_18 = LBMonthlyChart()  # -> report, data_mesh, data_lines, col_lines, legend, borders, labels, y_title, title, vis_set; plug-in component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
monthlychart_19 = LBMonthlyChart()  # -> report, data_mesh, data_lines, col_lines, legend, borders, labels, y_title, title, vis_set; plug-in component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
monthlychart_20 = LBMonthlyChart()  # -> report, data_mesh, data_lines, col_lines, legend, borders, labels, y_title, title, vis_set; plug-in component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
monthlychart_21 = LBMonthlyChart()  # -> report, data_mesh, data_lines, col_lines, legend, borders, labels, y_title, title, vis_set; plug-in component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
monthlychart_22 = LBMonthlyChart()  # -> report, data_mesh, data_lines, col_lines, legend, borders, labels, y_title, title, vis_set; plug-in component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
monthlychart_23 = LBMonthlyChart()  # -> report, data_mesh, data_lines, col_lines, legend, borders, labels, y_title, title, vis_set; plug-in component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
monthlychart_24 = LBMonthlyChart()  # -> report, data_mesh, data_lines, col_lines, legend, borders, labels, y_title, title, vis_set; plug-in component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
panel_79 = Panel("C:\Users\admin\masterwin\thermal\sim_\DOEPrototype\openstudio\run\eplusout.sql")
eui = HBEndUseIntensity(sql=panel_79)  # -> eui, eui_end_use, end_uses, gross_floor; plug-in component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
panel_80 = Panel(eui.end_uses)
merge_14 = Merge(Data1=eui.eui, Data2=eui.eui_end_use)  # -> simplify(flatten(Result))
merge_15 = Merge(Data1="Total EUI", Data2=flatten(panel_80))  # -> simplify(Result)
clean_2 = CleanTree(RemoveNulls=True, RemoveInvalid=True, RemoveEmpty=False, Tree=merge_14)
merge_16 = Merge(Data1=graft(merge_15), Data2=graft(clean_2))
data = Data(simplify(merge_16))
# Reference DOE
panel_81 = Panel(data)

faceresult = HBReadFaceResult(sql=swaposm.sql)  # -> face_indoor_temp, face_outdoor_temp, face_energy_flow; disabled; plug-in component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
number_slider = Slider(300, range=0..300)
number_slider_2 = Slider(10, range=0..300)
colrange = LBColorRange(index="19")  # -> colors; plug-in component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
colrange_2 = LBColorRange(index="18")  # -> colors; plug-in component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
neg = Negative(Value=number_slider)
neg_2 = Negative(Value=number_slider_2)
legendpar = LBLegendParameters(min=neg, max=number_slider, colors=colrange)  # -> leg_par; plug-in component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
legendpar_2 = LBLegendParameters(min=neg_2, max=number_slider_2, colors=colrange_2)  # -> leg_par; plug-in component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
pt = Point(Point(109.8477153, 81.415335, 0))
pt_2 = Point(Point(109.8477153, 148.0667584, 0))

eui_2 = HBEndUseIntensity(sql=swaposm.sql, ip=Toggle(False))  # -> eui, eui_end_use, end_uses, gross_floor; plug-in component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
panel_82 = Panel(eui_2.eui)
panel_83 = Panel(eui_2.end_uses)
loadbalance = HBThermalLoadBalance(
    rooms_model=flatten(addsubface),
    cooling=roomenergyresult.cooling,
    heating=roomenergyresult.heating,
    lighting=roomenergyresult.lighting,
    electric_equip=roomenergyresult.electric_equip,
    gas_equip=roomenergyresult.gas_equip,
    process=roomenergyresult.process,
    hot_water=roomenergyresult.hot_water,
    people_gain=roomenergyresult.people_gain,
    solar_gain=roomenergyresult.solar_gain,
    infiltration_load=roomenergyresult.infiltration_load,
    mech_vent_load=roomenergyresult.mech_vent_load,
    nat_vent_load=roomenergyresult.nat_vent_load,
    face_energy_flow=faceresult.face_energy_flow)  # -> report, balance, balance_stor, norm_bal, norm_bal_stor; plug-in component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

merge_17 = Merge(Data1=eui_2.eui, Data2=eui_2.eui_end_use)  # -> simplify(flatten(Result))
merge_18 = Merge(Data1="Total EUI", Data2=flatten(panel_83))  # -> simplify(Result)
clean_3 = CleanTree(RemoveNulls=True, RemoveInvalid=True, RemoveEmpty=False, Tree=merge_17)
long = LongestList(ListA=flatten(clean_3), ListB="kWh/m2", PaddingMode=2)  # -> graft(ListA), graft(ListB); disabled
merge_19 = Merge(Data1=graft(merge_18), Data2=graft(clean_3), Data3=long.ListB)
join_3 = TextJoin(Text=merge_19, Join=" ")  # -> flatten(Result)
timeop = LBTimeIntervalOperation(data=loadbalance.norm_bal)  # -> daily, monthly, mon_per_hr; plug-in component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
data_2 = Data(flatten(join_3))
join_4 = TextJoin(Text=["Energy Balance", data_2])

data_3 = Data(simplify(merge_19))
monthlychart_25 = LBMonthlyChart(data=timeop.daily, base_pt=pt_2, stack=Toggle(True), global_title=join_4, legend_par=legendpar)  # -> report, data_mesh, data_lines, col_lines, legend, borders, labels, y_title, title, vis_set; plug-in component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
monthlychart_26 = LBMonthlyChart(data=timeop.monthly, base_pt=pt, stack=Toggle(True), global_title=join_4, legend_par=legendpar_2)  # -> report, data_mesh, data_lines, col_lines, legend, borders, labels, y_title, title, vis_set; plug-in component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
# Analysis DOE
panel_84 = Panel(data_3)
