# Grasshopper definition baseline_v2_CZ1A_L1.gh (Grasshopper 1.0.7)

rooms = Brep(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)
config = HBConfig()  # -> python_exe, py_lib_install, rad_install, os_install, ep_install, hb_os_gem, standards, asset_report, default_sim; plug-in component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
versions = HBCheckVersions()  # -> lbt_gh, python, radiance, openstudio, energyplus; plug-in component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
climate_zone = ValueList({"1A", "2B", "4B"}, selected="1A")
panel = Panel("C:\Users\admin\masterwin\thermal\sim_\DOEPrototype_")
path = FilePath("C:\Users\admin\masterwin\thermal\epw\USA_NM_Albuquerque.Intl.Sunport.723650_TMY3.epw")
roomsolid = HBRoomFromSolid(geo=flatten(rooms), conditioned=True)  # -> report, rooms; plug-in component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

# ---- group: Input Rooms
rooms_2 = Brep(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)

# ---- group: Input Plenum
rooms_3 = Brep(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)

# ----
windows = Geometry([<brep referenced from the Rhino model> x4])
panel_2 = Panel(path)
panel_3 = Panel(versions.lbt_gh)
panel_4 = Panel(versions.openstudio)
panel_5 = Panel([config.python_exe, config.py_lib_install])

# ---- group: Interior Walls
floor_to_ceiling_height = Panel("2.74")
perimeter_thermal_zone_depth = Panel("4.572")
debrep = DeconstructBrep(Brep=rooms_2)  # -> Faces, Edges, Vertices
item = ListItem(List=debrep.Faces, Index=0, Wrap=True)  # -> Item, Item1, Item2
skeleton = HBStraightSkeleton(floor_geo=item.Item, offset=perimeter_thermal_zone_depth)  # -> polyskel, perim_poly, core_poly; plug-in component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
lng = ListLength(List=flatten(skeleton.perim_poly))
lng_2 = ListLength(List=flatten(item.Item))
Z = UnitZ(Factor=floor_to_ceiling_height)
division = Division(A=lng, B=lng_2)
extr = Extrude(Base=skeleton.perim_poly, Direction=Z)
partition = PartitionList(List=extr, Size=division)
extr_2 = Extrude(Base=skeleton.core_poly, Direction=Z)  # -> graft(Extrusion)
partition_2 = PartitionList(List=skeleton.perim_poly, Size=division)
ins = InsertItems(List=partition, Item=extr_2, Indices=4, Wrap=True)

# ---- group: Boundary Condition
panel_6 = Panel("""1
4
7
10
13""")
panel_7 = Panel("""Rm1_Wall_
Rm2_Wall_
Rm3_Wall_
Rm4_Wall_
Rm5_Wall_""")
debrep_2 = DeconstructBrep(Brep=ins)  # -> Faces, Edges, Vertices
debrep_3 = DeconstructBrep(Brep=rooms_3)  # -> Faces, Edges, Vertices
item_2 = ListItem(List=debrep_2.Faces, Index=0, Wrap=True)
item_3 = ListItem(List=debrep_3.Faces, Index=panel_6, Wrap=True)
face = HBFace(geo=flatten(item_2), name="ExposedFloor", bc="Adiabatic")  # -> report, graft(faces); plug-in component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
face_2 = HBFace(geo=debrep_2.Faces, name=graft(panel_7))  # -> report, faces; plug-in component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
face_3 = HBFace(geo=item_3, name="ExposedCeiling_", bc="Adiabatic")  # -> report, faces; plug-in component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
face_4 = HBFace(geo=debrep_3.Faces)  # -> report, faces; plug-in component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
replace = ReplaceItems(List=face_2.faces, Item=face.faces, Indices="0", Wrap=False)
replace_2 = ReplaceItems(List=face_4.faces, Item=face_3.faces, Indices=panel_6, Wrap=False)

# ----
concat = Concatenate(FragmentA="DOEPrototype_", FragmentB=climate_zone)
merge = Merge(Data1=panel, Data2=climate_zone, Data3="\openstudio\run\in.osm")
merge_2 = Merge(Data1=panel, Data2=climate_zone, Data3="\openstudio\run\eplusout.sql")
versioner = LBVersioner(update=Toggle(False), version="1.6.0")  # -> Vviiiiiz; plug-in component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
syncghfile = LBSyncGrasshopperFile(sync=Toggle(False))  # -> report; plug-in component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
model = HBModel(rooms=flatten(roomsolid.rooms), name=concat)  # -> report, model; plug-in component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
join = TextJoin(Text=merge)
join_2 = TextJoin(Text=merge_2)
panel_8 = Panel("C:\Users\admin\masterwin\thermal\mea\CreateDOEPrototypeBuilding")
panel_9 = Panel(versioner)
eui = HBEndUseIntensity(sql=join_2)  # -> eui, eui_end_use, end_uses, gross_floor; plug-in component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
opendir = LBOpenDirectory(file_path=join_2)  # -> report; disabled; plug-in component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
loademodel = HBLoadGbXMLOSMIDF(model_file=join, load=Toggle(True))  # -> report, model; plug-in component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
concat_2 = Concatenate(FragmentA="ASHRAE 169-2013-", FragmentB=climate_zone)
create_doe_prototype_building = CreateDOEPrototypeBuilding(
    measure_path=panel_8,
    building_type="MediumOffice",
    template="90.1-2016",
    climate_zone=concat_2,
    epw_file="Not Applicable")  # -> report, measure; plug-in component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
panel_10 = Panel(eui.end_uses)
panel_11 = Panel(eui.eui)
toggle = BooleanToggle(False)
panel_12 = Panel(eui.eui_end_use)
modeltoosm = HBModelToOSM(
    model=model.model,
    epw_file=path,
    measures=create_doe_prototype_building.measure,
    folder="C:\Users\admin\masterwin\thermal\sim_",
    write=toggle,
    run=toggle)  # -> report, jsons, osw, osm, idf, sql, zsz, rdd, html; plug-in component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
roomenergyattr = HBRoomEnergyAttributes({"Program": "properties.energy.program_type.display_name", "Construction Set": "properties.energy.construction_set.display_name", "Is Conditioned": "properties.energy.is_conditioned", "People per Area [ppl/m2]": "properties.energy.people.people_per_area", "Area per Person [m2/ppl]": "properties.energy.people.area_per_person", "Lighting per Area [W/m2]": "properties.energy.lighting.watts_per_area"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}, selected="Infiltration per Exterior Area [m3/s-m2]": "properties.energy.infiltration.flow_per_exterior_area")
faceenergyattr = HBFaceEnergyAttributes({"Construction": "properties.energy.construction.display_name", "Materials": "properties.energy.construction.layers", "Thickness [m]": "properties.energy.construction.thickness", "Density [kg/m2]": "properties.energy.construction.mass_area_density", "Heat Capacity [kg/K-m2]": "properties.energy.construction.area_heat_capacity", "R-Value [m2-K/W]": "properties.energy.construction.r_value", "U-Value [W/m2-K]": "properties.energy.construction.u_value", "U-Factor [W/m2-K]": "properties.energy.construction.u_factor", "SHGC [Unshaded]": "properties.energy.construction.shgc", "Solar Transmitance [Unshaded]": "properties.energy.construction.solar_transmittance", "Visible Transmitance [Unshaded]": "properties.energy.construction.visible_transmittance", "Solar Reflectance [Outside]": "properties.energy.construction.outside_solar_reflectance", "Solar Reflectance [Inside]": "properties.energy.construction.inside_solar_reflectance", "Fraction Area Operable": "properties.energy.vent_opening.fraction_area_operable", "Fraction Height Operable": "properties.energy.vent_opening.fraction_height_operable", "Discharge Coefficient": "properties.energy.vent_opening.discharge_coefficient"}, selected="Construction")
panel_13 = Panel(modeltoosm.sql)
vizbybc = HBVisualizeByBC(hb_objs=loademodel.model)  # -> outdoors, surface, ground, adiabatic, other, wire_frame; plug-in component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
vizbytype = HBVisualizeByType(hb_objs=loademodel.model)  # -> walls, interior_walls, roofs, ceilings, exterior_floors, interior_floors, air_walls, apertures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; plug-in component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
labelrooms = HBLabelRooms(rooms_model=flatten(loademodel.model), attribute=roomenergyattr, txt_height="1")  # -> label_text, base_pts, labels, wire_frame; plug-in component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
lablefaces = HBLabelFaces(hb_objs=flatten(loademodel.model), attribute=faceenergyattr, sub_faces="1", txt_height="1")  # -> label_text, base_pts, labels, wire_frame; plug-in component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
deconstructmodel = HBDeconstructModel(model=loademodel.model)  # -> rooms, faces, apertures, doors, shades; plug-in component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
bldgvintages = HBBuildingVintages({"ASHRAE 90.1 2019  |  IECC 2021": "2019", "ASHRAE 90.1 2016  |  IECC 2018": "2016", "ASHRAE 90.1 2013  |  IECC 2015": "2013", "ASHRAE 90.1 2010  |  IECC 2012": "2010", "ASHRAE 90.1 2007  |  IECC 2009": "2007", "ASHRAE 90.1 2004  |  IECC 2006": "2004", "1980-2004 (CBECS)": "1980_2004", "Pre-1980 (CBECS)": "pre_1980"}, selected="ASHRAE 90.1 2016  |  IECC 2018")
constructiontypes = HBConstructionTypes({"SteelFramed", "WoodFramed", "Mass", "Metal Building"}, selected="SteelFramed")
geo = Geometry(vizbytype.doors)
geo_2 = Geometry(vizbybc.adiabatic)
geo_3 = Geometry(vizbytype.interior_walls)
geo_4 = Geometry(vizbytype.ceilings)
geo_5 = Geometry(vizbytype.interior_floors)
geo_6 = Geometry(vizbytype.apertures)
geo_7 = Geometry(vizbytype.wire_frame)
floorheight = HBRoomsByFloorHeight(rooms=flatten(deconstructmodel.rooms))  # -> flr_hgts, rooms; plug-in component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
panel_14 = Panel(climate_zone)
constrsetclimate = HBConstructionSetByClimate(climate_zone=panel_14, vintage=bldgvintages, constr_type=constructiontypes)  # -> constr_set; plug-in component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
searchprog = HBSearchPrograms(vintage=bldgvintages, keywords="Plenum")  # -> room_prog; plug-in component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
searchprog_2 = HBSearchPrograms(vintage=bldgvintages, keywords="MediumOffice")  # -> room_prog; plug-in component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
bang = ExplodeTree(Data=simplify(floorheight.rooms))  # -> Branch0, Branch1, Branch2, Branch3, Branch4, Branch5
panel_15 = Panel("""Room-East
Room-North
Room-West
Room-South
Room-Core""")
item_4 = ListItem(List=searchprog, Index="0", Wrap=True)
item_5 = ListItem(List=searchprog_2, Index="8", Wrap=True)
room = HBRoom(faces=replace, name=graft(panel_15), constr_set=constrsetclimate, conditioned=Toggle(True))  # -> report, room; plug-in component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
room_2 = HBRoom(faces=flatten(replace_2), name="L2Plenum", constr_set=constrsetclimate, conditioned=Toggle(False))  # -> report, room; plug-in component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
data = Data([item_5, item_4])
panel_16 = Panel(data)

# ----
# Program_type from Room
deconstrprogram = HBDeconstructProgramType(rooms=flatten(bang.Branch2))  # -> space_types; inputs rooms: list
#   port rooms: A ProgramType object or text for the identifier of a ProgramType to be looked up in the program type library.
# ---------- deconstrprogram: Python ----------
try:  # import the core honeybee dependencies
    from honeybee.model import Model
    from honeybee.colorobj import ColorRoom
except ImportError as e:
    raise ImportError('\nFailed to import honeybee:\n\t{}'.format(e))

try:  # import the ladybug_rhino dependencies
    from ladybug_rhino.grasshopper import all_required_inputs, list_to_data_tree
except ImportError as e:
    raise ImportError('\nFailed to import ladybug_rhino:\n\t{}'.format(e))


if True:
    # extract any rooms from input Models
    in_rooms = []
    for hb_obj in _rooms:
        if isinstance(hb_obj, Model):
            in_rooms.extend(hb_obj.rooms)
        else:
            in_rooms.append(hb_obj)
    
    # Get unique spc_types from rooms
    space_type_str = "properties.energy.program_type.identifier"
    color_obj = ColorRoom(in_rooms, space_type_str)
    # Since it includes infil, actually space
    unique_space_types = color_obj.attributes_unique
    
    # loop through each of the rooms and get the attributes
    people = [[] for st in unique_space_types]
    lighting = [[] for st in unique_space_types]
    electric_equip = [[] for st in unique_space_types]
    gas_equip = [[] for st in unique_space_types]
    hot_water = [[] for st in unique_space_types]
    infiltration = [[] for st in unique_space_types]
    ventilation = [[] for st in unique_space_types]
    setpoint = [[] for st in unique_space_types]
    space_types = [[] for st in unique_space_types]
    
    for atr, room in zip(color_obj.attributes, in_rooms):
        atr_i = unique_space_types.index(atr)
        prog = room.properties.energy.program_type
        people[atr_i].append(prog.people)
        lighting[atr_i].append(prog.lighting)
        electric_equip[atr_i].append(prog.electric_equipment)
        gas_equip[atr_i].append(prog.gas_equipment)
        hot_water[atr_i].append(prog.service_hot_water)
        infiltration[atr_i].append(prog.infiltration)
        ventilation[atr_i].append(prog.ventilation)
        setpoint[atr_i].append(prog.setpoint)
        space_types[atr_i].append(prog)
        
    setpt = setpoint
    print(setpt)
    
    people = list_to_data_tree(people)
    lighting = list_to_data_tree(lighting)
    electric_equip = list_to_data_tree(electric_equip)
    gas_equip = list_to_data_tree(gas_equip)
    hot_water = list_to_data_tree(hot_water)
    infiltration = list_to_data_tree(infiltration)
    ventilation = list_to_data_tree(ventilation)
    setpoint = list_to_data_tree(setpoint)
    space_types = list_to_data_tree(space_types)
# ---------- end deconstrprogram ----------
deconstrprogram_2 = HBDeconstructProgramType(rooms=flatten(bang.Branch3))  # -> space_types; inputs rooms: list; same code as deconstrprogram
applyprogram = HBApplyProgramType(rooms=flatten(room.room), program=deconstrprogram)  # -> report, rooms; plug-in component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
applyprogram_2 = HBApplyProgramType(rooms=flatten(room_2.room), program=deconstrprogram_2)  # -> report, rooms; plug-in component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

# ----
# Correction: Needs to be flattened or else
#  we get outdoor roof/ceiling for plenum interior
merge_3 = Merge(Data1=applyprogram.rooms, Data2=applyprogram_2.rooms)  # -> flatten(Result)

# ---- group: Plenum to Room per Level
toggle_2 = BooleanToggle(True)
solveadj = HBSolveAdjacency(rooms=merge_3, adiabatic=Toggle(False), overwrite=toggle_2, run=toggle_2)  # -> report, simplify(adj_rooms); plug-in component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

# ----
aperture = HBAperture(geo=windows, name="Windows", operable=Toggle(True))  # -> report, apertures; plug-in component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
addsubface = HBAddSubface(hb_obj=flatten(solveadj.adj_rooms), sub_faces=flatten(aperture.apertures))  # -> hb_obj; plug-in component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
all_air = HBAllAirHVACTemplates({"VAV chiller with gas boiler reheat": "VAV_Chiller_Boiler", "VAV chiller with central air source heat pump reheat": "VAV_Chiller_ASHP", "VAV chiller with district hot water reheat": "VAV_Chiller_DHW", "VAV chiller with PFP boxes": "VAV_Chiller_PFP", "VAV chiller with gas coil reheat": "VAV_Chiller_GasCoil", "VAV air-cooled chiller with gas boiler reheat": "VAV_ACChiller_Boiler", "VAV air-cooled chiller with central air source heat pump reheat": "VAV_ACChiller_ASHP", "VAV air-cooled chiller with district hot water reheat": "VAV_ACChiller_DHW", "VAV air-cooled chiller with PFP boxes": "VAV_ACChiller_PFP", "VAV air-cooled chiller with gas coil reheat": "VAV_ACChiller_GasCoil"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}, selected="PVAV with gas boiler reheat": "PVAV_Boiler")  # disabled
bldgvintages_2 = HBBuildingVintages({"ASHRAE 90.1 2019  |  IECC 2021": "2019", "ASHRAE 90.1 2016  |  IECC 2018": "2016", "ASHRAE 90.1 2013  |  IECC 2015": "2013", "ASHRAE 90.1 2010  |  IECC 2012": "2010", "ASHRAE 90.1 2007  |  IECC 2009": "2007", "ASHRAE 90.1 2004  |  IECC 2006": "2004", "1980-2004 (CBECS)": "1980_2004", "Pre-1980 (CBECS)": "pre_1980"}, selected="ASHRAE 90.1 2016  |  IECC 2018")  # disabled
applysetpointvals = HBApplySetpointValues(room_or_program=flatten(addsubface), cooling_setpt="29", heating_setpt="20")  # -> report, mod_obj; plug-in component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
idealair = HBIdealAir(rooms=flatten(applysetpointvals.mod_obj), economizer="NoEconomizer")  # -> report, rooms; plug-in component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
allairhvac = HBAllAirHVAC(rooms=flatten(applysetpointvals.mod_obj), system_type=all_air, vintage=bldgvintages_2)  # -> report, rooms; disabled; plug-in component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
panel_17 = Panel("20230923_DOEPrototype_GH")
model_2 = HBModel(rooms=flatten(idealair.rooms), name="20230817_DOEPrototype_GH")  # -> report, model; plug-in component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
roomenergyattr_2 = HBRoomEnergyAttributes({"Program": "properties.energy.program_type.display_name", "Construction Set": "properties.energy.construction_set.display_name", "Is Conditioned": "properties.energy.is_conditioned", "People per Area [ppl/m2]": "properties.energy.people.people_per_area", "Area per Person [m2/ppl]": "properties.energy.people.area_per_person", "Lighting per Area [W/m2]": "properties.energy.lighting.watts_per_area"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}, selected="Infiltration per Exterior Area [m3/s-m2]": "properties.energy.infiltration.flow_per_exterior_area")
faceenergyattr_2 = HBFaceEnergyAttributes({"Construction": "properties.energy.construction.display_name", "Materials": "properties.energy.construction.layers", "Thickness [m]": "properties.energy.construction.thickness", "Density [kg/m2]": "properties.energy.construction.mass_area_density", "Heat Capacity [kg/K-m2]": "properties.energy.construction.area_heat_capacity", "R-Value [m2-K/W]": "properties.energy.construction.r_value", "U-Value [W/m2-K]": "properties.energy.construction.u_value", "U-Factor [W/m2-K]": "properties.energy.construction.u_factor", "SHGC [Unshaded]": "properties.energy.construction.shgc", "Solar Transmitance [Unshaded]": "properties.energy.construction.solar_transmittance", "Visible Transmitance [Unshaded]": "properties.energy.construction.visible_transmittance", "Solar Reflectance [Outside]": "properties.energy.construction.outside_solar_reflectance", "Solar Reflectance [Inside]": "properties.energy.construction.inside_solar_reflectance", "Fraction Area Operable": "properties.energy.vent_opening.fraction_area_operable", "Fraction Height Operable": "properties.energy.vent_opening.fraction_height_operable", "Discharge Coefficient": "properties.energy.vent_opening.discharge_coefficient"}, selected="Construction")
panel_18 = Panel("3")  # disabled

panel_19 = Panel("1")  # disabled
analysisperiod = LBAnalysisPeriod(start_month=panel_19, start_day=1, start_hour=0, end_month=panel_18)  # -> period, hoys, dates; disabled; plug-in component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

vizbytype_2 = HBVisualizeByType(hb_objs=model_2.model)  # -> walls, interior_walls, roofs, ceilings, exterior_floors, interior_floors, air_walls, apertures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; plug-in component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
vizbybc_2 = HBVisualizeByBC(hb_objs=model_2.model)  # -> outdoors, surface, ground, adiabatic, other, wire_frame; plug-in component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
labelrooms_2 = HBLabelRooms(rooms_model=flatten(model_2.model), attribute=roomenergyattr_2, txt_height="1")  # -> label_text, base_pts, labels, wire_frame; plug-in component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
lablefaces_2 = HBLabelFaces(hb_objs=flatten(model_2.model), attribute=faceenergyattr_2, txt_height="1")  # -> label_text, base_pts, labels, wire_frame; plug-in component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
panel_20 = Panel("C:\Users\admin\masterwin\thermal\sim_\20230923_DOEPrototype_GH\openstudio\run\in.osm")
geo_8 = Geometry(vizbybc_2.surface)
geo_9 = Geometry([vizbytype_2.roofs, vizbytype_2.exterior_floors])
geo_10 = Geometry([vizbytype_2.interior_floors, vizbytype_2.ceilings])
geo_11 = Geometry(vizbytype_2.apertures)
geo_12 = Geometry(vizbytype_2.doors)
geo_13 = Geometry(vizbytype_2.wire_frame)
geo_14 = Geometry(vizbytype_2.interior_walls)
data_2 = Data(labelrooms_2.labels)
file = ReadFile(File="C:\Users\admin\masterwin\thermal\lbt\swap_gh.py", PerLineParse=False)
toggle_3 = BooleanToggle(True)
toggle_4 = BooleanToggle(True)
simoutput = HBSimulationOutput(
    zone_energy_use=toggle_3,
    hvac_energy_use=toggle_3,
    gains_and_losses=toggle_3,
    comfort_metrics=toggle_3,
    surface_temperature=toggle_3,
    surface_energy_flow=toggle_3)  # -> report, sim_output; plug-in component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
simcontrol = HBSimulationControl(
    do_zone_sizing=toggle_4,
    do_system_sizing=toggle_4,
    do_plant_sizing=toggle_4,
    for_sizing_period=Toggle(False),
    for_run_period=toggle_4)  # -> sim_control; plug-in component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
shadowcalc = HBShadowCalculation(solar_dist="FullInteriorAndExterior", frequency="30", max_figures="15000")  # -> shadow_calc; plug-in component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
toggle_5 = BooleanToggle(False)
toggle_6 = BooleanToggle(True)
panel_21 = Panel("C:\Users\admin\masterwin\thermal\measures\CreateTypicalDOEBuildingFromModel")
path_2 = FilePath("C:\Users\admin\masterwin\thermal\epw\USA_HI_Honolulu.Intl.AP.911820_TMY3\USA_HI_Honolulu.Intl.AP.911820_TMY3.epw")
path_3 = FilePath("C:\Users\admin\masterwin\thermal\epw\USA_HI_Honolulu.Intl.AP.911820_TMY3\USA_HI_Honolulu.Intl.AP.911820_TMY3.ddy")
panel_22 = Panel(climate_zone)
panel_23 = Panel(path_3)
sizingpar = HBSizingParameter(ddy_file=panel_23, heating_fac="1", cooling_fac="1")  # -> sizing; plug-in component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
simpar = HBSimulationParameter(
    output=simoutput.sim_output,
    run_period=analysisperiod.period,
    timestep=6,
    sim_control=simcontrol,
    shadow_calc=shadowcalc,
    sizing=sizingpar)  # -> sim_par; plug-in component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
panel_24 = Panel(path_2)
create_typical_doe_building_from_model = CreateTypicalDOEBuildingFromModel(
    measure_path=panel_21,
    template="90.1-2016",
    system_type="Inferred",
    swh_src="Inferred",
    add_constructions=toggle_5,
    add_space_type_loads=toggle_5,
    add_elevators=toggle_5,
    add_internal_mass=toggle_5,
    add_exterior_lights=toggle_6,
    onsite_parking_fraction=toggle_5,
    add_exhaust=toggle_5,
    add_swh=toggle_6,
    add_thermostat=toggle_5,
    add_hvac=toggle_5,
    add_refrigeration=toggle_5,
    remove_objects=toggle_6)  # -> report, measure; plug-in component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
panel_25 = Panel(panel_24)
eui_2 = HBEndUseIntensity(sql=join_2)  # -> eui, eui_end_use, end_uses, gross_floor; plug-in component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
modeltoosm_2 = HBModelToOSM(
    model=model_2.model,
    epw_file=panel_24,
    sim_par=simpar,
    folder="C:\Users\admin\masterwin\thermal\sim_",
    write=Toggle(False),
    run="2")  # -> report, jsons, osw, osm, idf, sql, zsz, rdd, html; plug-in component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
panel_26 = Panel(modeltoosm_2.osm)
config_2 = HBConfig()  # -> python_exe, py_lib_install, rad_install, os_install, ep_install, hb_os_gem, standards, asset_report, default_sim; plug-in component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
versions_2 = HBCheckVersions()  # -> lbt_gh, python, radiance, openstudio, energyplus; plug-in component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
panel_27 = Panel(eui_2.eui)
panel_28 = Panel(eui_2.end_uses)
swaposm = SwapOSM(
    osm=panel_26,
    epw=panel_25,
    mea=create_typical_doe_building_from_model.measure,
    run_swap=Toggle(False),
    run_sim=Toggle(False),
    update=Toggle(False))  # -> out, osm, osm_swap, idf, sql, zsz, rdd, html, err; inputs mea: list
# ---------- swaposm: Python ----------
"""Run swap.py from subprocess on LBT python."""
from __future__ import print_function
import sys
import os
import json
from pprint import pprint
from subprocess import Popen, PIPE, STDOUT
from honeybee.config import folders as hb_config
from honeybee_energy.config import folders as hbe_config
from honeybee_energy.measure import Measure
from ladybug_rhino.download import download_file


# Global
path = os.path
SWAP_URL = "https://raw.githubusercontent.com/saeranv/thermal/main/lbt/swap.py"
SWAP_NAME = "swap.py"
IS_TTY = sys.stdin.isatty() or len(sys.argv) > 1


def run_subproc(cmds):
    """Run subprocess for list of commands (cmds)."""

    print("Running command:\n{}\n".format(" ".join(cmds)))
    p = Popen(cmds, shell=True, stdout=PIPE, stderr=PIPE)
    _stdout, _stderr = p.communicate()

    assert p.returncode == 0, \
        "stdout:\n{}\nstderr:\n{}".format(_stdout, _stderr)
    return _stdout, _stderr


def update_swap(_swap_fpath):
    """Update swap.py from github and confirm in lbt scripts path."""

    _ = download_file(SWAP_URL, _swap_fpath)
    print("## Downloaded {} from {}.".format(SWAP_NAME, SWAP_URL))

    assert path.exists(_swap_fpath), \
        "Path {} not exist.\n".format(_swap_fpath)


def update_pip(_lbt_pytexe, _ops_version):
    """Update openstudio SDK via pip."""

    # Check if pip opesntudio is updated
    cmds = [_lbt_pytexe, "-m", "pip", "list"]
    _stdout = run_subproc(cmds)[0]
    pkgs = _stdout.decode("utf-8").strip().split("\n")
    is_pip_match = False
    for pkg in pkgs:
        if "openstudio" in pkg:
            _ops_version_ = pkg.split("openstudio")[1].strip()
            print("## Found openstudio {} in pip.".format(_ops_version_))
            is_pip_match = _ops_version_ == _ops_version
            break

    if not is_pip_match:
        # Pip install openstudio if not in pip or version wrong
        _ops_pkg = "openstudio=={}".format(_ops_version)
        cmds = [_lbt_pytexe, "-m", "pip", "install", _ops_pkg]

        _stdout, _stderr = run_subproc(cmds)
        if _stdout: print(_stdout.decode("utf-8").strip())
        if _stderr: print(_stderr.decode("utf-8").strip())


def dump_mea(measure, osm_fpath):
    """Dump measure to osw file."""

    osw_fpath = path.join(path.dirname(osm_fpath), "workflow.osw")
    osw_dict = measure.to_osw_dict()
    osw_dict["measure_paths"] = [measure.folder]
    with open(osw_fpath, "w") as fp:
        json.dump(osw_dict, fp, indent=4)
    return osw_fpath

if IS_TTY:
    # Label bool, fpath inputs
    run_swap_, run_sim_, update_ = True, True, True
    _osm, _epw, _mea_dpath = sys.argv[-3:]
    mea = Measure(_mea_dpath)

if run_swap_ or run_sim_ or update_:

    # # Overwrite
    # update_ = False
    # run_swap_ = False
    # run_sim_ = False
    _osw_swap, _osm_swap = None, None
    swap_fpath = path.join(hb_config.python_scripts_path, SWAP_NAME)
    lbt_pytexe = hb_config.python_exe_path
    lbt_opsexe = hbe_config.openstudio_exe
    opsv_ = hbe_config.openstudio_version
    ops_version = "{}.{}.{}".format(opsv_[0], opsv_[1], opsv_[2])
    runsim_dpath = path.join(path.dirname(_osm), "run") # sim dpath is child
    # # TODO: only for debugging
    # swap_fpath = path.abspath(path.join(_epw, "../../../lbt", SWAP_NAME))

    # Update/confirm swap_fpath exists
    if update_ or (not path.exists(swap_fpath)):
        _ = update_swap(swap_fpath)
        _ = update_pip(lbt_pytexe, ops_version)

    if run_swap_:
        # Run swap
        print("\n## Running swap.py on lbtpyt.exe")

        # Update measure, and run swap_win.py
        _osw = dump_mea(_mea[0], _osm)
        swap_cmds = [lbt_pytexe, swap_fpath, _osw, _osm, _epw]
        stdout, stderr = run_subproc(swap_cmds)
        _osm_swap, _osw_swap = \
            stdout.decode('utf-8').strip().split("\n")[-2:]
        if stdout: print(stdout.decode('utf-8'))
        if stderr: print(stderr.decode('utf-8'))

    if run_sim_:
        # Run workflow.osw
        print("\n## Running workflow.osw on openstudio.exe")

        if not _osw_swap:
            _osw_swap = path.join(runsim_dpath, "workflow_swap.osw")

        assert path.exists(_osw_swap), \
            "OSW not found at {}".format(_osw_swap)

        sim_cmds = [lbt_opsexe, "run", "-w", _osw_swap]
        stdout, stderr = run_subproc(sim_cmds)
        if stdout: print(stdout)
        if stderr: print(stderr)

        # Get outputs
        # print(runsim_dpath, ":\n", os.listdir(runsim_dpath))
        _sql = path.join(runsim_dpath, "eplusout.sql")
        _err = path.join(runsim_dpath, "eplusout.err")
        if path.exists(_sql):
            osm = path.join(runsim_dpath, "in.osm")
            idf = path.join(runsim_dpath, "in.idf")
            zsz = path.join(runsim_dpath, "epluszsz.csv")
            rdd = path.join(runsim_dpath, "eplus.rdd")
            html = path.join(runsim_dpath, "eplustbl.htm")
            sql = _sql
            print(osm, idf, zsz, rdd, html, err, sql, sep="\n")
        if path.exists(_err):
            err = _err
# ---------- end swaposm ----------
panel_29 = Panel([config_2.python_exe, config_2.py_lib_install])
panel_30 = Panel([versions_2.lbt_gh, versions_2.python, versions_2.radiance, versions_2.openstudio, versions_2.energyplus])
panel_31 = Panel(eui_2.eui_end_use)
roomenergyresult = HBReadRoomEnergyResult(sql=swaposm.sql)  # -> cooling, heating, lighting, electric_equip, gas_equip, process, hot_water, fan_electric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; plug-in component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
eui_3 = HBEndUseIntensity(sql=swaposm.sql)  # -> eui, eui_end_use, end_uses, gross_floor; plug-in component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
panel_32 = Panel(eui_3.end_uses)
panel_33 = Panel(eui_3.eui)
xdata = LBDeconstructData(data=roomenergyresult.mech_vent_load)  # -> header, values; plug-in component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
panel_34 = Panel(eui_3.eui_end_use)
panel_35 = Panel(swaposm.out)
