# Grasshopper definition baseline_v2_CZ1A_L123.gh (Grasshopper 1.0.7)

opaquemat = HBOpaqueMaterial(
    name="Roof Membrane - Highly",
    thickness="0.0095",
    conductivity="0.16",
    density="1211.29",
    spec_heat="1460",
    roughness="VeryRough",
    therm_absp="0.75",
    sol_absp="0.45",
    vis_absp="0.70")  # -> mat; plug-in component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
opaquematnomass = HBOpaqueMaterialNoMass(
    name="Typical Insulation R-24.52",
    r_value="4.318887",
    roughness="Smooth",
    therm_absp="0.9",
    sol_absp="0.7",
    vis_absp="0.7")  # -> mat; plug-in component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
opaquemat_2 = HBOpaqueMaterial(
    name="Metal Roof Surface",
    thickness="0.0008",
    conductivity="45.28",
    density="7824",
    spec_heat="500",
    roughness="Smooth",
    therm_absp="0.9",
    sol_absp="0.70",
    vis_absp="0.70")  # -> mat; plug-in component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

opaquematnomass_2 = HBOpaqueMaterialNoMass(
    name="Typical Insulation R-6.78",
    r_value="0.216480",
    roughness="Smooth",
    therm_absp="0.9",
    sol_absp="0.7",
    vis_absp="0.8")  # -> mat; plug-in component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
opaquematnomass_3 = HBOpaqueMaterialNoMass(name="Typical Carpet pad", r_value="0.216480", roughness="Smooth", therm_absp="0.9", sol_absp="0.7", vis_absp="0.8")  # -> mat; plug-in component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
opaquemat_3 = HBOpaqueMaterial(
    name="4in. Normalweight Concrete",
    thickness="0.1016",
    conductivity="2.31",
    density="2322",
    spec_heat="832",
    roughness="MediumRough",
    therm_absp="0.9",
    sol_absp="0.7",
    vis_absp="0.7")  # -> mat; plug-in component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

opaquemat_4 = HBOpaqueMaterial(
    name="25mm Stucco",
    thickness="0.0254",
    conductivity="0.72",
    density="1856",
    spec_heat="840",
    roughness="Smooth",
    therm_absp="0.9",
    sol_absp="0.7",
    vis_absp="0.7")  # -> mat; plug-in component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
opaquemat_5 = HBOpaqueMaterial(
    name="5/8 in. Gypsum Board",
    thickness="0.0159",
    conductivity="0.16",
    density="800",
    spec_heat="1090",
    roughness="MediumSmooth",
    therm_absp="0.9",
    sol_absp="0.7",
    vis_absp="0.7")  # -> mat; plug-in component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
opaquematnomass_4 = HBOpaqueMaterialNoMass(
    name="Typical Insulation R-9.73",
    r_value="1.712828",
    roughness="Smooth",
    therm_absp="0.9",
    sol_absp="0.7",
    vis_absp="0.7")  # -> mat; plug-in component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
merge = Merge(Data1=opaquemat_4, Data2=opaquemat_5, Data3=opaquematnomass_4, Data4=opaquemat_5)
merge_2 = Merge(Data1=opaquemat, Data2=opaquematnomass, Data3=opaquemat_2)
merge_3 = Merge(Data1=opaquematnomass_2, Data2=opaquemat_3, Data3=opaquematnomass_3)
opaqueconstr = HBOpaqueConstruction(name="Typical Insulated Steel Frame", materials=merge)  # -> constr; plug-in component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
opaqueconstr_2 = HBOpaqueConstruction(name="Typical IEAD Roof - Highly reflective", materials=merge_2)  # -> constr; plug-in component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
opaqueconstr_3 = HBOpaqueConstruction(name="Typical Insulated Exterior Mass", materials=merge_3)  # -> constr; plug-in component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
exteriorsubset = HBExteriorConstructionSubset(exterior_wall=opaqueconstr, exterior_roof=opaqueconstr_2, exposed_floor=opaqueconstr_3)  # -> exterior_set; plug-in component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

# ----
# Debugging LBT Installation
config = HBConfig()  # -> python_exe, py_lib_install, rad_install, os_install, ep_install, hb_os_gem, standards, asset_report, default_sim; plug-in component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
versions = HBCheckVersions()  # -> lbt_gh, python, radiance, openstudio, energyplus; plug-in component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
panel = Panel([versions.openstudio, versions.energyplus])
panel_2 = Panel([versions.lbt_gh, versions.python])
panel_3 = Panel([config.python_exe, config.py_lib_install, config.os_install, config.ep_install, config.standards, config.default_sim])
toggle = BooleanToggle(False)  # disabled
panel_4 = Panel("1.6.0")  # disabled
versioner = LBVersioner(update=toggle, version=panel_4)  # -> Vviiiiiz; disabled; plug-in component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
syncghfile = LBSyncGrasshopperFile(sync=Toggle(False))  # -> report; plug-in component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
panel_5 = Panel(syncghfile)

panel_6 = Panel("C:\Users\saera\master\thermal\mea\")

# ----
# Measures dirpath
panel_7 = Panel("C:\measures\")

panel_8 = Panel("C:\Users\saera\master\thermal\_sim\gh\ref\")
panel_9 = Panel("C:\Users\saera\master\thermal\_sim\gh\rep\")

# ----
# Climate Zone 2B
climate_zone = ValueList({"1A", "2A", "2B", "3A", "3B", "3C", "4A", "4B", "4C", "5A", "5B", "6A", "6B", "7", "8"}, selected="1A")

bldgvintages = HBBuildingVintages({"ASHRAE 90.1 2019  |  IECC 2021": "2019", "ASHRAE 90.1 2016  |  IECC 2018": "2016", "ASHRAE 90.1 2013  |  IECC 2015": "2013", "ASHRAE 90.1 2010  |  IECC 2012": "2010", "ASHRAE 90.1 2007  |  IECC 2009": "2007", "ASHRAE 90.1 2004  |  IECC 2006": "2004", "1980-2004 (CBECS)": "1980_2004", "Pre-1980 (CBECS)": "pre_1980"}, selected="ASHRAE 90.1 2016  |  IECC 2018")
constructiontypes = HBConstructionTypes({"SteelFramed", "WoodFramed", "Mass", "Metal Building"}, selected="SteelFramed")
constrsetclimate = HBConstructionSetByClimate(climate_zone=climate_zone, vintage=bldgvintages, constr_type=constructiontypes)  # -> constr_set; plug-in component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

# ----
# Reference Model name
# Reference Simulation dirpath
panel_10 = Panel("D:\Research outputs\DOE report\Openstudio_reference\")
join = TextJoin(Text=["ref_doe_", climate_zone])

# ----
# Model name
# Simulation dirpath
panel_11 = Panel("D:\Research outputs\DOE report\Openstudio_reproduced\")
join_2 = TextJoin(Text=["rep_doe_", climate_zone])
panel_12 = Panel(join_2)

# ----
# EPW fpath
path = FilePath("C:\Users\saera\master\thermal\epw\IECC_epw\USA_HI_Honolulu.Intl.AP.911820_TMY3.epw")
panel_13 = Panel(path)

# ----
# DDY fpath
path_2 = FilePath("C:\Users\saera\master\thermal\epw\USA_HI_Honolulu.Intl.AP.911820_TMY3\USA_HI_Honolulu.Intl.AP.911820_TMY3.ddy")
panel_14 = Panel(path_2)

panel_15 = Panel(join)

opaquemat_6 = HBOpaqueMaterial(
    name="Std Wood 6inch",
    thickness="0.15",
    conductivity="0.12",
    density="540",
    spec_heat="1210",
    roughness="MediumSmooth",
    therm_absp="0.9",
    sol_absp="0.7",
    vis_absp="0.7")  # -> mat; plug-in component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
opaqueconstr_4 = HBOpaqueConstruction(name="InteriorFurnishings", materials=opaquemat_6)  # -> constr; plug-in component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

opaquemat_7 = HBOpaqueMaterial(
    name="Acoustic Tile 1/2 in.",
    thickness="0.0127",
    conductivity="0.057633",
    density="288.332341",
    spec_heat="795.492",
    roughness="MediumSmooth",
    therm_absp="0.9",
    sol_absp="0.00",
    vis_absp="0.00")  # -> mat; plug-in component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

# ----
# Geometries
rooms = Brep([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])

opaquemat_8 = HBOpaqueMaterial(
    name="F08 Metal Surface",
    thickness="0.0008",
    conductivity="45.28",
    density="7824",
    spec_heat="500",
    roughness="Smooth",
    therm_absp="0.9",
    sol_absp="0.7",
    vis_absp="0.7")  # -> mat; plug-in component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
opaquematnomass_5 = HBOpaqueMaterialNoMass(
    name="Typical Insulation R-1.85",
    r_value="0.326262",
    roughness="Smooth",
    therm_absp="0.9",
    sol_absp="0.7",
    vis_absp="0.7")  # -> mat; plug-in component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

# ---- group: Inteiror Walls
perimeter_thermal_zone_depth = Panel("4.572")
debrep = DeconstructBrep(Brep=rooms)  # -> Faces, Edges, Vertices
item = ListItem(List=debrep.Faces, Index=0, Wrap=True)  # -> Item, Item1, Item2
skeleton = HBStraightSkeleton(floor_geo=item.Item, offset=perimeter_thermal_zone_depth)  # -> polyskel, perim_poly, core_poly; plug-in component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
floor_to_ceiling_height = Panel("2.74")
lng = ListLength(List=flatten(skeleton.perim_poly))
lng_2 = ListLength(List=flatten(item.Item))
division = Division(A=lng, B=lng_2)
Z = UnitZ(Factor=floor_to_ceiling_height)
extr = Extrude(Base=skeleton.perim_poly, Direction=Z)
extr_2 = Extrude(Base=skeleton.core_poly, Direction=Z)  # -> graft(Extrusion)
partition = PartitionList(List=extr, Size=division)
ins = InsertItems(List=partition, Item=extr_2, Indices=4, Wrap=True)
clean = CleanTree(RemoveNulls=True, RemoveInvalid=True, RemoveEmpty=True, Tree=ins)

# ---- group: Plenum
core_poly = Geometry(graft(skeleton.core_poly))
perim_poly = Geometry(skeleton.perim_poly)
edges = BrepEdges(Brep=item.Item)  # -> Naked, Interior, NonManifold
partition_2 = PartitionList(List=perim_poly, Size=division)
plenum_height = Panel("1.22")
join_3 = JoinCurves(Curves=edges.Naked, Preserve=False)
Z_2 = UnitZ(Factor=plenum_height)
addition = Addition(A=plenum_height, B=floor_to_ceiling_height)
merge_4 = Merge(Data1=partition_2, Data2=core_poly)
item_2 = ListItem(List=flatten(item.Item), Index=0, Wrap=True)  # -> Item, Item1, Item2
extr_3 = Extrude(Base=join_3, Direction=Z_2)  # -> flatten(Extrusion)
move = Move(Geometry=merge_4, Motion=Z)  # -> Geometry, Transform
Z_3 = UnitZ(Factor=addition)
bang = ExplodeTree(Data=simplify(move.Geometry))  # -> Branch0, Branch1, Branch2
move_2 = Move(Geometry=extr_3, Motion=Z)  # -> Geometry, Transform
move_3 = Move(Geometry=item_2.Item2, Motion=Z_3)  # -> Geometry, Transform
item_3 = ListItem(List=move_2.Geometry, Index=0, Wrap=True)  # -> Item, Item1, Item2
move_4 = Move(Geometry=bang.Branch1, Motion=Z_2)  # -> Geometry, Transform
move_5 = Move(Geometry=bang.Branch0, Motion=Z_2)  # -> Geometry, Transform
merge_5 = Merge(Data1=move_3.Geometry, Data2=bang.Branch2, Data3=item_3.Item2)  # -> flatten(Result)
merge_6 = Merge(Data1=bang.Branch1, Data2=move_4.Geometry, Data3=item_3.Item1)  # -> flatten(Result)
merge_7 = Merge(Data1=bang.Branch0, Data2=move_5.Geometry, Data3=item_3.Item)  # -> flatten(Result)
entwine = Entwine(Branch00=merge_7, Branch01=merge_6, Branch02=merge_5, FlattenInputs=True)
join_4 = BrepJoin(Breps=entwine)  # -> Breps, Closed
graft = GraftTree(Tree=join_4.Breps, IncludeEmptyLists=True, IncludeNullItems=True)

# ----
windowmat = HBWindowMaterial(u_factor="3.066262", shgc="0.25")  # -> mat; plug-in component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
merge_8 = Merge(Data1=opaquemat_8, Data2=opaquematnomass_5)
windowconstr = HBWindowConstruction(name="U 0.54 SHGC 0.25 Simple Glazing", materials=windowmat)  # -> constr; plug-in component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
opaqueconstr_5 = HBOpaqueConstruction(name="Typical Insulated Metal Door", materials=merge_8)  # -> constr; plug-in component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
subfacesubset = HBSubfaceSubset(window=windowconstr, operable=windowconstr, exterior_door=opaqueconstr_5)  # -> subface_set; plug-in component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

opaqueconstr_6 = HBOpaqueConstruction(name="Plenum Acoustic Tile", materials=opaquemat_7)  # -> constr; plug-in component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

opaquemat_9 = HBOpaqueMaterial(
    name="G01 13mm gypsum board",
    thickness="0.0127",
    conductivity="0.16",
    density="800",
    spec_heat="1090",
    roughness="Smooth",
    therm_absp="0.9",
    sol_absp="0.7",
    vis_absp="0.5")  # -> mat; plug-in component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
opaquematnomass_6 = HBOpaqueMaterialNoMass(name="CP02 Carpet Pad", r_value="0.216480", roughness="VeryRough", therm_absp="0.9", sol_absp="0.7", vis_absp="0.8")  # -> mat; plug-in component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
opaquemat_10 = HBOpaqueMaterial(
    name="100mm Normalweight Concrete floor",
    thickness="0.101600",
    conductivity="2.31",
    density="2322",
    spec_heat="832",
    roughness="MediumSmooth",
    therm_absp="0.9",
    sol_absp="0.7",
    vis_absp="0.7")  # -> mat; plug-in component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
merge_9 = Merge(Data1=opaquemat_9, Data2=opaquemat_9)
merge_10 = Merge(Data1=opaquemat_10, Data2=opaquematnomass_6)
merge_11 = Merge(Data1=opaquematnomass_6, Data2=opaquemat_10)
opaqueconstr_7 = HBOpaqueConstruction(name="Typical Interior Wall", materials=merge_9)  # -> constr; plug-in component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
opaqueconstr_8 = HBOpaqueConstruction(name="Typical Interior Floor", materials=merge_11)  # -> constr; plug-in component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
opaqueconstr_9 = HBOpaqueConstruction(name="Typical Interior Ceiling", materials=merge_10)  # -> constr; plug-in component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
interiorsubset = HBInteriorConstructionSubset(interior_wall=opaqueconstr_7, ceiling=opaqueconstr_6, interior_floor=opaqueconstr_8)  # -> interior_set; plug-in component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

decnstrconstrset = HBDeconstructConstructionSet(constr_set=constrsetclimate)  # -> exterior_wall, exterior_roof, exposed_floor, ground_wall, ground_roof, ground_floor, window, skylight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; plug-in component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
groundsubset = HBGroundConstructionSubset(ground_floor=decnstrconstrset.ground_floor)  # -> ground_set; plug-in component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

interiorsubset_2 = HBInteriorConstructionSubset(ceiling=opaqueconstr_9, interior_floor=opaqueconstr_6)  # -> interior_set; plug-in component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

panel_16 = Panel("""Office_Core_bottom
Office_Core_mid
Office_Core_top""")
panel_17 = Panel("""Office_Perimeter_bot_ZN_
Office_Perimeter_mid_ZN_
Office_Perimeter_top_ZN_""")

# ---- group: Names Perimeter Zones by Orientation
area = Area(Geometry=partition)  # -> Area, Centroid
avr = Average(Input=area.Centroid)
subtraction = Subtraction(A=area.Centroid, B=avr)
python = GhPythonScript(x=subtraction)  # -> a
# ---------- python: Python ----------
if x is None: 
    a = None
else:
    eps = 1e-5 
    px, py = x[0], x[1]

    if abs(abs(px) - abs(py)) < eps:
        if (px * py) > 0.0:
            a = "2" if px > 0.0 else "4"
        else:
            a = "3" if py > 0.0 else "1"
            
    elif abs(px) > abs(py):
        a = "2" if px > 0.0 else "4" 
    else:
        a = "3" if py > 0.0 else "1"
# ---------- end python ----------
concat = Concatenate(FragmentA=graft(panel_17), FragmentB=python)  # -> simplify(Result)
ins_2 = InsertItems(List=concat, Item=graft(panel_16), Indices=4, Wrap=True)
panel_18 = Panel(ins_2)

# ---- group: Storey Interior
interiorsubset_3 = HBInteriorConstructionSubset(interior_wall=opaqueconstr_7, ceiling=opaqueconstr_6, interior_floor=opaqueconstr_6)  # -> interior_set; plug-in component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

# ----
decnstrconstrset_2 = HBDeconstructConstructionSet(constr_set=constrsetclimate)  # -> exterior_wall, exterior_roof, exposed_floor, ground_wall, ground_roof, ground_floor, window, skylight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; plug-in component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
constructionset = HBConstructionSet(base_constr_set=constrsetclimate, exterior_subset=exteriorsubset, interior_subset=interiorsubset_2)  # -> constr_set; plug-in component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
constructionset_2 = HBConstructionSet(
    base_constr_set=constrsetclimate,
    exterior_subset=exteriorsubset,
    ground_subset=groundsubset,
    interior_subset=interiorsubset,
    subface_subset=subfacesubset)  # -> constr_set; plug-in component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

# ---- group: Names Perimeter Zones by Orientation
panel_19 = Panel("""custom_plenum_bt
custom_plenum_md
custom_plenum_tp""")
concat_2 = Concatenate(FragmentA=panel_19)  # -> simplify(graft(Result))

# ---- group: Window and Door Construction
doors = Geometry([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])
windows = Geometry([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])
aperture = HBAperture(geo=windows, name="Windows", operable=Toggle(True), ep_constr=decnstrconstrset_2.window)  # -> report, apertures; plug-in component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
door = HBDoor(geo=doors, name="Doors", ep_constr=decnstrconstrset_2.exterior_door)  # -> report, doors; plug-in component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

# ----
toggle_2 = BooleanToggle(False)
toggle_3 = BooleanToggle(False)
toggle_4 = BooleanToggle(True)
concat_3 = Concatenate(FragmentA=panel_6, FragmentB="CreateTypicalDOEBuildingFromModel")
create_typical_doe_building_from_model = CreateTypicalDOEBuildingFromModel(
    measure_path=concat_3,
    template="90.1-2016",
    exterior_lighting_zone="0",
    add_constructions=toggle_2,
    add_space_type_loads=toggle_2,
    add_elevators=toggle_3,
    add_internal_mass=toggle_2,
    add_exterior_lights=toggle_4,
    onsite_parking_fraction="0.343417",
    add_exhaust=toggle_3,
    add_swh=Toggle(False),
    add_thermostat=toggle_3,
    add_hvac=toggle_2,
    add_refrigeration=toggle_2,
    remove_objects=toggle_4)  # -> report, measure; plug-in component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

panel_20 = Panel(panel_9)
panel_21 = Panel(climate_zone)
panel_22 = Panel(panel_14)
panel_23 = Panel(panel_13)

rooms_2 = Brep(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)
roomsolid = HBRoomFromSolid(geo=flatten(rooms_2), conditioned=True)  # -> report, rooms; plug-in component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
panel_24 = Panel(join)
model = HBModel(rooms=flatten(roomsolid.rooms), name=panel_24)  # -> report, model; plug-in component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

sizingpar = HBSizingParameter()  # -> sizing; plug-in component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
concat_4 = Concatenate(FragmentA=panel_6, FragmentB="CreateDOEPrototypeBuilding")
concat_5 = Concatenate(FragmentA="ASHRAE 169-2013-", FragmentB=climate_zone)
panel_25 = Panel(concat_5)
panel_26 = Panel(panel_13)
create_doe_prototype_building = CreateDOEPrototypeBuilding(measure_path=concat_4, building_type="MediumOffice", template="90.1-2016", climate_zone=panel_25, epw_file=panel_26)  # -> report, measure; plug-in component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
panel_27 = Panel(panel_8)
toggle_5 = BooleanToggle(True)
toggle_6 = BooleanToggle(False)

merge_12 = Merge(Data1=panel_8, Data2=join, Data3="\openstudio\run\in.osm")
join_5 = TextJoin(Text=merge_12)
panel_28 = Panel(join_5)

modeltoosm = HBModelToOSM(
    model=model.model,
    epw_file=panel_26,
    measures=create_doe_prototype_building.measure,
    folder=panel_27,
    write=toggle_6,
    run=toggle_6)  # -> report, jsons, osw, osm, idf, sql, zsz, rdd, html; plug-in component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
panel_29 = Panel(modeltoosm.sql)
openfile = LBOpenFile(file_path=modeltoosm.osm)  # -> report; disabled; plug-in component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

# ----
# Ref SQL fpath
panel_30 = Panel("\openstudio\run\eplusout.sql")
merge_13 = Merge(Data1=panel_8, Data2=join, Data3=panel_30)
join_6 = TextJoin(Text=merge_13)
panel_31 = Panel(join_6)

# ----
# Rep SQL fpath
panel_32 = Panel("\openstudio\run\run\eplusout.sql")
merge_14 = Merge(Data1=panel_9, Data2=join_2, Data3=panel_32)
join_7 = TextJoin(Text=merge_14)
panel_33 = Panel(join_7)

# ----
# Assign Programs
bldgvintages_2 = HBBuildingVintages({"ASHRAE 90.1 2019  |  IECC 2021": "2019", "ASHRAE 90.1 2016  |  IECC 2018": "2016", "ASHRAE 90.1 2013  |  IECC 2015": "2013", "ASHRAE 90.1 2010  |  IECC 2012": "2010", "ASHRAE 90.1 2007  |  IECC 2009": "2007", "ASHRAE 90.1 2004  |  IECC 2006": "2004", "1980-2004 (CBECS)": "1980_2004", "Pre-1980 (CBECS)": "pre_1980"}, selected="ASHRAE 90.1 2016  |  IECC 2018")
searchprog = HBSearchPrograms(vintage=bldgvintages_2, keywords="Whole")  # -> room_prog; plug-in component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
searchprog_2 = HBSearchPrograms(vintage=bldgvintages_2, keywords="Plenum")  # -> room_prog; plug-in component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
item_4 = ListItem(List=searchprog_2, Index="0", Wrap=True)
item_5 = ListItem(List=searchprog, Index="3", Wrap=True)
panel_34 = Panel(item_4)
panel_35 = Panel(item_5)

deconstrprogram = HBDeconstructProgramType(program=item_5)  # -> people, lighting, electric_equip, gas_equip, hot_water, infiltration, ventilation, setpoint; plug-in component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

programtype = HBProgramType(name="custom_plenum_prog", base_program=item_4, infiltration=deconstrprogram.infiltration)  # -> program; plug-in component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

programtype_2 = HBProgramType(
    name="custom_office_prog_core",
    people=deconstrprogram.people,
    lighting=deconstrprogram.lighting,
    electric_equip=deconstrprogram.electric_equip,
    gas_equip=deconstrprogram.gas_equip,
    hot_water=deconstrprogram.hot_water,
    ventilation=deconstrprogram.ventilation,
    setpoint=deconstrprogram.setpoint)  # -> program; plug-in component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

roomsolid_2 = HBRoomFromSolid(geo=graft, name=concat_2, constr_set=constructionset, program=programtype, conditioned=Toggle(False), roof_angle=5)  # -> report, rooms; plug-in component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

srf_area_per_flr_space_area = Panel("2")
roomsbyattr = HBRoomsByAttribute(rooms=roomsolid_2.rooms, attribute="floor_area")  # -> values, rooms; plug-in component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
flatten = FlattenTree(Tree=roomsbyattr.values, Path="{0}")
multiplication = Multiplication(A=flatten, B=srf_area_per_flr_space_area)
internalmass = HBInternalMass(rooms=roomsolid_2.rooms, geo_or_area=multiplication, construction=opaqueconstr_4, name="Internal Mass Definition 1")  # -> report, simplify(rooms); plug-in component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

toggle_7 = BooleanToggle(False)
plenum = HBPlenum(rooms=internalmass.rooms, conditioned=toggle_7, include_floor=toggle_7)  # -> rooms; disabled; plug-in component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

roomsolid_3 = HBRoomFromSolid(geo=clean, name=ins_2, constr_set=constructionset_2, program=item_5, conditioned=Toggle(True), roof_angle=5)  # -> report, rooms; plug-in component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

roomsbyattr_2 = HBRoomsByAttribute(rooms=roomsolid_3.rooms, attribute="floor_area")  # -> values, rooms; plug-in component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
srf_area_per_flr_space_area_2 = Panel("2")
flatten_2 = FlattenTree(Tree=roomsbyattr_2.values, Path="{0}")
path_mapper = PathMapper(flatten_2, source="{A}(i)", target="{i\5}")
multiplication_2 = Multiplication(A=path_mapper, B=srf_area_per_flr_space_area_2)
internalmass_2 = HBInternalMass(
    rooms=roomsolid_3.rooms,
    geo_or_area=flatten(multiplication_2),
    construction=opaqueconstr_4,
    name="Internal Mass Definition 2")  # -> report, rooms; plug-in component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

all_air = HBAllAirHVACTemplates({"VAV chiller with gas boiler reheat": "VAV_Chiller_Boiler", "VAV chiller with central air source heat pump reheat": "VAV_Chiller_ASHP", "VAV chiller with district hot water reheat": "VAV_Chiller_DHW", "VAV chiller with PFP boxes": "VAV_Chiller_PFP", "VAV chiller with gas coil reheat": "VAV_Chiller_GasCoil", "VAV air-cooled chiller with gas boiler reheat": "VAV_ACChiller_Boiler", "VAV air-cooled chiller with central air source heat pump reheat": "VAV_ACChiller_ASHP", "VAV air-cooled chiller with district hot water reheat": "VAV_ACChiller_DHW", "VAV air-cooled chiller with PFP boxes": "VAV_ACChiller_PFP", "VAV air-cooled chiller with gas coil reheat": "VAV_ACChiller_GasCoil"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}, selected="PVAV with gas heat with electric reheat": "PVAV_BoilerElectricReheat")
bldgvintages_3 = HBBuildingVintages({"ASHRAE 90.1 2019  |  IECC 2021": "2019", "ASHRAE 90.1 2016  |  IECC 2018": "2016", "ASHRAE 90.1 2013  |  IECC 2015": "2013", "ASHRAE 90.1 2010  |  IECC 2012": "2010", "ASHRAE 90.1 2007  |  IECC 2009": "2007", "ASHRAE 90.1 2004  |  IECC 2006": "2004", "1980-2004 (CBECS)": "1980_2004", "Pre-1980 (CBECS)": "pre_1980"}, selected="ASHRAE 90.1 2016  |  IECC 2018")
allairhvac = HBAllAirHVAC(rooms=internalmass_2.rooms, system_type=all_air, vintage=bldgvintages_3)  # -> report, rooms; plug-in component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

merge_15 = Merge(Data1=allairhvac.rooms, Data2=internalmass.rooms)
addsubface = HBAddSubface(hb_obj=flatten(merge_15), sub_faces=flatten([aperture.apertures, door.doors]))  # -> hb_obj; plug-in component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
floorheight = HBRoomsByFloorHeight(rooms=flatten(addsubface))  # -> flr_hgts, rooms; plug-in component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

bang_2 = ExplodeTree(Data=simplify(floorheight.rooms))  # -> Branch0, Branch1, Branch2, Branch3, Branch4, Branch5
merge_16 = Merge(Data1=bang_2.Branch2, Data2=bang_2.Branch3)  # -> flatten(Result)
merge_17 = Merge(Data1=bang_2.Branch0, Data2=bang_2.Branch1)  # -> flatten(Result)
merge_18 = Merge(Data1=bang_2.Branch4, Data2=bang_2.Branch5)  # -> flatten(Result)
setstory = HBSetStory(rooms=flatten(merge_17), story="Storey1")  # -> report, rooms; plug-in component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
setstory_2 = HBSetStory(rooms=flatten(merge_16), story="Storey2")  # -> report, rooms; plug-in component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
toggle_8 = BooleanToggle(True)
toggle_9 = BooleanToggle(True)
setstory_3 = HBSetStory(rooms=flatten(merge_18), story="Storey3")  # -> report, rooms; plug-in component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
toggle_10 = BooleanToggle(True)
solveadj = HBSolveAdjacency(rooms=setstory.rooms, ep_int_constr=interiorsubset_3, adiabatic=Toggle(False), overwrite=toggle_8, run=toggle_8)  # -> report, simplify(adj_rooms); plug-in component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
solveadj_2 = HBSolveAdjacency(rooms=setstory_2.rooms, ep_int_constr=interiorsubset_3, adiabatic=Toggle(False), overwrite=toggle_9, run=toggle_9)  # -> report, simplify(adj_rooms); plug-in component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
solveadj_3 = HBSolveAdjacency(rooms=setstory_3.rooms, ep_int_constr=interiorsubset_3, adiabatic=Toggle(False), overwrite=toggle_10, run=toggle_10)  # -> report, simplify(adj_rooms); plug-in component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
merge_19 = Merge(Data1=solveadj.adj_rooms, Data2=solveadj_2.adj_rooms, Data3=solveadj_3.adj_rooms)  # -> flatten(Result)

panel_36 = Panel(solveadj.adj_rooms)

solveadj_4 = HBSolveAdjacency(rooms=merge_19, overwrite=Toggle(False), run=Toggle(True))  # -> report, simplify(adj_rooms); plug-in component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

orientation = HBRoomsByOrientation(rooms=flatten(solveadj_4.adj_rooms))  # -> orientations, perim_rooms, core_rooms; plug-in component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
applyprogram = HBApplyProgramType(rooms=flatten(orientation.core_rooms), program=programtype_2, overwrite=Toggle(True))  # -> report, rooms; plug-in component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
merge_20 = Merge(Data1=orientation.perim_rooms, Data2=applyprogram.rooms)  # -> flatten(Result)

# ----
# Flr ht
floorheight_2 = HBRoomsByFloorHeight(rooms=flatten(solveadj_4.adj_rooms))  # -> simplify(graft(flr_hgts)), simplify(rooms); disabled; plug-in component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
bang_3 = ExplodeTree(Data=floorheight_2.rooms)  # -> Branch0, Branch1, Branch2, Branch3, Branch4, Branch5; disabled
data = Data(flatten([bang_3.Branch2, bang_3.Branch3]))  # disabled
data_2 = Data(flatten([bang_3.Branch4, bang_3.Branch5]))  # disabled
data_3 = Data(flatten([bang_3.Branch0, bang_3.Branch1]))  # disabled

# ----
# Srf Type
facesbytype = HBFacesByType(hb_objs=data_3)  # -> walls, interior_walls, roofs, ceilings, exterior_floors, interior_floors, air_walls, apertures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; disabled; plug-in component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

# ----
# Disable for Model Q/A
faceenergyattr = HBFaceEnergyAttributes({"Construction": "properties.energy.construction.display_name", "Materials": "properties.energy.construction.layers", "Thickness [m]": "properties.energy.construction.thickness", "Density [kg/m2]": "properties.energy.construction.mass_area_density", "Heat Capacity [kg/K-m2]": "properties.energy.construction.area_heat_capacity", "R-Value [m2-K/W]": "properties.energy.construction.r_value", "U-Value [W/m2-K]": "properties.energy.construction.u_value", "U-Factor [W/m2-K]": "properties.energy.construction.u_factor", "SHGC [Unshaded]": "properties.energy.construction.shgc", "Solar Transmitance [Unshaded]": "properties.energy.construction.solar_transmittance", "Visible Transmitance [Unshaded]": "properties.energy.construction.visible_transmittance", "Solar Reflectance [Outside]": "properties.energy.construction.outside_solar_reflectance", "Solar Reflectance [Inside]": "properties.energy.construction.inside_solar_reflectance", "Fraction Area Operable": "properties.energy.vent_opening.fraction_area_operable", "Fraction Height Operable": "properties.energy.vent_opening.fraction_height_operable", "Discharge Coefficient": "properties.energy.vent_opening.discharge_coefficient"}, selected="Construction")  # disabled
roomenergyattr = HBRoomEnergyAttributes({"Program": "properties.energy.program_type.display_name", "Construction Set": "properties.energy.construction_set.display_name", "Is Conditioned": "properties.energy.is_conditioned", "People per Area [ppl/m2]": "properties.energy.people.people_per_area", "Area per Person [m2/ppl]": "properties.energy.people.area_per_person", "Lighting per Area [W/m2]": "properties.energy.lighting.watts_per_area"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}, selected="Program")  # disabled
faceattr = HBFaceAttributes({"Display Name": "display_name", "Simulation Name (Identifier)": "identifier", "Boundary Condition": "boundary_condition", "Has Parent": "has_parent", "Parent": "parent", "Azimuth": "azimuth", "Altitude": "altitude", "Area": "area", "Perimeter": "perimeter", "Face Type": "type", "Aperture Is Operable": "is_operable", "Door Is Glass": "is_glass"}, selected="Simulation Name (Identifier)")  # disabled
roomattr = HBRoomAttributes({"Display Name": "display_name", "Simulation Name (Identifier)": "identifier", "Multiplier": "multiplier", "Floor Area Excluded": "exclude_floor_area", "Story": "story", "Volume": "volume", "Gross Floor Area": "floor_area", "Exposed Area": "exposed_area", "Exterior Wall Area": "exterior_wall_area", "Exterior Aperture Area": "exterior_aperture_area", "Average Floor Elevation": "average_floor_height"}, selected="Display Name")  # disabled
panel_37 = Panel("1")  # disabled
panel_38 = Panel("1")  # disabled
labelrooms = HBLabelRooms(rooms_model=flatten(solveadj_4.adj_rooms), attribute=roomenergyattr, txt_height=panel_37)  # -> label_text, base_pts, labels, wire_frame; disabled; plug-in component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
relay = Relay([facesbytype.interior_floors, facesbytype.ceilings, facesbytype.interior_walls])  # disabled
lablefaces = HBLabelFaces(hb_objs=flatten(relay), attribute=faceenergyattr, txt_height=panel_38)  # -> label_text, base_pts, labels, wire_frame; disabled; plug-in component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
panel_39 = Panel(labelrooms.label_text)  # disabled
vizbytype = HBVisualizeByType(hb_objs=data_3)  # -> walls, interior_walls, roofs, ceilings, exterior_floors, interior_floors, air_walls, apertures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; disabled; plug-in component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
vizbybc = HBVisualizeByBC(hb_objs=data_3)  # -> outdoors, surface, ground, adiabatic, other, wire_frame; disabled; plug-in component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
faceb = FaceBoundaries(Mesh=vizbybc.surface)  # disabled
brep = Brep(faceb)  # disabled
swatch = ColourSwatch(SwatchColor=RGBA(255, 128, 128, 158))  # disabled
geo = Geometry(vizbytype.interior_walls)  # disabled
geo_2 = Geometry(vizbytype.apertures)  # disabled
geo_3 = Geometry(vizbytype.doors)  # disabled
geo_4 = Geometry(vizbytype.wire_frame)  # disabled
geo_5 = Geometry(vizbytype.walls)  # disabled
preview = CustomPreview(Geometry=brep, Material=swatch)  # disabled
geo_6 = Geometry(vizbytype.exterior_floors)  # disabled
geo_7 = Geometry(vizbytype.interior_floors)  # disabled
roofs = Geometry(vizbytype.roofs)  # disabled
geo_8 = Geometry(vizbytype.ceilings)  # disabled

shw = HBSHWTemplates({"Gas Water Heater": "Gas_WaterHeater", "Electric Water Heater": "Electric_WaterHeater", "Heat Pump Water Heater": "HeatPump_WaterHeater", "Gas Tankless Heater": "Gas_TanklessHeater", "Electric Tankless Heater": "Electric_TanklessHeater"}, selected="Gas Water Heater")
orientation_2 = HBRoomsByOrientation(rooms=flatten(merge_20))  # -> orientations, perim_rooms, core_rooms; plug-in component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
floorheight_3 = HBRoomsByFloorHeight(rooms=flatten(orientation_2.core_rooms))  # -> flr_hgts, rooms; plug-in component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
bang_4 = ExplodeTree(Data=simplify(floorheight_3.rooms))  # -> Branch0, Branch1, Branch2
shw_2 = HBSHWSystem(rooms=flatten(merge_20), system_type=shw, efficiency="0.808", condition=bang_4.Branch0, loss_coeff="7.96")  # -> report, rooms; plug-in component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

panel_40 = Panel(join_2)
model_2 = HBModel(rooms=flatten(shw_2.rooms), name=panel_40)  # -> report, model; plug-in component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

toggle_11 = BooleanToggle(True)
toggle_12 = BooleanToggle(True)
simoutput = HBSimulationOutput(
    zone_energy_use=toggle_11,
    hvac_energy_use=toggle_11,
    gains_and_losses=toggle_11,
    comfort_metrics=toggle_11,
    surface_temperature=toggle_11,
    surface_energy_flow=toggle_11)  # -> report, sim_output; plug-in component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
customoutput = HBCustomSimulationOutput(base_sim_output=simoutput.sim_output)  # -> report, sim_output; plug-in component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
simcontrol = HBSimulationControl(
    do_zone_sizing=toggle_12,
    do_system_sizing=toggle_12,
    do_plant_sizing=toggle_12,
    for_sizing_period=Toggle(False),
    for_run_period=toggle_12)  # -> sim_control; plug-in component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
shadowcalc = HBShadowCalculation(solar_dist="FullInteriorAndExterior", frequency="30", max_figures="15000")  # -> shadow_calc; plug-in component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

# ---- group: There is a change in the input or output! Replace this component manually.
sizingpar_2 = HBSizingParameter(ddy_file=panel_22, heating_fac="1", cooling_fac="1")  # -> sizing; plug-in component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

# ----
simpar = HBSimulationParameter(output=customoutput.sim_output, timestep=6, sim_control=simcontrol, shadow_calc=shadowcalc, sizing=sizingpar_2)  # -> sim_par; plug-in component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

modeltoosm_2 = HBModelToOSM(model=model_2.model, epw_file=panel_23, sim_par=simpar, folder=panel_20, write=Toggle(True), run="2")  # -> report, jsons, osw, osm, idf, sql, zsz, rdd, html; plug-in component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
swaposm = SwapOSM(
    osm=modeltoosm_2.osm,
    ref_osm=join_5,
    epw=panel_23,
    mea=create_typical_doe_building_from_model.measure,
    run_swap=toggle_5,
    run_sim=toggle_5,
    update=Toggle(False))  # -> out, osm, osm_swap, idf, sql, zsz, rdd, html, err; inputs mea: list
# ---------- swaposm: Python ----------
from __future__ import print_function
import sys
import os
import json
from pprint import pprint
from subprocess import Popen, PIPE, STDOUT
from honeybee.config import folders as hb_config
from honeybee_energy.config import folders as hbe_config
from honeybee_energy.measure import Measure
from ladybug_rhino.download import download_file


# Global
path = os.path
SWAP_URL = "https://raw.githubusercontent.com/saeranv/thermal/main/lbt/swap.py"
SWAP_NAME = "swap.py"
IS_TTY = sys.stdin.isatty() or len(sys.argv) > 1


def run_subproc(cmds):
    """Run subprocess for list of commands (cmds)."""

    print("Running command:\n{}\n".format(" ".join(cmds)))
    p = Popen(cmds, shell=True, stdout=PIPE, stderr=PIPE)
    _stdout, _stderr = p.communicate()
    #_stdout, _stderr = p.stdout, p.stderr
    
    assert p.returncode == 0, \
        "returncode: {}\nstdout:\n{}\nstderr:\n{}".format(
            p.returncode, _stdout, _stderr)
    return _stdout, _stderr


def update_swap(_swap_fpath):
    """Update swap.py from github and confirm in lbt scripts path."""

    _ = download_file(SWAP_URL, _swap_fpath)
    print("## Downloaded {} from {}.".format(SWAP_NAME, SWAP_URL))

    assert path.exists(_swap_fpath), \
        "Path {} not exist.\n".format(_swap_fpath)


def update_pip(_lbt_pytexe, _ops_version):
    """Update openstudio SDK via pip."""

    # Check if pip opesntudio is updated
    cmds = [_lbt_pytexe, "-m", "pip", "list"]
    _stdout = run_subproc(cmds)[0]
    pkgs = _stdout.decode("utf-8").strip().split("\n")
    is_pip_match = False
    for pkg in pkgs:
        if "openstudio" in pkg:
            _ops_version_ = pkg.split("openstudio")[1].strip()
            print("## Found openstudio {} in pip.".format(_ops_version_))
            is_pip_match = _ops_version_ == _ops_version
            break

    if not is_pip_match:
        # Pip install openstudio if not in pip or version wrong
        _ops_pkg = "openstudio=={}".format(_ops_version)
        cmds = [_lbt_pytexe, "-m", "pip", "install", _ops_pkg]

        _stdout, _stderr = run_subproc(cmds)
        if _stdout: print(_stdout.decode("utf-8").strip())
        if _stderr: print(_stderr.decode("utf-8").strip())


def dump_mea(measure, osw_fpath):
    """Dump measure to osw file."""

    osw_dict = measure.to_osw_dict()
    osw_dict["measure_paths"] = [measure.folder]
    with open(osw_fpath, "w") as fp:
        json.dump(osw_dict, fp, indent=4)
    return osw_fpath

if IS_TTY:
    # Label bool, fpath inputs
    run_swap_, run_sim_, update_ = True, True, False
    _osm, _ref_osm, _epw, _mea_dpath = sys.argv[-3:]
    _mea = Measure(_mea_dpath)

if run_swap_ or run_sim_ or update_:

    # # Overwrite
    # update_ = False
    # run_swap_ = False
    # run_sim_ = False

    lbt_pytexe = hb_config.python_exe_path
    lbt_opsexe = hbe_config.openstudio_exe
    opsv_ = hbe_config.openstudio_version
    ops_version = "{}.{}.{}".format(opsv_[0], opsv_[1], opsv_[2])
    # TODO: only for debugging
    # swap_fpath = path.join(hb_config.python_scripts_path, SWAP_NAME)
    # swap_fpath = path.abspath(path.join(_epw, "../../../swap", "swap2.py"))
    swap_fpath = path.abspath(path.join(_epw, "../../../lbt", "swap.py"))
    
    # Update/confirm swap_fpath exists
    if update_ or (not path.exists(swap_fpath)):
        _ = update_swap(swap_fpath)
        _ = update_pip(lbt_pytexe, ops_version)
        update_cmds = [lbt_pytexe, swap_fpath, "--help"]
        stdout = run_subproc(update_cmds)[0]
        print(stdout.decode("utf-8").strip())

    assert isinstance(_osm, str) and path.exists(_osm), \
        "Error, OSM file does not exist."
    assert isinstance(_epw, str) and path.exists(_epw), \
        "Error, EPW file does not exist."
    assert _mea is not None, \
        "Error, Measure obj does not exist."

    try:
        _osw_swap, _osm_swap = None, None
        runsim_dpath = path.dirname(_osm) # sim dpath is child
        _osw = path.join(runsim_dpath, "workflow.osw")


        if run_swap_:
            # Run swap
            print("\n## Running swap.py on lbtpyt.exe")
            # Update measure, and run swap_win.py
            _osw = dump_mea(_mea[0], _osw)
            swap_cmds = [lbt_pytexe, swap_fpath, _osw, _osm, _ref_osm, _epw]
            stdout, stderr = run_subproc(swap_cmds)
            
            if stdout: 
                print(stdout.decode('utf-8'))
                _osm_swap, _osw_swap = \
                    stdout.decode('utf-8').strip().split("\n")[-2:]
            if stderr: print(stderr.decode('utf-8'))

        if run_sim_:
            # Run workflow.osw
            print("\n## Running workflow.osw on openstudio.exe")

            if not _osw_swap:
                _osw_swap = path.join(runsim_dpath, "workflow_swap.osw")

            assert path.exists(_osw_swap), \
                "OSW not found at {}".format(_osw_swap)

            sim_cmds = [lbt_opsexe, "run", "-w", _osw_swap]
            stdout, stderr = run_subproc(sim_cmds)
            if stdout: print(stdout)
            if stderr: print(stderr)

            # Get outputs
            # print(runsim_dpath, ":\n", os.listdir(runsim_dpath))

            ransim_dpath = path.join(runsim_dpath, "run")
            _sql = path.join(ransim_dpath, "eplusout.sql")
            if path.exists(_sql):
                osm = path.join(ransim_dpath, "in.osm")
                _osm_swap = _osm_swap
                idf = path.join(ransim_dpath, "in.idf")
                zsz = path.join(ransim_dpath, "epluszsz.csv")
                rdd = path.join(ransim_dpath, "eplus.rdd")
                html = path.join(ransim_dpath, "eplustbl.htm")
                err = path.join(ransim_dpath, "eplusout.err")
                sql = _sql
                print(osm, idf, zsz, rdd, html, err, sql, sep="\n")
    except:
        # clear globals in case error in OSM object.
        for name in dir():
            if name.startswith("_"):
                continue
            del globals()[name]
        # raise w/o arg means gets last exception and reraise it
        raise
# ---------- end swaposm ----------

# ----
# Ref SQL fpath
# SQL fpath
panel_41 = Panel("")
panel_43 = Panel(swaposm.sql)
eui = HBEndUseIntensity(sql=join_6)  # -> eui, eui_end_use, end_uses, gross_floor; plug-in component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
eui_2 = HBEndUseIntensity(sql=swaposm.sql)  # -> eui, eui_end_use, end_uses, gross_floor; plug-in component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
panel_44 = Panel(eui.eui)
panel_45 = Panel(eui.end_uses)
panel_46 = Panel(eui_2.end_uses)
panel_47 = Panel(eui_2.eui)
panel_48 = Panel(eui.eui_end_use)
panel_49 = Panel(eui_2.eui_end_use)
panel_50 = Panel(swaposm.out)
panel_51 = Panel(modeltoosm_2.report)

opendir = LBOpenDirectory(file_path=swaposm.sql)  # -> report; plug-in component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
customresult = HBReadCustomResult(sql=swaposm.sql)  # -> results; disabled; plug-in component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
bang_5 = ExplodeTree(Data=simplify(customresult))  # -> Branch0, Branch1; disabled
