# Grasshopper definition baseline_v2_CZ6B_L123.gh (Grasshopper 1.0.7)

# ----
# Debugging LBT Installation
config = HBConfig()  # -> python_exe, py_lib_install, rad_install, os_install, ep_install, hb_os_gem, standards, asset_report, default_sim; plug-in component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
versions = HBCheckVersions()  # -> lbt_gh, python, radiance, openstudio, energyplus; plug-in component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
panel = Panel([versions.lbt_gh, versions.python])
panel_2 = Panel([versions.openstudio, versions.energyplus])
panel_3 = Panel([config.python_exe, config.py_lib_install, config.os_install, config.ep_install, config.standards, config.default_sim])
toggle = BooleanToggle(False)  # disabled
panel_4 = Panel("1.6.0")  # disabled
versioner = LBVersioner(update=toggle, version=panel_4)  # -> Vviiiiiz; disabled; plug-in component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
syncghfile = LBSyncGrasshopperFile(sync=Toggle(False))  # -> report; plug-in component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
panel_5 = Panel(syncghfile)

# ----
# Measures dirpath
panel_6 = Panel("C:\measures\")

panel_7 = Panel("C:\Users\saera\master\thermal\mea\")
panel_8 = Panel("C:\Users\saera\master\thermal\_sim\gh\ref\")
panel_9 = Panel("C:\Users\saera\master\thermal\_sim\gh\rep\")

# ----
# Climate Zone 6B
climate_zone = ValueList({"1A", "2A", "2B", "3A", "3B", "3C", "4A", "4B", "4C", "5A", "5B", "6A", "6B", "7", "8"}, selected="6B")

# ----
# Reference Model name
# Reference Simulation dirpath
panel_10 = Panel("D:\Research outputs\DOE report\Openstudio_reference\")
join = TextJoin(Text=["ref_doe_", climate_zone])

# ----
# Model name
# Simulation dirpath
panel_11 = Panel("D:\Research outputs\DOE report\Openstudio_reproduced\")
join_2 = TextJoin(Text=["rep_doe_", climate_zone])
panel_12 = Panel(join_2)

# ----
# EPW fpath
path = FilePath("C:\Users\saera\master\thermal\epw\IECC_epw\USA_MT_Great.Falls.Intl.AP.727750_TMY3.epw")
panel_13 = Panel(path)

# ----
# DDY fpath
path_2 = FilePath("C:\Users\saera\master\thermal\epw\USA_MT_Great.Falls.Intl.AP.727750_TMY3\USA_MT_Great.Falls.Intl.AP.727750_TMY3.ddy")
panel_14 = Panel(path_2)

bldgvintages = HBBuildingVintages({"ASHRAE 90.1 2019  |  IECC 2021": "2019", "ASHRAE 90.1 2016  |  IECC 2018": "2016", "ASHRAE 90.1 2013  |  IECC 2015": "2013", "ASHRAE 90.1 2010  |  IECC 2012": "2010", "ASHRAE 90.1 2007  |  IECC 2009": "2007", "ASHRAE 90.1 2004  |  IECC 2006": "2004", "1980-2004 (CBECS)": "1980_2004", "Pre-1980 (CBECS)": "pre_1980"}, selected="ASHRAE 90.1 2016  |  IECC 2018")
constructiontypes = HBConstructionTypes({"SteelFramed", "WoodFramed", "Mass", "Metal Building"}, selected="SteelFramed")
constrsetclimate = HBConstructionSetByClimate(climate_zone=climate_zone, vintage=bldgvintages, constr_type=constructiontypes)  # -> constr_set; plug-in component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

decnstrconstrset = HBDeconstructConstructionSet(constr_set=constrsetclimate)  # -> exterior_wall, exterior_roof, exposed_floor, ground_wall, ground_roof, ground_floor, window, skylight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; plug-in component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

panel_15 = Panel(join)

panel_16 = Panel(decnstrconstrset.ground_floor)

opaquemat = HBOpaqueMaterial(
    name="100mm Normalweight Concrete floor",
    thickness="0.101600",
    conductivity="2.31",
    density="2322",
    spec_heat="832",
    roughness="MediumSmooth",
    therm_absp="0.9",
    sol_absp="0.7",
    vis_absp="0.7")  # -> mat; plug-in component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

opaquemat_2 = HBOpaqueMaterial(
    name="Acoustic Tile 1/2 in.",
    thickness="0.0127",
    conductivity="0.057633",
    density="288.332341",
    spec_heat="795.492",
    roughness="MediumSmooth",
    therm_absp="0.9",
    sol_absp="0.00",
    vis_absp="0.00")  # -> mat; plug-in component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

opaquemat_3 = HBOpaqueMaterial(
    name="Std Wood 6inch",
    thickness="0.15",
    conductivity="0.12",
    density="540",
    spec_heat="1210",
    roughness="MediumSmooth",
    therm_absp="0.9",
    sol_absp="0.7",
    vis_absp="0.7")  # -> mat; plug-in component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
opaqueconstr = HBOpaqueConstruction(name="InteriorFurnishings", materials=opaquemat_3)  # -> constr; plug-in component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

opaquematnomass = HBOpaqueMaterialNoMass(
    name="Typical Insulation R-17.04",
    r_value="3.000718",
    roughness="Smooth",
    therm_absp="0.9",
    sol_absp="0.7",
    vis_absp="0.7")  # -> mat; plug-in component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

opaquematnomass_2 = HBOpaqueMaterialNoMass(
    name="Typical Insulation R-18.23",
    r_value="3.210364",
    roughness="Smooth",
    therm_absp="0.9",
    sol_absp="0.7",
    vis_absp="0.7")  # -> mat; plug-in component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

# ----
# Geometries
rooms = Brep([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])

opaquematnomass_3 = HBOpaqueMaterialNoMass(
    name="Typical Insulation R-30.13",
    r_value="5.306685",
    roughness="Smooth",
    therm_absp="0.9",
    sol_absp="0.7",
    vis_absp="0.7")  # -> mat; plug-in component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

searchmats = HBSearchMaterials(keywords="25mm Stucco")  # -> flatten(opaque_mats), window_mats; plug-in component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
searchmats_2 = HBSearchMaterials(keywords="5/8 in. Gypsum Board")  # -> flatten(opaque_mats), window_mats; plug-in component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
searchmats_3 = HBSearchMaterials(keywords="Typical Carpet pad")  # -> flatten(opaque_mats), window_mats; plug-in component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
searchmats_4 = HBSearchMaterials(keywords="4 in. Normalweight Concrete")  # -> flatten(opaque_mats), window_mats; plug-in component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
searchmats_5 = HBSearchMaterials(keywords="Metal Roof Surface")  # -> flatten(opaque_mats), window_mats; plug-in component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
searchmats_6 = HBSearchMaterials(keywords="Roof Membrane")  # -> flatten(opaque_mats), window_mats; plug-in component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
item = ListItem(List=searchmats_6.opaque_mats, Index=Slider(1, range=0..3), Wrap=True)
item_2 = ListItem(List=searchmats_5.opaque_mats, Index=Slider(0, range=0..3), Wrap=True)
merge = Merge(Data1=opaquematnomass, Data2=searchmats_4.opaque_mats, Data3=searchmats_3.opaque_mats)
panel_17 = Panel(item)
merge_2 = Merge(Data1=item, Data2=opaquematnomass_3, Data3=item_2)
merge_3 = Merge(Data1=searchmats.opaque_mats, Data2=searchmats_2.opaque_mats, Data3=opaquematnomass_2, Data4=searchmats_2.opaque_mats)
panel_18 = Panel(item_2)
opaqueconstr_2 = HBOpaqueConstruction(name="Typical IEAD Roof R-31.25", materials=merge_2)  # -> constr; plug-in component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
opaqueconstr_3 = HBOpaqueConstruction(name="Typical Insulated Steel Framed Exterior Wall R-20.41", materials=merge_3)  # -> constr; plug-in component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
opaqueconstr_4 = HBOpaqueConstruction(name="Typical Insulated Exterior Mass Floor R-19.61", materials=merge)  # -> constr; plug-in component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
exteriorsubset = HBExteriorConstructionSubset(exterior_wall=opaqueconstr_3, exterior_roof=opaqueconstr_2, exposed_floor=opaqueconstr_4)  # -> exterior_set; plug-in component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
panel_19 = Panel("exterior set")

searchmats_7 = HBSearchMaterials(keywords="8 in. Normalweight Concrete Floor")  # -> opaque_mats, window_mats; plug-in component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
searchmats_8 = HBSearchMaterials(keywords="Typical Carpet pad")  # -> opaque_mats, window_mats; plug-in component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
merge_4 = Merge(Data1=searchmats_7.opaque_mats, Data2=searchmats_8.opaque_mats)
opaqueconstr_5 = HBOpaqueConstruction(name="Typical Insulated Carpeted 8in Slab Floor", materials=merge_4)  # -> constr; plug-in component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
groundsubset = HBGroundConstructionSubset(ground_floor=decnstrconstrset.ground_floor)  # -> ground_set; plug-in component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
panel_20 = Panel("ground set")

# ---- group: Inteiror Walls
perimeter_thermal_zone_depth = Panel("4.572")
debrep = DeconstructBrep(Brep=rooms)  # -> Faces, Edges, Vertices
item_3 = ListItem(List=debrep.Faces, Index=0, Wrap=True)  # -> Item, Item1, Item2
skeleton = HBStraightSkeleton(floor_geo=item_3.Item, offset=perimeter_thermal_zone_depth)  # -> polyskel, perim_poly, core_poly; plug-in component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
floor_to_ceiling_height = Panel("2.74")
lng = ListLength(List=flatten(skeleton.perim_poly))
lng_2 = ListLength(List=flatten(item_3.Item))
division = Division(A=lng, B=lng_2)
Z = UnitZ(Factor=floor_to_ceiling_height)
extr = Extrude(Base=skeleton.perim_poly, Direction=Z)
extr_2 = Extrude(Base=skeleton.core_poly, Direction=Z)  # -> graft(Extrusion)
partition = PartitionList(List=extr, Size=division)
ins = InsertItems(List=partition, Item=extr_2, Indices=4, Wrap=True)
clean = CleanTree(RemoveNulls=True, RemoveInvalid=True, RemoveEmpty=True, Tree=ins)

# ---- group: Plenum
core_poly = Geometry(graft(skeleton.core_poly))
perim_poly = Geometry(skeleton.perim_poly)
edges = BrepEdges(Brep=item_3.Item)  # -> Naked, Interior, NonManifold
partition_2 = PartitionList(List=perim_poly, Size=division)
plenum_height = Panel("1.22")
join_3 = JoinCurves(Curves=edges.Naked, Preserve=False)
Z_2 = UnitZ(Factor=plenum_height)
addition = Addition(A=plenum_height, B=floor_to_ceiling_height)
merge_5 = Merge(Data1=partition_2, Data2=core_poly)
item_4 = ListItem(List=flatten(item_3.Item), Index=0, Wrap=True)  # -> Item, Item1, Item2
extr_3 = Extrude(Base=join_3, Direction=Z_2)  # -> flatten(Extrusion)
move = Move(Geometry=merge_5, Motion=Z)  # -> Geometry, Transform
Z_3 = UnitZ(Factor=addition)
bang = ExplodeTree(Data=simplify(move.Geometry))  # -> Branch0, Branch1, Branch2
move_2 = Move(Geometry=extr_3, Motion=Z)  # -> Geometry, Transform
move_3 = Move(Geometry=item_4.Item2, Motion=Z_3)  # -> Geometry, Transform
item_5 = ListItem(List=move_2.Geometry, Index=0, Wrap=True)  # -> Item, Item1, Item2
move_4 = Move(Geometry=bang.Branch1, Motion=Z_2)  # -> Geometry, Transform
move_5 = Move(Geometry=bang.Branch0, Motion=Z_2)  # -> Geometry, Transform
merge_6 = Merge(Data1=move_3.Geometry, Data2=bang.Branch2, Data3=item_5.Item2)  # -> flatten(Result)
merge_7 = Merge(Data1=bang.Branch1, Data2=move_4.Geometry, Data3=item_5.Item1)  # -> flatten(Result)
merge_8 = Merge(Data1=bang.Branch0, Data2=move_5.Geometry, Data3=item_5.Item)  # -> flatten(Result)
entwine = Entwine(Branch00=merge_8, Branch01=merge_7, Branch02=merge_6, FlattenInputs=True)
join_4 = BrepJoin(Breps=entwine)  # -> Breps, Closed
graft = GraftTree(Tree=join_4.Breps, IncludeEmptyLists=True, IncludeNullItems=True)

# ----
# Assign Programs
bldgvintages_2 = HBBuildingVintages({"ASHRAE 90.1 2019  |  IECC 2021": "2019", "ASHRAE 90.1 2016  |  IECC 2018": "2016", "ASHRAE 90.1 2013  |  IECC 2015": "2013", "ASHRAE 90.1 2010  |  IECC 2012": "2010", "ASHRAE 90.1 2007  |  IECC 2009": "2007", "ASHRAE 90.1 2004  |  IECC 2006": "2004", "1980-2004 (CBECS)": "1980_2004", "Pre-1980 (CBECS)": "pre_1980"}, selected="ASHRAE 90.1 2016  |  IECC 2018")
searchprog = HBSearchPrograms(vintage=bldgvintages_2, keywords="Whole")  # -> room_prog; plug-in component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
searchprog_2 = HBSearchPrograms(vintage=bldgvintages_2, keywords="Plenum")  # -> room_prog; plug-in component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
item_6 = ListItem(List=searchprog_2, Index="0", Wrap=True)
item_7 = ListItem(List=searchprog, Index="3", Wrap=True)
panel_21 = Panel(item_6)
panel_22 = Panel(item_7)

opaqueconstr_6 = HBOpaqueConstruction(name="Plenum Acoustic Tile", materials=opaquemat_2)  # -> constr; plug-in component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

searchmats_9 = HBSearchMaterials(keywords="CP02 Carpet Pad")  # -> flatten(opaque_mats), window_mats; plug-in component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
searchmats_10 = HBSearchMaterials(keywords="G01 13mm gypsum board")  # -> opaque_mats, window_mats; plug-in component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
merge_9 = Merge(Data1=opaquemat, Data2=searchmats_9.opaque_mats)
merge_10 = Merge(Data1=searchmats_9.opaque_mats, Data2=opaquemat)
merge_11 = Merge(Data1=searchmats_10.opaque_mats, Data2=searchmats_10.opaque_mats)
opaqueconstr_7 = HBOpaqueConstruction(name="Typical Interior Ceiling", materials=merge_9)  # -> constr; plug-in component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
opaqueconstr_8 = HBOpaqueConstruction(name="Typical Interior Floor", materials=merge_10)  # -> constr; plug-in component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
opaqueconstr_9 = HBOpaqueConstruction(name="Typical Interior Wall", materials=merge_11)  # -> constr; plug-in component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
panel_23 = Panel("interior set")
interiorsubset = HBInteriorConstructionSubset(interior_wall=opaqueconstr_9, ceiling=opaqueconstr_6, interior_floor=opaqueconstr_8)  # -> interior_set; plug-in component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

interiorsubset_2 = HBInteriorConstructionSubset(ceiling=opaqueconstr_7, interior_floor=opaqueconstr_6)  # -> interior_set; plug-in component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

# ---- group: Names Perimeter Zones by Orientation
area = Area(Geometry=partition)  # -> Area, Centroid
avr = Average(Input=area.Centroid)
subtraction = Subtraction(A=area.Centroid, B=avr)
panel_24 = Panel("""Core_bottom
Core_top
Core_mid""")
panel_25 = Panel("""Perimeter_bot_ZN_
Perimter_mid_ZN_
Perimeter_top_ZN_""")
python = GhPythonScript(x=subtraction)  # -> a
# ---------- python: Python ----------
if x is None: 
    a = None
else:
    eps = 1e-5 
    px, py = x[0], x[1]

    if abs(abs(px) - abs(py)) < eps:
        if (px * py) > 0.0:
            a = "2" if px > 0.0 else "4"
        else:
            a = "3" if py > 0.0 else "1"
            
    elif abs(px) > abs(py):
        a = "2" if px > 0.0 else "4" 
    else:
        a = "3" if py > 0.0 else "1"
# ---------- end python ----------
concat = Concatenate(FragmentA=graft(panel_25), FragmentB=python)  # -> simplify(Result)
ins_2 = InsertItems(List=concat, Item=graft(panel_24), Indices=4, Wrap=True)
panel_26 = Panel(ins_2)

# ---- group: Room Program
deconstrprogram = HBDeconstructProgramType(program=item_7)  # -> people, lighting, electric_equip, gas_equip, hot_water, infiltration, ventilation, setpoint; plug-in component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
programtype = HBProgramType(
    name="custom_office_prog",
    people=deconstrprogram.people,
    lighting=deconstrprogram.lighting,
    electric_equip=deconstrprogram.electric_equip,
    gas_equip=deconstrprogram.gas_equip,
    hot_water=deconstrprogram.hot_water,
    infiltration=deconstrprogram.infiltration,
    ventilation=deconstrprogram.ventilation,
    setpoint=deconstrprogram.setpoint)  # -> program; plug-in component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

# ----
deconstrprogram_2 = HBDeconstructProgramType(program=item_7)  # -> people, lighting, electric_equip, gas_equip, hot_water, infiltration, ventilation, setpoint; plug-in component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

deconstrprogram_3 = HBDeconstructProgramType(program=item_6)  # -> people, lighting, electric_equip, gas_equip, hot_water, infiltration, ventilation, setpoint; plug-in component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
programtype_2 = HBProgramType(name="custom_plenum_prog", infiltration=deconstrprogram_3.infiltration)  # -> program; plug-in component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

# ---- group: Storey Interior
interiorsubset_3 = HBInteriorConstructionSubset(interior_wall=opaqueconstr_9, ceiling=opaqueconstr_6, interior_floor=opaqueconstr_6)  # -> interior_set; plug-in component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

# ---- group: Names Perimeter Zones by Orientation
panel_27 = Panel("""custom_plenum_bt
custom_plenum_md
custom_plenum_tp""")
concat_2 = Concatenate(FragmentA=panel_27)  # -> simplify(graft(Result))

# ----
programtype_3 = HBProgramType(
    name="custom_office_prog_core",
    people=deconstrprogram_2.people,
    lighting=deconstrprogram_2.lighting,
    electric_equip=deconstrprogram_2.electric_equip,
    gas_equip=deconstrprogram_2.gas_equip,
    hot_water=deconstrprogram_2.hot_water,
    ventilation=deconstrprogram_2.ventilation,
    setpoint=deconstrprogram_2.setpoint)  # -> program; plug-in component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
panel_28 = Panel("""AFN Surface Venting Window or Door Opening Factor
Surface Inside Face Convection Heat Transfer Coefficient""")  # disabled
panel_29 = Panel("Site:GroundTemperature:BuildingSurface,8.6,2.8,-4.1,-8.8,-2.2,0.3,6.7,10.1,16.5,20.6,19.2,14.7;")
toggle_2 = BooleanToggle(False)

panel_30 = Panel(panel_9)
panel_31 = Panel(climate_zone)
panel_32 = Panel(panel_14)
panel_33 = Panel(panel_13)

toggle_3 = BooleanToggle(True)
toggle_4 = BooleanToggle(True)
simoutput = HBSimulationOutput(
    zone_energy_use=toggle_3,
    hvac_energy_use=toggle_3,
    gains_and_losses=toggle_3,
    comfort_metrics=toggle_3,
    surface_temperature=toggle_3,
    surface_energy_flow=toggle_3)  # -> report, sim_output; plug-in component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
customoutput = HBCustomSimulationOutput(base_sim_output=simoutput.sim_output, output_names=panel_28)  # -> report, sim_output; plug-in component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
simcontrol = HBSimulationControl(
    do_zone_sizing=toggle_4,
    do_system_sizing=toggle_4,
    do_plant_sizing=toggle_4,
    for_sizing_period=Toggle(False),
    for_run_period=toggle_4)  # -> sim_control; plug-in component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
shadowcalc = HBShadowCalculation(solar_dist="FullInteriorAndExterior", frequency="30", max_figures="15000")  # -> shadow_calc; plug-in component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
sizingpar = HBSizingParameter(ddy_file=panel_32, heating_fac="1", cooling_fac="1")  # -> sizing; plug-in component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
simpar = HBSimulationParameter(output=customoutput.sim_output, timestep=6, sim_control=simcontrol, shadow_calc=shadowcalc, sizing=sizingpar)  # -> sim_par; plug-in component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

toggle_5 = BooleanToggle(False)

rooms_2 = Brep(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)
roomsolid = HBRoomFromSolid(geo=flatten(rooms_2), conditioned=True)  # -> report, rooms; plug-in component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
panel_34 = Panel(join)
model = HBModel(rooms=flatten(roomsolid.rooms), name=panel_34)  # -> report, model; plug-in component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

toggle_6 = BooleanToggle(True)
panel_35 = Panel("Not Applicable")
merge_12 = Merge(Data1=panel_29)  # disabled
concat_3 = Concatenate(FragmentA=panel_7, FragmentB="CreateDOEPrototypeBuilding")
concat_4 = Concatenate(FragmentA=panel_7, FragmentB="CreateTypicalDOEBuildingFromModel")
concat_5 = Concatenate(FragmentA="ASHRAE 169-2013-", FragmentB=climate_zone)
panel_36 = Panel(concat_5)
create_typical_doe_building_from_model = CreateTypicalDOEBuildingFromModel(
    measure_path=concat_4,
    template="90.1-2016",
    exterior_lighting_zone="0",
    add_constructions=toggle_2,
    add_space_type_loads=toggle_2,
    add_elevators=toggle_5,
    add_internal_mass=toggle_2,
    add_exterior_lights=toggle_6,
    onsite_parking_fraction="0.343417",
    add_exhaust=toggle_5,
    add_swh=Toggle(True),
    add_thermostat=toggle_5,
    add_hvac=toggle_2,
    add_refrigeration=toggle_2,
    remove_objects=toggle_6)  # -> report, measure; plug-in component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
panel_37 = Panel(merge_12)
panel_38 = Panel(panel_13)
create_doe_prototype_building = CreateDOEPrototypeBuilding(measure_path=concat_3, building_type="MediumOffice", template="90.1-2016", climate_zone=panel_36, epw_file=panel_38)  # -> report, measure; plug-in component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

merge_13 = Merge(Data1=panel_8, Data2=join, Data3="\openstudio\run\in.osm")
join_5 = TextJoin(Text=merge_13)
panel_39 = Panel(join_5)

panel_40 = Panel(panel_8)
toggle_7 = BooleanToggle(False)
toggle_8 = BooleanToggle(True)
modeltoosm = HBModelToOSM(
    model=model.model,
    epw_file=panel_38,
    measures=create_doe_prototype_building.measure,
    folder=panel_40,
    write=toggle_7,
    run=toggle_7)  # -> report, jsons, osw, osm, idf, sql, zsz, rdd, html; plug-in component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
panel_41 = Panel(modeltoosm.osm)
opendir = LBOpenDirectory(file_path=modeltoosm.osm)  # -> report; disabled; plug-in component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

# ----
# Ref SQL fpath
panel_42 = Panel("\openstudio\run\eplusout.sql")
merge_14 = Merge(Data1=panel_8, Data2=join, Data3=panel_42)
join_6 = TextJoin(Text=merge_14)
panel_43 = Panel(join_6)

# ----
# Rep SQL fpath
panel_44 = Panel("\openstudio\run\run\eplusout.sql")
merge_15 = Merge(Data1=panel_9, Data2=join_2, Data3=panel_44)
join_7 = TextJoin(Text=merge_15)
panel_45 = Panel(join_7)

toggle_9 = BooleanToggle(True)  # disabled

searchmats_11 = HBSearchMaterials(keywords="F08 Metal surface")  # -> flatten(opaque_mats), window_mats; plug-in component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
opaquematnomass_4 = HBOpaqueMaterialNoMass(
    name="Typical Insulation R-2.38",
    r_value="0.418404",
    roughness="Smooth",
    therm_absp="0.900000",
    sol_absp="0.7",
    vis_absp="0.7")  # -> mat; plug-in component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
opaquematnomass_5 = HBOpaqueMaterialNoMass(
    name="Typical Insulation R-1.85",
    r_value="0.326262",
    roughness="Smooth",
    therm_absp="0.900000",
    sol_absp="0.7",
    vis_absp="0.7")  # -> mat; plug-in component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
searchconstrs = HBSearchConstructions(keywords="U 0.36 SHGC 0.4 Simple Glazing")  # -> opaque_constrs, window_constrs, shade_constrs; plug-in component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
merge_16 = Merge(Data1=searchmats_11.opaque_mats, Data2=opaquematnomass_5)
opaqueconstr_10 = HBOpaqueConstruction(name="Typical Overhead Door R-3.23", materials=opaquematnomass_4)  # -> constr; disabled; plug-in component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
opaqueconstr_11 = HBOpaqueConstruction(name="Typical Insulated Metal Door R-2.7", materials=merge_16)  # -> constr; plug-in component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

item_8 = ListItem(List=searchconstrs.window_constrs, Index=0, Wrap=True)
panel_46 = Panel(searchconstrs.window_constrs)

subfacesubset = HBSubfaceSubset(window=item_8, operable=item_8, exterior_door=opaqueconstr_11, overhead_door=opaqueconstr_11, glass_door=item_8)  # -> subface_set; plug-in component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

decnstrconstrset_2 = HBDeconstructConstructionSet(constr_set=constrsetclimate)  # -> exterior_wall, exterior_roof, exposed_floor, ground_wall, ground_roof, ground_floor, window, skylight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; plug-in component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
constructionset = HBConstructionSet(base_constr_set=constrsetclimate, exterior_subset=exteriorsubset, interior_subset=interiorsubset_2)  # -> constr_set; plug-in component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
constructionset_2 = HBConstructionSet(
    base_constr_set=constrsetclimate,
    exterior_subset=exteriorsubset,
    ground_subset=groundsubset,
    interior_subset=interiorsubset,
    subface_subset=subfacesubset)  # -> constr_set; plug-in component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

roomsolid_2 = HBRoomFromSolid(geo=graft, name=concat_2, constr_set=constructionset, program=programtype_2, conditioned=Toggle(False), roof_angle=5)  # -> report, rooms; plug-in component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

srf_area_per_flr_space_area = Panel("2")
roomsbyattr = HBRoomsByAttribute(rooms=roomsolid_2.rooms, attribute="floor_area")  # -> values, rooms; plug-in component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
flatten = FlattenTree(Tree=roomsbyattr.values, Path="{0}")
multiplication = Multiplication(A=flatten, B=srf_area_per_flr_space_area)
internalmass = HBInternalMass(rooms=roomsolid_2.rooms, geo_or_area=multiplication, construction=opaqueconstr, name="Internal Mass Definition 1")  # -> report, simplify(rooms); plug-in component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

# ---- group: Window and Door Construction
doors = Geometry([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])
windows = Geometry([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])
aperture = HBAperture(geo=windows, name="Windows", operable=Toggle(True), ep_constr=decnstrconstrset_2.window)  # -> report, apertures; plug-in component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
door = HBDoor(geo=doors, name="Doors", ep_constr=decnstrconstrset_2.exterior_door)  # -> report, doors; plug-in component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

# ----
toggle_10 = BooleanToggle(False)
plenum = HBPlenum(rooms=internalmass.rooms, conditioned=toggle_10, remove_infilt=Toggle(False), include_floor=toggle_10)  # -> rooms; plug-in component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

roomsolid_3 = HBRoomFromSolid(geo=clean, name=ins_2, constr_set=constructionset_2, program=programtype, conditioned=Toggle(True), roof_angle=5)  # -> report, rooms; plug-in component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

roomsbyattr_2 = HBRoomsByAttribute(rooms=roomsolid_3.rooms, attribute="floor_area")  # -> values, rooms; plug-in component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
srf_area_per_flr_space_area_2 = Panel("2")
flatten_2 = FlattenTree(Tree=roomsbyattr_2.values, Path="{0}")
path_mapper = PathMapper(flatten_2, source="{A}(i)", target="{i\5}")
multiplication_2 = Multiplication(A=path_mapper, B=srf_area_per_flr_space_area_2)
internalmass_2 = HBInternalMass(
    rooms=roomsolid_3.rooms,
    geo_or_area=flatten(multiplication_2),
    construction=opaqueconstr,
    name="Internal Mass Definition 2")  # -> report, rooms; plug-in component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

all_air = HBAllAirHVACTemplates({"VAV chiller with gas boiler reheat": "VAV_Chiller_Boiler", "VAV chiller with central air source heat pump reheat": "VAV_Chiller_ASHP", "VAV chiller with district hot water reheat": "VAV_Chiller_DHW", "VAV chiller with PFP boxes": "VAV_Chiller_PFP", "VAV chiller with gas coil reheat": "VAV_Chiller_GasCoil", "VAV air-cooled chiller with gas boiler reheat": "VAV_ACChiller_Boiler", "VAV air-cooled chiller with central air source heat pump reheat": "VAV_ACChiller_ASHP", "VAV air-cooled chiller with district hot water reheat": "VAV_ACChiller_DHW", "VAV air-cooled chiller with PFP boxes": "VAV_ACChiller_PFP", "VAV air-cooled chiller with gas coil reheat": "VAV_ACChiller_GasCoil"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}, selected="PVAV with gas boiler reheat": "PVAV_Boiler")
bldgvintages_3 = HBBuildingVintages({"ASHRAE 90.1 2019  |  IECC 2021": "2019", "ASHRAE 90.1 2016  |  IECC 2018": "2016", "ASHRAE 90.1 2013  |  IECC 2015": "2013", "ASHRAE 90.1 2010  |  IECC 2012": "2010", "ASHRAE 90.1 2007  |  IECC 2009": "2007", "ASHRAE 90.1 2004  |  IECC 2006": "2004", "1980-2004 (CBECS)": "1980_2004", "Pre-1980 (CBECS)": "pre_1980"}, selected="ASHRAE 90.1 2016  |  IECC 2018")
allairhvac = HBAllAirHVAC(rooms=internalmass_2.rooms, system_type=all_air, vintage=bldgvintages_3)  # -> report, rooms; plug-in component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

shw = HBSHWTemplates({"Gas Water Heater": "Gas_WaterHeater", "Electric Water Heater": "Electric_WaterHeater", "Heat Pump Water Heater": "HeatPump_WaterHeater", "Gas Tankless Heater": "Gas_TanklessHeater", "Electric Tankless Heater": "Electric_TanklessHeater"}, selected="Gas Water Heater")  # disabled
panel_47 = Panel("0.808")  # disabled
panel_48 = Panel("7.96")  # disabled
shw_2 = HBSHWSystem(rooms=flatten(internalmass_2.rooms), system_type=shw, efficiency=panel_47, loss_coeff=panel_48)  # -> report, rooms; disabled; plug-in component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

merge_17 = Merge(Data1=allairhvac.rooms, Data2=plenum)
addsubface = HBAddSubface(hb_obj=flatten(merge_17), sub_faces=flatten([aperture.apertures, door.doors]))  # -> hb_obj; plug-in component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
floorheight = HBRoomsByFloorHeight(rooms=flatten(addsubface))  # -> flr_hgts, rooms; plug-in component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

bang_2 = ExplodeTree(Data=simplify(floorheight.rooms))  # -> Branch0, Branch1, Branch2, Branch3, Branch4, Branch5
merge_18 = Merge(Data1=bang_2.Branch2, Data2=bang_2.Branch3)  # -> flatten(Result)
merge_19 = Merge(Data1=bang_2.Branch0, Data2=bang_2.Branch1)  # -> flatten(Result)
merge_20 = Merge(Data1=bang_2.Branch4, Data2=bang_2.Branch5)  # -> flatten(Result)
setstory = HBSetStory(rooms=flatten(merge_19), story="Storey1")  # -> report, rooms; plug-in component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
setstory_2 = HBSetStory(rooms=flatten(merge_18), story="Storey2")  # -> report, rooms; plug-in component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
toggle_11 = BooleanToggle(True)
toggle_12 = BooleanToggle(True)
setstory_3 = HBSetStory(rooms=flatten(merge_20), story="Storey3")  # -> report, rooms; plug-in component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
toggle_13 = BooleanToggle(True)
solveadj = HBSolveAdjacency(rooms=setstory.rooms, ep_int_constr=interiorsubset_3, adiabatic=Toggle(False), overwrite=toggle_11, run=toggle_11)  # -> report, simplify(adj_rooms); plug-in component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
solveadj_2 = HBSolveAdjacency(rooms=setstory_2.rooms, ep_int_constr=interiorsubset_3, adiabatic=Toggle(False), overwrite=toggle_12, run=toggle_12)  # -> report, simplify(adj_rooms); plug-in component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
solveadj_3 = HBSolveAdjacency(rooms=setstory_3.rooms, ep_int_constr=interiorsubset_3, adiabatic=Toggle(False), overwrite=toggle_13, run=toggle_13)  # -> report, simplify(adj_rooms); plug-in component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
merge_21 = Merge(Data1=solveadj.adj_rooms, Data2=solveadj_2.adj_rooms, Data3=solveadj_3.adj_rooms)  # -> flatten(Result)

panel_49 = Panel(solveadj.adj_rooms)

solveadj_4 = HBSolveAdjacency(rooms=merge_21, overwrite=Toggle(False), run=Toggle(True))  # -> report, simplify(adj_rooms); plug-in component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

orientation = HBRoomsByOrientation(rooms=flatten(solveadj_4.adj_rooms))  # -> orientations, perim_rooms, core_rooms; plug-in component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
applyprogram = HBApplyProgramType(rooms=flatten(orientation.core_rooms), program=programtype_3, overwrite=Toggle(True))  # -> report, rooms; plug-in component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
merge_22 = Merge(Data1=orientation.perim_rooms, Data2=applyprogram.rooms)  # -> flatten(Result)

panel_50 = Panel(join_2)
model_2 = HBModel(rooms=flatten(merge_22), name=panel_50)  # -> report, model; plug-in component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

# ----
# Flr ht
floorheight_2 = HBRoomsByFloorHeight(rooms=flatten(solveadj_4.adj_rooms))  # -> simplify(graft(flr_hgts)), simplify(rooms); disabled; plug-in component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
bang_3 = ExplodeTree(Data=floorheight_2.rooms)  # -> Branch0, Branch1, Branch2, Branch3, Branch4, Branch5; disabled
data = Data(flatten([bang_3.Branch2, bang_3.Branch3]))  # disabled
data_2 = Data(flatten([bang_3.Branch4, bang_3.Branch5]))  # disabled
data_3 = Data(flatten([bang_3.Branch0, bang_3.Branch1]))  # disabled

# ----
# Srf Type
facesbytype = HBFacesByType(hb_objs=data_2)  # -> walls, interior_walls, roofs, ceilings, exterior_floors, interior_floors, air_walls, apertures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; disabled; plug-in component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

# ----
# Disable for Model Q/A
faceenergyattr = HBFaceEnergyAttributes({"Construction": "properties.energy.construction.display_name", "Materials": "properties.energy.construction.layers", "Thickness [m]": "properties.energy.construction.thickness", "Density [kg/m2]": "properties.energy.construction.mass_area_density", "Heat Capacity [kg/K-m2]": "properties.energy.construction.area_heat_capacity", "R-Value [m2-K/W]": "properties.energy.construction.r_value", "U-Value [W/m2-K]": "properties.energy.construction.u_value", "U-Factor [W/m2-K]": "properties.energy.construction.u_factor", "SHGC [Unshaded]": "properties.energy.construction.shgc", "Solar Transmitance [Unshaded]": "properties.energy.construction.solar_transmittance", "Visible Transmitance [Unshaded]": "properties.energy.construction.visible_transmittance", "Solar Reflectance [Outside]": "properties.energy.construction.outside_solar_reflectance", "Solar Reflectance [Inside]": "properties.energy.construction.inside_solar_reflectance", "Fraction Area Operable": "properties.energy.vent_opening.fraction_area_operable", "Fraction Height Operable": "properties.energy.vent_opening.fraction_height_operable", "Discharge Coefficient": "properties.energy.vent_opening.discharge_coefficient"}, selected="Construction")  # disabled
roomenergyattr = HBRoomEnergyAttributes({"Program": "properties.energy.program_type.display_name", "Construction Set": "properties.energy.construction_set.display_name", "Is Conditioned": "properties.energy.is_conditioned", "People per Area [ppl/m2]": "properties.energy.people.people_per_area", "Area per Person [m2/ppl]": "properties.energy.people.area_per_person", "Lighting per Area [W/m2]": "properties.energy.lighting.watts_per_area"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}, selected="Program")  # disabled
faceattr = HBFaceAttributes({"Display Name": "display_name", "Simulation Name (Identifier)": "identifier", "Boundary Condition": "boundary_condition", "Has Parent": "has_parent", "Parent": "parent", "Azimuth": "azimuth", "Altitude": "altitude", "Area": "area", "Perimeter": "perimeter", "Face Type": "type", "Aperture Is Operable": "is_operable", "Door Is Glass": "is_glass"}, selected="Simulation Name (Identifier)")  # disabled
roomattr = HBRoomAttributes({"Display Name": "display_name", "Simulation Name (Identifier)": "identifier", "Multiplier": "multiplier", "Floor Area Excluded": "exclude_floor_area", "Story": "story", "Volume": "volume", "Gross Floor Area": "floor_area", "Exposed Area": "exposed_area", "Exterior Wall Area": "exterior_wall_area", "Exterior Aperture Area": "exterior_aperture_area", "Average Floor Elevation": "average_floor_height"}, selected="Display Name")  # disabled
panel_51 = Panel("1")  # disabled
panel_52 = Panel("1")  # disabled
labelrooms = HBLabelRooms(rooms_model=flatten(solveadj_4.adj_rooms), attribute=roomenergyattr, txt_height=panel_51)  # -> label_text, base_pts, labels, wire_frame; disabled; plug-in component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
relay = Relay([facesbytype.interior_floors, facesbytype.ceilings, facesbytype.interior_walls])  # disabled
lablefaces = HBLabelFaces(hb_objs=flatten(relay), attribute=faceenergyattr, txt_height=panel_52)  # -> label_text, base_pts, labels, wire_frame; disabled; plug-in component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
panel_53 = Panel(labelrooms.label_text)  # disabled
vizbytype = HBVisualizeByType(hb_objs=data_2)  # -> walls, interior_walls, roofs, ceilings, exterior_floors, interior_floors, air_walls, apertures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; disabled; plug-in component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
vizbybc = HBVisualizeByBC(hb_objs=data_2)  # -> outdoors, surface, ground, adiabatic, other, wire_frame; disabled; plug-in component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
faceb = FaceBoundaries(Mesh=vizbybc.outdoors)  # disabled
brep = Brep(faceb)  # disabled
swatch = ColourSwatch(SwatchColor=RGBA(255, 128, 128, 158))  # disabled
geo = Geometry(vizbytype.apertures)  # disabled
geo_2 = Geometry(vizbytype.doors)  # disabled
geo_3 = Geometry(vizbytype.wire_frame)  # disabled
geo_4 = Geometry(vizbytype.interior_walls)  # disabled
geo_5 = Geometry(vizbytype.walls)  # disabled
preview = CustomPreview(Geometry=brep, Material=swatch)  # disabled
geo_6 = Geometry(vizbytype.exterior_floors)  # disabled
geo_7 = Geometry(vizbytype.interior_floors)  # disabled
roofs = Geometry(vizbytype.roofs)  # disabled
geo_8 = Geometry(vizbytype.ceilings)  # disabled

modeltoosm_2 = HBModelToOSM(model=model_2.model, epw_file=panel_33, sim_par=simpar, add_str=merge_12, folder=panel_30, write=Toggle(True), run="2")  # -> report, jsons, osw, osm, idf, sql, zsz, rdd, html; plug-in component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
swaposm = SwapOSM(
    osm=modeltoosm_2.osm,
    ref_osm=join_5,
    epw=panel_33,
    mea=create_typical_doe_building_from_model.measure,
    run_swap=toggle_8,
    run_sim=toggle_8,
    update=Toggle(False))  # -> out, osm, osm_swap, idf, sql, zsz, rdd, html, err; inputs mea: list
# ---------- swaposm: Python ----------
from __future__ import print_function
import sys
import os
import json
from pprint import pprint
from subprocess import Popen, PIPE, STDOUT
from honeybee.config import folders as hb_config
from honeybee_energy.config import folders as hbe_config
from honeybee_energy.measure import Measure
from ladybug_rhino.download import download_file


# Global
path = os.path
SWAP_URL = "https://raw.githubusercontent.com/saeranv/thermal/main/lbt/swap.py"
SWAP_NAME = "swap.py"
IS_TTY = sys.stdin.isatty() or len(sys.argv) > 1


def run_subproc(cmds):
    """Run subprocess for list of commands (cmds)."""

    print("Running command:\n{}\n".format(" ".join(cmds)))
    p = Popen(cmds, shell=True, stdout=PIPE, stderr=PIPE)
    _stdout, _stderr = p.communicate()

    assert p.returncode == 0, \
        "returncode: {}\nstdout:\n{}\nstderr:\n{}".format(
            p.returncode, _stdout, _stderr)
    return _stdout, _stderr


def update_swap(_swap_fpath):
    """Update swap.py from github and confirm in lbt scripts path."""

    _ = download_file(SWAP_URL, _swap_fpath)
    print("## Downloaded {} from {}.".format(SWAP_NAME, SWAP_URL))

    assert path.exists(_swap_fpath), \
        "Path {} not exist.\n".format(_swap_fpath)


def update_pip(_lbt_pytexe, _ops_version):
    """Update openstudio SDK via pip."""

    # Check if pip opesntudio is updated
    cmds = [_lbt_pytexe, "-m", "pip", "list"]
    _stdout = run_subproc(cmds)[0]
    pkgs = _stdout.decode("utf-8").strip().split("\n")
    is_pip_match = False
    for pkg in pkgs:
        if "openstudio" in pkg:
            _ops_version_ = pkg.split("openstudio")[1].strip()
            print("## Found openstudio {} in pip.".format(_ops_version_))
            is_pip_match = _ops_version_ == _ops_version
            break

    if not is_pip_match:
        # Pip install openstudio if not in pip or version wrong
        _ops_pkg = "openstudio=={}".format(_ops_version)
        cmds = [_lbt_pytexe, "-m", "pip", "install", _ops_pkg]

        _stdout, _stderr = run_subproc(cmds)
        if _stdout: print(_stdout.decode("utf-8").strip())
        if _stderr: print(_stderr.decode("utf-8").strip())


def dump_mea(measure, osw_fpath):
    """Dump measure to osw file."""

    osw_dict = measure.to_osw_dict()
    osw_dict["measure_paths"] = [measure.folder]
    with open(osw_fpath, "w") as fp:
        json.dump(osw_dict, fp, indent=4)
    return osw_fpath

if IS_TTY:
    # Label bool, fpath inputs
    run_swap_, run_sim_, update_ = True, True, True
    _osm, _ref_osm, _epw, _mea_dpath = sys.argv[-3:]
    _mea = Measure(_mea_dpath)

if run_swap_ or run_sim_ or update_:

    # # Overwrite
    # update_ = False
    # run_swap_ = False
    # run_sim_ = False

    lbt_pytexe = hb_config.python_exe_path
    lbt_opsexe = hbe_config.openstudio_exe
    opsv_ = hbe_config.openstudio_version
    ops_version = "{}.{}.{}".format(opsv_[0], opsv_[1], opsv_[2])
    swap_fpath = path.join(hb_config.python_scripts_path, SWAP_NAME)
    # # TODO: only for debugging
    # swap_fpath = path.abspath(path.join(_epw, "../../../lbt", SWAP_NAME))

    # Update/confirm swap_fpath exists
    if update_ or (not path.exists(swap_fpath)):
        _ = update_swap(swap_fpath)
        _ = update_pip(lbt_pytexe, ops_version)
        update_cmds = [lbt_pytexe, swap_fpath, "--help"]
        stdout = run_subproc(update_cmds)[0]
        print(stdout.decode("utf-8").strip())

    assert isinstance(_osm, str) and path.exists(_osm), \
        "Error, OSM file does not exist."
    assert isinstance(_epw, str) and path.exists(_epw), \
        "Error, EPW file does not exist."
    assert _mea is not None, \
        "Error, Measure obj does not exist."

    try:
        _osw_swap, _osm_swap = None, None
        runsim_dpath = path.dirname(_osm) # sim dpath is child
        _osw = path.join(runsim_dpath, "workflow.osw")


        if run_swap_:
            # Run swap
            print("\n## Running swap.py on lbtpyt.exe")
            # Update measure, and run swap_win.py
            _osw = dump_mea(_mea[0], _osw)
            swap_cmds = [lbt_pytexe, swap_fpath, _osw, _osm, _ref_osm, _epw]
            stdout, stderr = run_subproc(swap_cmds)
            _osm_swap, _osw_swap = \
                stdout.decode('utf-8').strip().split("\n")[-2:]
            if stdout: print(stdout.decode('utf-8'))
            if stderr: print(stderr.decode('utf-8'))

        if run_sim_:
            # Run workflow.osw
            print("\n## Running workflow.osw on openstudio.exe")

            if not _osw_swap:
                _osw_swap = path.join(runsim_dpath, "workflow_swap.osw")

            assert path.exists(_osw_swap), \
                "OSW not found at {}".format(_osw_swap)

            sim_cmds = [lbt_opsexe, "run", "-w", _osw_swap]
            stdout, stderr = run_subproc(sim_cmds)
            if stdout: print(stdout)
            if stderr: print(stderr)

            # Get outputs
            # print(runsim_dpath, ":\n", os.listdir(runsim_dpath))

            ransim_dpath = path.join(runsim_dpath, "run")
            _sql = path.join(ransim_dpath, "eplusout.sql")
            if path.exists(_sql):
                osm = path.join(ransim_dpath, "in.osm")
                _osm_swap = _osm_swap
                idf = path.join(ransim_dpath, "in.idf")
                zsz = path.join(ransim_dpath, "epluszsz.csv")
                rdd = path.join(ransim_dpath, "eplus.rdd")
                html = path.join(ransim_dpath, "eplustbl.htm")
                err = path.join(ransim_dpath, "eplusout.err")
                sql = _sql
                print(osm, idf, zsz, rdd, html, err, sql, sep="\n")
    except:
        # clear globals in case error in OSM object.
        for name in dir():
            if name.startswith("_"):
                continue
            del globals()[name]
        # raise w/o arg means gets last exception and reraise it
        raise
# ---------- end swaposm ----------

# ----
# Ref SQL fpath
# SQL fpath
panel_54 = Panel("")
panel_56 = Panel(swaposm.sql)
eui = HBEndUseIntensity(sql=join_6)  # -> eui, eui_end_use, end_uses, gross_floor; plug-in component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
eui_2 = HBEndUseIntensity(sql=swaposm.sql)  # -> eui, eui_end_use, end_uses, gross_floor; plug-in component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
panel_57 = Panel(eui.eui)
panel_58 = Panel(eui.end_uses)
panel_59 = Panel(eui_2.end_uses)
panel_60 = Panel(eui_2.eui)
panel_61 = Panel(eui.eui_end_use)
panel_62 = Panel(eui_2.eui_end_use)
panel_63 = Panel(swaposm.out)
panel_64 = Panel(modeltoosm_2.report)

opendir_2 = LBOpenDirectory(file_path=swaposm.sql)  # -> report; plug-in component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
faceresult = HBReadFaceResult(sql=swaposm.sql)  # -> face_indoor_temp, face_outdoor_temp, face_energy_flow; disabled; plug-in component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
roomenergyresult = HBReadRoomEnergyResult(sql=swaposm.sql)  # -> cooling, heating, lighting, electric_equip, gas_equip, process, hot_water, fan_electric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; disabled; plug-in component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
panel_65 = Panel(eui_2.gross_floor)
customresult = HBReadCustomResult(sql=swaposm.sql, output_names=panel_28)  # -> results; disabled; plug-in component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
colorfaces = HBColorFaces(data=flatten(faceresult.face_energy_flow), hb_objs=flatten(model_2.model), normalize=toggle_9)  # -> report, mesh, wire_frame, legend, title, faces, colors, values, vis_set; disabled; plug-in component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
colorrooms = HBColorRooms(data=flatten(roomenergyresult.heating), rooms_model=flatten(model_2.model), norm_by_flr=toggle_9)  # -> report, mesh, wire_frame, legend, title, rooms, colors, values, vis_set; disabled; plug-in component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
bang_4 = ExplodeTree(Data=simplify(customresult))  # -> Branch0, Branch1; disabled
