# Grasshopper definition itm_L1_CZ4B.gh (Grasshopper 1.0.7)

panel = Panel("0.34")

panel_2 = Panel("2322")
opaquemat = HBOpaqueMaterial(
    name="Flat Concrete Extrusions",
    thickness="0.07",
    conductivity="2.31",
    density="1150",
    spec_heat="832",
    roughness="MediumSmooth",
    therm_absp="0.9",
    sol_absp="0.7",
    vis_absp="0.7")  # -> mat; plug-in component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

searchmats = HBSearchMaterials(keywords="concrete")  # -> opaque_mats, window_mats; plug-in component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
item = ListItem(List=searchmats.opaque_mats, Index="17", Wrap=True)

opaquemat_2 = HBOpaqueMaterial(
    name="100mm Normalweight Concrete floor",
    thickness="0.101600",
    conductivity="2.31",
    density="2322",
    spec_heat="832",
    roughness="MediumSmooth",
    therm_absp="0.9",
    sol_absp="0.7",
    vis_absp="0.7")  # -> mat; plug-in component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

opaquematnomass = HBOpaqueMaterialNoMass(
    name="Typical Insulation R-0.54",
    r_value="0.094503",
    roughness="Smooth",
    therm_absp="0.9",
    sol_absp="0.7",
    vis_absp="0.7")  # -> mat; plug-in component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

opaquematnomass_2 = HBOpaqueMaterialNoMass(
    name="Typical Insulation R-5.89",
    r_value="1.036522",
    roughness="Smooth",
    therm_absp="0.9",
    sol_absp="0.7",
    vis_absp="0.7")  # -> mat; plug-in component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

opaquematnomass_3 = HBOpaqueMaterialNoMass(
    name="Typical Insulation R-19.72",
    r_value="3.472204",
    roughness="Smooth",
    therm_absp="0.9",
    sol_absp="0.7",
    vis_absp="0.7")  # -> mat; plug-in component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

opaquemat_3 = HBOpaqueMaterial(
    name="Acoustic Tile 1/2 in.",
    thickness="0.0127",
    conductivity="0.057633",
    density="288.332341",
    spec_heat="795.492",
    roughness="MediumSmooth",
    therm_absp="0.9",
    sol_absp="0.00",
    vis_absp="0.00")  # -> mat; plug-in component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

decnstrmat = HBDeconstructMaterial(mat=item)  # -> values, attr_names, r_val_si, r_val_ip; plug-in component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

searchmats_2 = HBSearchMaterials(keywords="CP02 Carpet Pad")  # -> flatten(opaque_mats), window_mats; plug-in component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
searchmats_3 = HBSearchMaterials(keywords="25mm Stucco")  # -> flatten(opaque_mats), window_mats; plug-in component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
searchmats_4 = HBSearchMaterials(keywords="5/8 in. Gypsum Board")  # -> flatten(opaque_mats), window_mats; plug-in component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
searchmats_5 = HBSearchMaterials(keywords="8 in. Normalweight Concrete Floor")  # -> opaque_mats, window_mats; plug-in component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
searchmats_6 = HBSearchMaterials(keywords="Typical Carpet pad")  # -> opaque_mats, window_mats; plug-in component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
searchmats_7 = HBSearchMaterials(keywords="Typical Carpet pad")  # -> flatten(opaque_mats), window_mats; plug-in component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
searchmats_8 = HBSearchMaterials(keywords="4 in. Normalweight concrete floor")  # -> flatten(opaque_mats), window_mats; plug-in component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
opaquematnomass_4 = HBOpaqueMaterialNoMass(
    name="Typical Insulation R-2.38",
    r_value="0.418404",
    roughness="Smooth",
    therm_absp="0.900000",
    sol_absp="0.7",
    vis_absp="0.7")  # -> mat; plug-in component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
searchmats_9 = HBSearchMaterials(keywords="Roof Membrane - Highly")  # -> flatten(opaque_mats), window_mats; plug-in component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
searchmats_10 = HBSearchMaterials(keywords="Metal Roof Surface")  # -> flatten(opaque_mats), window_mats; plug-in component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
searchmats_11 = HBSearchMaterials(keywords="F08 Metal surface")  # -> flatten(opaque_mats), window_mats; plug-in component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
opaquematnomass_5 = HBOpaqueMaterialNoMass(
    name="Typical Insulation R-1.85",
    r_value="0.326262",
    roughness="Smooth",
    therm_absp="0.900000",
    sol_absp="0.7",
    vis_absp="0.7")  # -> mat; plug-in component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
searchconstrs = HBSearchConstructions(keywords="U 0.57 SHGC 0.25 Simple Glazing")  # -> opaque_constrs, window_constrs, shade_constrs; plug-in component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
panel_3 = Panel("Plenum Acoustic Tile")
opaquemat_4 = HBOpaqueMaterial(
    name="Metal Roof Surface",
    thickness="0.000800",
    conductivity="45.280000",
    density="7824.000000",
    spec_heat="500.000000",
    roughness="Smooth",
    therm_absp="0.900000",
    sol_absp="0.700000",
    vis_absp="0.700000")  # -> mat; plug-in component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
searchmats_12 = HBSearchMaterials(keywords="G01 13mm gypsum board")  # -> opaque_mats, window_mats; plug-in component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
merge = Merge(Data1=searchmats_5.opaque_mats, Data2=searchmats_6.opaque_mats)
item_2 = ListItem(List=searchmats_9.opaque_mats, Index=Slider(1, range=0..3), Wrap=True)
merge_2 = Merge(Data1=searchmats_2.opaque_mats, Data2=opaquemat_2)
merge_3 = Merge(Data1=opaquemat_2, Data2=searchmats_2.opaque_mats)
merge_4 = Merge(Data1=opaquematnomass, Data2=searchmats_8.opaque_mats, Data3=searchmats_7.opaque_mats)
panel_4 = Panel(searchmats_10.opaque_mats)
merge_5 = Merge(Data1=searchmats_12.opaque_mats, Data2=searchmats_12.opaque_mats)
merge_6 = Merge(Data1=searchmats_11.opaque_mats, Data2=opaquematnomass_5)
opaqueconstr = HBOpaqueConstruction(name="ITM-1", materials=opaquemat)  # -> constr; plug-in component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
panel_5 = Panel(item_2)
merge_7 = Merge(Data1=item_2, Data2=opaquematnomass_3, Data3=opaquemat_4)
merge_8 = Merge(Data1=searchmats_3.opaque_mats, Data2=searchmats_4.opaque_mats, Data3=opaquematnomass_2, Data4=searchmats_4.opaque_mats)
panel_6 = Panel("""DOE-Typical Insulated Exterior Mass;
Typical Insulated Exterior Mass Floor R-3.11""")
opaqueconstr_2 = HBOpaqueConstruction(name="Typical Insulated Carpeted 8in Slab Floor", materials=merge)  # -> constr; plug-in component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
opaqueconstr_3 = HBOpaqueConstruction(name="Typical IEAD Roof R-20.83", materials=merge_7)  # -> constr; plug-in component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
opaqueconstr_4 = HBOpaqueConstruction(name="Typical Insulated Steel Framed Exterior Wall R-8.06", materials=merge_8)  # -> constr; plug-in component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
opaqueconstr_5 = HBOpaqueConstruction(name="Typical Overhead Door R-3.23", materials=opaquematnomass_4)  # -> constr; plug-in component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
opaqueconstr_6 = HBOpaqueConstruction(name=panel_6, materials=merge_4)  # -> constr; plug-in component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
opaqueconstr_7 = HBOpaqueConstruction(name="Typical Insulated Metal Door R-2.7", materials=merge_6)  # -> constr; plug-in component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
opaqueconstr_8 = HBOpaqueConstruction(name="Typical Interior Wall", materials=merge_5)  # -> constr; plug-in component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
opaqueconstr_9 = HBOpaqueConstruction(name="Typical Interior Floor", materials=merge_2)  # -> constr; plug-in component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
opaqueconstr_10 = HBOpaqueConstruction(name="Typical Interior Ceiling", materials=merge_3)  # -> constr; plug-in component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
groundsubset = HBGroundConstructionSubset(ground_floor=opaqueconstr_2)  # -> ground_set; plug-in component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
subfacesubset = HBSubfaceSubset(
    window=searchconstrs.window_constrs,
    operable=searchconstrs.window_constrs,
    exterior_door=opaqueconstr_7,
    overhead_door=opaqueconstr_5,
    glass_door=searchconstrs.window_constrs)  # -> subface_set; plug-in component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
panel_7 = Panel("ground set")
panel_8 = Panel("interior set")
interiorsubset = HBInteriorConstructionSubset(ceiling=opaqueconstr_10, interior_floor=opaqueconstr)  # -> interior_set; plug-in component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
exteriorsubset = HBExteriorConstructionSubset(exterior_wall=opaqueconstr_4, exterior_roof=opaqueconstr_3, exposed_floor=opaqueconstr_6)  # -> exterior_set; plug-in component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
panel_9 = Panel("exterior set")
interiorsubset_2 = HBInteriorConstructionSubset(interior_wall=opaqueconstr_8, ceiling=opaqueconstr, interior_floor=opaqueconstr_9)  # -> interior_set; plug-in component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
constructionset = HBConstructionSet(exterior_subset=exteriorsubset, interior_subset=interiorsubset)  # -> constr_set; plug-in component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
constructionset_2 = HBConstructionSet(
    exterior_subset=exteriorsubset,
    ground_subset=groundsubset,
    interior_subset=interiorsubset_2,
    subface_subset=subfacesubset)  # -> constr_set; plug-in component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

panel_10 = Panel(decnstrmat.attr_names)
panel_11 = Panel(searchmats.opaque_mats)
panel_12 = Panel(decnstrmat.values)
panel_13 = Panel("floor/ceiling")

# ---- group: Input Plenum
rooms = Brep(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)

# ---- group: Input Rooms
rooms_2 = Brep(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)

# ---- group: Inteiror Walls
perimeter_thermal_zone_depth = Panel("4.572")
debrep = DeconstructBrep(Brep=rooms_2)  # -> Faces, Edges, Vertices
item_3 = ListItem(List=debrep.Faces, Index=0, Wrap=True)  # -> Item, Item1, Item2
floor_to_ceiling_height = Panel("2.74")
skeleton = HBStraightSkeleton(floor_geo=item_3.Item, offset=perimeter_thermal_zone_depth)  # -> polyskel, perim_poly, core_poly; plug-in component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
lng = ListLength(List=flatten(skeleton.perim_poly))
lng_2 = ListLength(List=flatten(item_3.Item))
division = Division(A=lng, B=lng_2)
Z = UnitZ(Factor=floor_to_ceiling_height)
extr = Extrude(Base=skeleton.perim_poly, Direction=Z)
partition = PartitionList(List=extr, Size=division)
extr_2 = Extrude(Base=skeleton.core_poly, Direction=Z)  # -> graft(Extrusion)
partition_2 = PartitionList(List=skeleton.perim_poly, Size=division)
ins = InsertItems(List=partition, Item=extr_2, Indices=4, Wrap=True)

# ---- group: Boundary Condition
debrep_2 = DeconstructBrep(Brep=ins)  # -> Faces, Edges, Vertices
debrep_3 = DeconstructBrep(Brep=rooms)  # -> Faces, Edges, Vertices
panel_14 = Panel("""1
4
7
10
13""")
item_4 = ListItem(List=debrep_2.Faces, Index=0, Wrap=True)
item_5 = ListItem(List=debrep_3.Faces, Index=panel_14, Wrap=True)
panel_15 = Panel("""itm_perim_east_ceil_
itm_perim_north_ceil_
itm_perim_west_ceil_
itm_perim_south_ceil_
itm_core_ceil_""")
face = HBFace(geo=flatten(item_4), name="ExposedFloor", bc="Adiabatic")  # -> report, graft(faces); plug-in component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
face_2 = HBFace(geo=debrep_2.Faces, name=graft(panel_15))  # -> report, faces; plug-in component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
face_3 = HBFace(geo=item_5, name="ExposedCeiling_", bc="Adiabatic")  # -> report, faces; plug-in component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
face_4 = HBFace(geo=debrep_3.Faces)  # -> report, faces; plug-in component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
replace = ReplaceItems(List=face_4.faces, Item=face_3.faces, Indices=panel_14, Wrap=False)
replace_2 = ReplaceItems(List=face_2.faces, Item=face.faces, Indices="0", Wrap=False)

# ---- group: Internal Mass
opaquemat_5 = HBOpaqueMaterial(
    name="Std Wood 6inch",
    thickness="0.15",
    conductivity="0.12",
    density="540",
    spec_heat="1210",
    roughness="MediumSmooth",
    therm_absp="0.9",
    sol_absp="0.7",
    vis_absp="0.7")  # -> mat; plug-in component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
opaqueconstr_11 = HBOpaqueConstruction(name="InteriorFurnishings", materials=opaquemat_5)  # -> constr; plug-in component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

# ----
bldgvintages = HBBuildingVintages({"ASHRAE 90.1 2019  |  IECC 2021": "2019", "ASHRAE 90.1 2016  |  IECC 2018": "2016", "ASHRAE 90.1 2013  |  IECC 2015": "2013", "ASHRAE 90.1 2010  |  IECC 2012": "2010", "ASHRAE 90.1 2007  |  IECC 2009": "2007", "ASHRAE 90.1 2004  |  IECC 2006": "2004", "1980-2004 (CBECS)": "1980_2004", "Pre-1980 (CBECS)": "pre_1980"}, selected="ASHRAE 90.1 2016  |  IECC 2018")
constructiontypes = HBConstructionTypes({"SteelFramed", "WoodFramed", "Mass", "Metal Building"}, selected="SteelFramed")
constrsetclimate = HBConstructionSetByClimate(climate_zone="2B", vintage=bldgvintages, constr_type=constructiontypes)  # -> constr_set; plug-in component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
searchprog = HBSearchPrograms(vintage=bldgvintages, keywords="Whole")  # -> room_prog; plug-in component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

searchprog_2 = HBSearchPrograms(vintage=bldgvintages, keywords="Plenum")  # -> room_prog; plug-in component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
item_6 = ListItem(List=searchprog_2, Index="0", Wrap=True)
item_7 = ListItem(List=searchprog, Index="3", Wrap=True)
panel_16 = Panel([item_7, item_6])

# ---- group: Room Program
deconstrprogram = HBDeconstructProgramType(program=item_7)  # -> people, lighting, electric_equip, gas_equip, hot_water, infiltration, ventilation, setpoint; plug-in component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
programtype = HBProgramType(
    name="office_prog_perimeterRms",
    people=deconstrprogram.people,
    lighting=deconstrprogram.lighting,
    electric_equip=deconstrprogram.electric_equip,
    infiltration=deconstrprogram.infiltration,
    ventilation=deconstrprogram.ventilation,
    setpoint=deconstrprogram.setpoint)  # -> program; plug-in component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
programtype_2 = HBProgramType(
    name="office_prog_core",
    people=deconstrprogram.people,
    lighting=deconstrprogram.lighting,
    electric_equip=deconstrprogram.electric_equip,
    ventilation=deconstrprogram.ventilation,
    setpoint=deconstrprogram.setpoint)  # -> program; plug-in component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

# ---- group: Rooms
panel_17 = Panel("""office_md_perim_east
office_md_perim_north
office_md_perim_west
office_md_perim_south
office_md_core""")
room = HBRoom(faces=simplify(replace_2), name=graft(panel_17), constr_set=constructionset_2, conditioned=Toggle(True))  # -> report, simplify(flatten(room)); plug-in component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

# ----
programtype_3 = HBProgramType(name="plenum_prog", base_program=item_6)  # -> program; plug-in component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

# ---- group: Plenum
room_2 = HBRoom(faces=flatten(replace), name="Plenum", constr_set=constructionset, conditioned=Toggle(False))  # -> report, room; plug-in component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

# ---- group: Cores
item_8 = ListItem(List=room.room, Index="4", Wrap=True)
applyprogram = HBApplyProgramType(rooms=item_8, program=programtype_2)  # -> report, rooms; plug-in component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

# ---- group: Perimeter Rooms
cull_i = CullIndex(List=room.room, Indices="4", Wrap=True)
applyprogram_2 = HBApplyProgramType(rooms=cull_i, program=programtype)  # -> report, simplify(rooms); plug-in component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

# ----
applyprogram_3 = HBApplyProgramType(rooms=room_2.room, program=programtype_3)  # -> report, rooms; plug-in component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

roomattr = HBRoomAttributes({"Display Name": "display_name", "Simulation Name (Identifier)": "identifier", "Multiplier": "multiplier", "Story": "story", "Volume": "volume", "Gross Floor Area": "floor_area", "Exposed Area": "exposed_area", "Exterior Wall Area": "exterior_wall_area", "Exterior Aperture Area": "exterior_aperture_area", "Average Floor Elevation": "average_floor_height"}, selected="Gross Floor Area")
roomsbyattr = HBRoomsByAttribute(rooms=graft(room_2.room), attribute=roomattr)  # -> values, rooms; plug-in component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
flatten = FlattenTree(Tree=roomsbyattr.values, Path="{0}")
srf_area_per_flr_space_area = Panel("2")
multiplication = Multiplication(A=flatten, B=srf_area_per_flr_space_area)
internalmass = HBInternalMass(rooms=applyprogram_3.rooms, geo_or_area=multiplication, construction=opaqueconstr_11, name="Internal Mass Definition 1")  # -> report, rooms; plug-in component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

ins_2 = InsertItems(List=applyprogram_2.rooms, Item=applyprogram.rooms, Indices="4", Wrap=True)

# ---- group: Rooms Per Level
solveadj = HBSolveAdjacency(rooms=ins_2, adiabatic=Toggle(False), run=Toggle(True))  # -> report, simplify(adj_rooms); plug-in component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

# ----
roomattr_2 = HBRoomAttributes({"Display Name": "display_name", "Simulation Name (Identifier)": "identifier", "Multiplier": "multiplier", "Story": "story", "Volume": "volume", "Gross Floor Area": "floor_area", "Exposed Area": "exposed_area", "Exterior Wall Area": "exterior_wall_area", "Exterior Aperture Area": "exterior_aperture_area", "Average Floor Elevation": "average_floor_height"}, selected="Gross Floor Area")
roomsbyattr_2 = HBRoomsByAttribute(rooms=graft(room.room), attribute=roomattr_2)  # -> values, rooms; plug-in component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
flatten_2 = FlattenTree(Tree=roomsbyattr_2.values, Path="{0}")
srf_area_per_flr_space_area_2 = Panel("2")
path_mapper = PathMapper(flatten_2, source="{A}(i)", target="{i\5}")
multiplication_2 = Multiplication(A=path_mapper, B=srf_area_per_flr_space_area_2)
internalmass_2 = HBInternalMass(rooms=solveadj.adj_rooms, geo_or_area=multiplication_2, construction=opaqueconstr_11, name="Internal Mass Definition 1")  # -> report, simplify(rooms); plug-in component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

# ---- group: Ideal HVAC
idealair = HBIdealAir(
    rooms=flatten(internalmass_2.rooms),
    economizer="NoEconomizer",
    sensible_hr="0",
    heat_limit="NoLimit",
    cool_limit="NoLimit")  # -> report, rooms; plug-in component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

# ---- group: Plenum Rooms
toggle = BooleanToggle(False)
plenum = HBPlenum(rooms=internalmass.rooms, conditioned=Toggle(False), remove_infilt=toggle, include_floor=toggle)  # -> rooms; plug-in component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
graft = GraftTree(Tree=plenum, IncludeEmptyLists=True, IncludeNullItems=True)  # -> simplify(Tree)

# ----
decnstrconstrset = HBDeconstructConstructionSet(constr_set=constrsetclimate)  # -> exterior_wall, exterior_roof, exposed_floor, ground_wall, ground_roof, ground_floor, window, skylight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; plug-in component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
windows = Geometry([<brep referenced from the Rhino model> x4])
aperture = HBAperture(geo=windows, name="Windows", operable=Toggle(True), ep_constr=decnstrconstrset.window)  # -> report, apertures; plug-in component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

merge_9 = Merge(Data1=graft, Data2=idealair.rooms)  # -> flatten(Result)

# ---- group: Plenum to Room per Level
solveadj_2 = HBSolveAdjacency(rooms=merge_9, adiabatic=Toggle(False), run=Toggle(True))  # -> report, simplify(adj_rooms); plug-in component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

# ----
addsubface = HBAddSubface(hb_obj=flatten(solveadj_2.adj_rooms), sub_faces=flatten(aperture.apertures))  # -> hb_obj; plug-in component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

# ---- group: Nat. Vent.
ventcontrol = HBVentilationControl(min_in_temp="23", max_in_temp="28")  # -> vent_cntrl; plug-in component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
applysetpointvals = HBApplySetpointValues(room_or_program=flatten(addsubface), cooling_setpt="29", heating_setpt="20")  # -> report, mod_obj; plug-in component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
windowopen = HBWindowOpening(rooms=flatten(applysetpointvals.mod_obj), vent_cntrl=ventcontrol, wind_cross_vent=Toggle(False))  # -> report, rooms; plug-in component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

# ----
floorheight = HBRoomsByFloorHeight(rooms=flatten(windowopen.rooms))  # -> flr_hgts, rooms; plug-in component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
bang = ExplodeTree(Data=floorheight.rooms)  # -> Branch0, Branch1
facesbytype = HBFacesByType(hb_objs=bang.Branch0)  # -> walls, interior_walls, roofs, ceilings, exterior_floors, interior_floors, air_walls, apertures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; plug-in component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
roomenergyattr = HBRoomEnergyAttributes({"Program": "properties.energy.program_type.display_name", "Construction Set": "properties.energy.construction_set.display_name", "Is Conditioned": "properties.energy.is_conditioned", "People per Area [ppl/m2]": "properties.energy.people.people_per_area", "Area per Person [m2/ppl]": "properties.energy.people.area_per_person", "Lighting per Area [W/m2]": "properties.energy.lighting.watts_per_area"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}, selected="Program")
faceenergyattr = HBFaceEnergyAttributes({"Construction": "properties.energy.construction.display_name", "Materials": "properties.energy.construction.layers", "Thickness [m]": "properties.energy.construction.thickness", "Density [kg/m2]": "properties.energy.construction.mass_area_density", "Heat Capacity [J/K-m2]": "properties.energy.construction.area_heat_capacity", "Construction R-Value [m2-K/W]": "properties.energy.construction.r_value", "Construction U-Value [W/m2-K]": "properties.energy.construction.u_value", "Construction U-Factor [W/m2-K]": "properties.energy.construction.u_factor", "Construction SHGC [Unshaded]": "properties.energy.construction.shgc", "R-Factor [m2-K/W]": "properties.energy.r_factor", "U-Factor [W/m2-K]": "properties.energy.u_factor", "SHGC [Unshaded]": "properties.energy.shgc", "Solar Transmitance [Unshaded]": "properties.energy.construction.solar_transmittance", "Visible Transmitance [Unshaded]": "properties.energy.construction.visible_transmittance", "Solar Reflectance [Outside]": "properties.energy.construction.outside_solar_reflectance", "Solar Reflectance [Inside]": "properties.energy.construction.inside_solar_reflectance", "Fraction Area Operable": "properties.energy.vent_opening.fraction_area_operable", "Fraction Height Operable": "properties.energy.vent_opening.fraction_height_operable", "Discharge Coefficient": "properties.energy.vent_opening.discharge_coefficient"}, selected="Construction")
faceattr = HBFaceAttributes({"Display Name": "display_name", "Simulation Name (Identifier)": "identifier", "Boundary Condition": "boundary_condition", "Has Parent": "has_parent", "Parent": "parent", "Azimuth": "azimuth", "Altitude": "altitude", "Area": "area", "Perimeter": "perimeter", "Face Type": "type", "Aperture Is Operable": "is_operable", "Door Is Glass": "is_glass"}, selected="Display Name")
roomattr_3 = HBRoomAttributes({"Display Name": "display_name", "Simulation Name (Identifier)": "identifier", "Multiplier": "multiplier", "Floor Area Excluded": "exclude_floor_area", "Story": "story", "Volume": "volume", "Gross Floor Area": "floor_area", "Exposed Area": "exposed_area", "Exterior Wall Area": "exterior_wall_area", "Exterior Aperture Area": "exterior_aperture_area", "Average Floor Elevation": "average_floor_height"}, selected="Simulation Name (Identifier)")
versions = HBCheckVersions()  # -> lbt_gh, python, radiance, openstudio, energyplus; plug-in component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
versions_2 = HBCheckVersions()  # -> lbt_gh, python, radiance, openstudio, energyplus; plug-in component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
labelrooms = HBLabelRooms(rooms_model=flatten(windowopen.rooms), attribute=roomenergyattr)  # -> label_text, base_pts, labels, wire_frame; plug-in component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
lablefaces = HBLabelFaces(hb_objs=flatten(facesbytype.ceilings), attribute=faceattr)  # -> label_text, base_pts, labels, wire_frame; plug-in component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
vizbytype = HBVisualizeByType(hb_objs=windowopen.rooms)  # -> walls, interior_walls, roofs, ceilings, exterior_floors, interior_floors, air_walls, apertures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; plug-in component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
vizbybc = HBVisualizeByBC(hb_objs=windowopen.rooms)  # -> outdoors, surface, ground, adiabatic, other, wire_frame; plug-in component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
model = HBModel(rooms=flatten(windowopen.rooms), name="20231128_MidOffice_Baseline_Measure")  # -> report, model; plug-in component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
panel_18 = Panel(versions.lbt_gh)
panel_19 = Panel(versions.openstudio)
panel_20 = Panel(versions_2.openstudio)
panel_21 = Panel(versions_2.lbt_gh)
geo = Geometry(vizbybc.surface)
geo_2 = Geometry(vizbytype.interior_walls)
geo_3 = Geometry(vizbytype.ceilings)
geo_4 = Geometry(vizbytype.interior_floors)
geo_5 = Geometry(vizbytype.apertures)
geo_6 = Geometry(vizbytype.wire_frame)
panel_22 = Panel(lablefaces.label_text)
afn = HBAirflowNewtwork(model=model.model)  # -> report, model; plug-in component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
# AFN Surface Venting Window or Door Opening Factor
panel_23 = Panel("""AFN Surface Venting Window or Door Opening Factor
Surface Inside Face Convection Heat Transfer Coefficient""")
geo_7 = Geometry([vizbytype.roofs, vizbytype.exterior_floors])
toggle_2 = BooleanToggle(True)
simcontrol = HBSimulationControl(
    do_zone_sizing=toggle_2,
    do_system_sizing=toggle_2,
    do_plant_sizing=toggle_2,
    for_sizing_period=Toggle(False),
    for_run_period=toggle_2)  # -> sim_control; plug-in component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
shadowcalc = HBShadowCalculation(solar_dist="FullInteriorAndExterior", frequency="30", max_figures="15000")  # -> shadow_calc; plug-in component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
toggle_3 = BooleanToggle(True)
ddy_2b_sv = FilePath("C:\Users\admin\masterwin\thermal\epw\USA_AZ_Tucson-Davis-Monthan.AFB.722745_TMY3\USA_AZ_Tucson-Davis-Monthan.AFB.722745_TMY3.ddy")
epw_2b_sv = FilePath("C:\Users\admin\masterwin\thermal\epw\USA_AZ_Tucson-Davis-Monthan.AFB.722745_TMY3\USA_AZ_Tucson-Davis-Monthan.AFB.722745_TMY3.epw")
simoutput = HBSimulationOutput(
    zone_energy_use=toggle_3,
    hvac_energy_use=toggle_3,
    gains_and_losses=toggle_3,
    comfort_metrics=toggle_3,
    surface_temperature=toggle_3,
    surface_energy_flow=toggle_3)  # -> report, sim_output; plug-in component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
customoutput = HBCustomSimulationOutput(base_sim_output=simoutput.sim_output, output_names=panel_23)  # -> report, sim_output; plug-in component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
panel_24 = Panel("C:\Users\admin\masterwin\thermal\measures\CreateTypicalDOEBuildingFromModel")
panel_25 = Panel([epw_2b_sv, ddy_2b_sv])
sizingpar = HBSizingParameter(ddy_file=ddy_2b_sv, heating_fac="1", cooling_fac="1")  # -> sizing; plug-in component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
simpar = HBSimulationParameter(output=customoutput.sim_output, timestep=6, sim_control=simcontrol, shadow_calc=shadowcalc, sizing=sizingpar)  # -> sim_par; plug-in component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
toggle_4 = BooleanToggle(True)
toggle_5 = BooleanToggle(False)
path = FilePath(panel_24)
create_typical_doe_building_from_model = CreateTypicalDOEBuildingFromModel(
    measure_path=path,
    template="90.1-2016",
    system_type="Inferred",
    swh_src="Inferred",
    add_constructions=toggle_5,
    add_space_type_loads=toggle_5,
    add_elevators=toggle_5,
    add_internal_mass=toggle_5,
    add_exterior_lights=toggle_4,
    add_swh=toggle_4,
    add_thermostat=toggle_5,
    add_hvac=toggle_5,
    add_refrigeration=toggle_5,
    remove_objects=toggle_4)  # -> report, measure; plug-in component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
modeltoosm = HBModelToOSM(model=afn.model, epw_file=epw_2b_sv, sim_par=simpar, write=Toggle(True), run="2")  # -> report, jsons, osw, osm, idf, sql, zsz, rdd, html; plug-in component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
toggle_6 = BooleanToggle(False)
toggle_7 = BooleanToggle(True)
swaposm = SwapOSM(
    osm=modeltoosm.osm,
    epw=epw_2b_sv,
    mea=create_typical_doe_building_from_model.measure,
    run_swap=toggle_7,
    run_sim=toggle_7,
    update=Toggle(False))  # -> out, osm, osm_swap, idf, sql, zsz, rdd, html, err; inputs mea: list
# ---------- swaposm: Python ----------
"""Run swap.py from subprocess on LBT python."""
from __future__ import print_function
import sys
import os
import json
from pprint import pprint
from subprocess import Popen, PIPE, STDOUT
from honeybee.config import folders as hb_config
from honeybee_energy.config import folders as hbe_config
from honeybee_energy.measure import Measure
from ladybug_rhino.download import download_file


# Global
path = os.path
SWAP_URL = "https://raw.githubusercontent.com/saeranv/thermal/main/lbt/swap.py"
SWAP_NAME = "swap.py"
IS_TTY = sys.stdin.isatty() or len(sys.argv) > 1


def run_subproc(cmds):
    """Run subprocess for list of commands (cmds)."""

    print("Running command:\n{}\n".format(" ".join(cmds)))
    p = Popen(cmds, shell=True, stdout=PIPE, stderr=PIPE)
    _stdout, _stderr = p.communicate()

    assert p.returncode == 0, \
        "stdout:\n{}\nstderr:\n{}".format(_stdout, _stderr)
    return _stdout, _stderr


def update_swap(_swap_fpath):
    """Update swap.py from github and confirm in lbt scripts path."""

    _ = download_file(SWAP_URL, _swap_fpath)
    print("## Downloaded {} from {}.".format(SWAP_NAME, SWAP_URL))

    assert path.exists(_swap_fpath), \
        "Path {} not exist.\n".format(_swap_fpath)


def update_pip(_lbt_pytexe, _ops_version):
    """Update openstudio SDK via pip."""

    # Check if pip opesntudio is updated
    cmds = [_lbt_pytexe, "-m", "pip", "list"]
    _stdout = run_subproc(cmds)[0]
    pkgs = _stdout.decode("utf-8").strip().split("\n")
    is_pip_match = False
    for pkg in pkgs:
        if "openstudio" in pkg:
            _ops_version_ = pkg.split("openstudio")[1].strip()
            print("## Found openstudio {} in pip.".format(_ops_version_))
            is_pip_match = _ops_version_ == _ops_version
            break

    if not is_pip_match:
        # Pip install openstudio if not in pip or version wrong
        _ops_pkg = "openstudio=={}".format(_ops_version)
        cmds = [_lbt_pytexe, "-m", "pip", "install", _ops_pkg]

        _stdout, _stderr = run_subproc(cmds)
        if _stdout: print(_stdout.decode("utf-8").strip())
        if _stderr: print(_stderr.decode("utf-8").strip())


def dump_mea(measure, osm_fpath):
    """Dump measure to osw file."""

    osw_fpath = path.join(path.dirname(osm_fpath), "workflow.osw")
    osw_dict = measure.to_osw_dict()
    osw_dict["measure_paths"] = [measure.folder]
    with open(osw_fpath, "w") as fp:
        json.dump(osw_dict, fp, indent=4)
    return osw_fpath

if IS_TTY:
    # Label bool, fpath inputs
    run_swap_, run_sim_, update_ = True, True, True
    _osm, _epw, _mea_dpath = sys.argv[-3:]
    mea = Measure(_mea_dpath)

if run_swap_ or run_sim_ or update_:

    # # Overwrite
    # update_ = False
    # run_swap_ = False
    # run_sim_ = False
    _osw_swap, _osm_swap = None, None
    swap_fpath = path.join(hb_config.python_scripts_path, SWAP_NAME)
    lbt_pytexe = hb_config.python_exe_path
    lbt_opsexe = hbe_config.openstudio_exe
    opsv_ = hbe_config.openstudio_version
    ops_version = "{}.{}.{}".format(opsv_[0], opsv_[1], opsv_[2])
    runsim_dpath = path.join(path.dirname(_osm), "run") # sim dpath is child
    # # TODO: only for debugging
    # swap_fpath = path.abspath(path.join(_epw, "../../../lbt", SWAP_NAME))

    # Update/confirm swap_fpath exists
    if update_ or (not path.exists(swap_fpath)):
        _ = update_swap(swap_fpath)
        _ = update_pip(lbt_pytexe, ops_version)

    if run_swap_:
        # Run swap
        print("\n## Running swap.py on lbtpyt.exe")

        # Update measure, and run swap_win.py
        _osw = dump_mea(_mea[0], _osm)
        swap_cmds = [lbt_pytexe, swap_fpath, _osw, _osm, _epw]
        stdout, stderr = run_subproc(swap_cmds)
        _osm_swap, _osw_swap = \
            stdout.decode('utf-8').strip().split("\n")[-2:]
        if stdout: print(stdout.decode('utf-8'))
        if stderr: print(stderr.decode('utf-8'))

    if run_sim_:
        # Run workflow.osw
        print("\n## Running workflow.osw on openstudio.exe")

        if not _osw_swap:
            _osw_swap = path.join(runsim_dpath, "workflow_swap.osw")

        assert path.exists(_osw_swap), \
            "OSW not found at {}".format(_osw_swap)

        sim_cmds = [lbt_opsexe, "run", "-w", _osw_swap]
        stdout, stderr = run_subproc(sim_cmds)
        if stdout: print(stdout)
        if stderr: print(stderr)

        # Get outputs
        # print(runsim_dpath, ":\n", os.listdir(runsim_dpath))
        _sql = path.join(runsim_dpath, "eplusout.sql")
        _err = path.join(runsim_dpath, "eplusout.err")
        if path.exists(_sql):
            osm = path.join(runsim_dpath, "in.osm")
            idf = path.join(runsim_dpath, "in.idf")
            zsz = path.join(runsim_dpath, "epluszsz.csv")
            rdd = path.join(runsim_dpath, "eplus.rdd")
            html = path.join(runsim_dpath, "eplustbl.htm")
            sql = _sql
            print(osm, idf, zsz, rdd, html, err, sql, sep="\n")
        if path.exists(_err):
            err = _err
# ---------- end swaposm ----------
eui = HBEndUseIntensity(sql=swaposm.sql, ip=Toggle(False))  # -> eui, eui_end_use, end_uses, gross_floor; plug-in component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
faceresult = HBReadFaceResult(sql=swaposm.sql)  # -> face_indoor_temp, face_outdoor_temp, face_energy_flow; plug-in component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
customresult = HBReadCustomResult(sql=swaposm.sql, output_names=panel_23)  # -> results; plug-in component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
roomenergyresult = HBReadRoomEnergyResult(sql=swaposm.sql)  # -> cooling, heating, lighting, electric_equip, gas_equip, process, hot_water, fan_electric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; disabled; plug-in component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
analysisperiod = LBAnalysisPeriod(start_month="3", start_day="1", start_hour=0, end_month="3", end_day="2")  # -> period, hoys, dates; plug-in component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
importepw = LBImportEPW(epw_file=epw_2b_sv)  # -> location, dry_bulb_temperature, dew_point_temperature, relative_humidity, wind_speed, wind_direction, direct_normal_rad, diffuse_horizontal_rad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; plug-in component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
roomcomfortresult = HBReadRoomComfortResult(sql=swaposm.sql)  # -> oper_temp, air_temp, rad_temp, rel_humidity; plug-in component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
panel_26 = Panel("""Acoustic Tile
102.788
ITM-1
102.314""")
panel_27 = Panel(eui.eui)
panel_28 = Panel(eui.end_uses)
bang_2 = ExplodeTree(Data=simplify(customresult))  # -> Branch0, Branch1
applyper = LBApplyAnalysisPeriod(data=importepw.dry_bulb_temperature, period=analysisperiod.period)  # -> simplify(data); plug-in component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
panel_29 = Panel(swaposm.osm_swap)
panel_30 = Panel(swaposm.osm)
applyper_2 = LBApplyAnalysisPeriod(data=roomcomfortresult.air_temp, period=analysisperiod.period)  # -> simplify(data); plug-in component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
applyper_3 = LBApplyAnalysisPeriod(data=bang_2.Branch1, period=analysisperiod.period)  # -> simplify(data); plug-in component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
applyper_4 = LBApplyAnalysisPeriod(data=faceresult.face_indoor_temp, period=analysisperiod.period)  # -> simplify(data); plug-in component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
panel_31 = Panel(eui.eui_end_use)
faceresultbytype = HBFaceResultByType(data=applyper_4, hb_objs=windowopen.rooms)  # -> walls, interior_walls, roofs, ceilings, exterior_floors, interior_floors, apertures, interior_apertures, doors, interior_doors; plug-in component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
panel_32 = Panel(swaposm.out)
faceresultbytype_2 = HBFaceResultByType(data=applyper_3, hb_objs=windowopen.rooms)  # -> walls, interior_walls, roofs, ceilings, exterior_floors, interior_floors, apertures, interior_apertures, doors, interior_doors; plug-in component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
bang_3 = ExplodeTree(Data=simplify(graft(applyper_2)))  # -> Branch0, Branch1, Branch2, Branch3, Branch4, Branch5
xdata = LBDeconstructData(data=applyper)  # -> header, flatten(values); plug-in component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
xdata_2 = LBDeconstructData(data=bang_3.Branch3)  # -> header, flatten(values); plug-in component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
bang_4 = ExplodeTree(Data=simplify(graft(faceresultbytype.ceilings)))  # -> Branch0, Branch1, Branch2, Branch3
bang_5 = ExplodeTree(Data=simplify(graft(faceresultbytype_2.ceilings)))  # -> Branch0, Branch1, Branch2, Branch3
panel_33 = Panel(xdata_2.header)
panel_34 = Panel(xdata_2.values)
graph = QuickGraph([xdata.values, xdata_2.values], SortOrder=0)
xdata_3 = LBDeconstructData(data=bang_4.Branch3)  # -> header, values; plug-in component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
panel_35 = Panel(xdata_3.header)
xdata_4 = LBDeconstructData(data=faceresultbytype_2.ceilings)  # -> header, values; plug-in component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
xdata_5 = LBDeconstructData(data=bang_5.Branch0)  # -> header, values; plug-in component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
xdata_6 = LBDeconstructData(data=bang_5.Branch1)  # -> header, values; plug-in component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
xdata_7 = LBDeconstructData(data=bang_5.Branch2)  # -> header, values; plug-in component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
xdata_8 = LBDeconstructData(data=bang_5.Branch3)  # -> header, values; plug-in component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
merge_10 = Merge(Data1=xdata_3.values, Data2=xdata_2.values)
panel_36 = Panel(xdata_4.header)
sort = SortList(Keys=flatten([xdata_5.values, xdata_6.values, xdata_7.values, xdata_8.values]))  # -> Keys, ValuesA
panel_37 = Panel(xdata.header)
panel_38 = Panel(xdata.values)
graph_2 = QuickGraph(merge_10, SortOrder=0)
avr = Average(Input=sort.Keys)
panel_39 = Panel(avr)
bar_graph = BarGraph(sort.Keys, BarColor=RGB(255, 0, 90))
graph_3 = QuickGraph(xdata_5.values, SortOrder=0)
rev = ReverseList(List=sort.Keys)
panel_40 = Panel(rev)
